# Grasshopper definition UTCI_actual_future_delta_statistics.gh (Grasshopper 1.0.8)
# plug-ins: LadybugGrasshopper

# ----
# 3. Turn the toggle into "true" to calculate the UTCI
falsestart = LBFalseStartToggle(True)

# ----
# 2. Insert path to future EPW
future_epw = FilePath("D:\Marcello\Dropbox\PhD Parma\BERKELEY\CLIMA TOOL\EPWs\Berkeley_2070-8.5.epw")

# ---- group: Insert path to current EPW
# File: UTCI_actual_future_delta_statistics.gh
# Additional plugins: Ladybug Tools version 1.8.0
# 1. Insert path to current EPW
current_epw = FilePath("D:\Marcello\Dropbox\PhD Parma\BERKELEY\CLIMA TOOL\EPWs\Berkeley_Actual.epw")

# ----
# Settings
statistics_graph_width = Slider(10, range=0..100)
main_title_position = Slider(40, range=0..100)
statistics_bars_height = Slider(20, range=0.1..100)
lower_graph_width = Slider(600, range=0..1000)
graphs_height = Slider(200, range=0..1000)
statistics_data_size = Slider(6, range=0.1..10)
main_title_size = Slider(7, range=0.1..10)
labels_offset = Slider(-3, range=-3..0)
titles_size = Slider(6.5, range=0.1..10)
labels_size = Slider(5, range=0.1..10)
main_lines_colour = ColourSwatch(SwatchColor=RGB(128, 128, 128))
labels_colour = ColourSwatch(SwatchColor=RGB(0, 0, 0))

# ----
# Data
importepw = LBImportEPW(epw_file=current_epw)  # -> location, dry_bulb_temperature, dew_point_temperature, relative_humidity, wind_speed, wind_direction, direct_normal_rad, diffuse_horizontal_rad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; plug-in component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
importepw_2 = LBImportEPW(epw_file=future_epw)  # -> location, dry_bulb_temperature, dew_point_temperature, relative_humidity, wind_speed, wind_direction, direct_normal_rad, diffuse_horizontal_rad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; plug-in component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
hourlyplot = LBHourlyPlot(data=importepw.dry_bulb_temperature)  # -> report, mesh, legend, borders, labels, title, vis_set; plug-in component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

# ----
# MRT + UTCI
panel = Panel("90")
dirsolar = LBDirectionalSolarIrradiance(
    location=importepw.location,
    direct_norm=importepw.direct_normal_rad,
    diffuse_horiz=importepw.diffuse_horizontal_rad,
    srf_altitude=panel)  # -> report, total, direct, diff, reflect; plug-in component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
dirsolar_2 = LBDirectionalSolarIrradiance(
    location=importepw_2.location,
    direct_norm=importepw_2.direct_normal_rad,
    diffuse_horiz=importepw_2.diffuse_horizontal_rad,
    srf_altitude="90")  # -> report, total, direct, diff, reflect; plug-in component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
outdoorsolarmrt = LBOutdoorSolarMRT(
    location=importepw_2.location,
    surface_temp=importepw_2.dry_bulb_temperature,
    dir_norm_rad=dirsolar_2.direct,
    diff_horiz_rad=importepw_2.diffuse_horizontal_rad,
    horiz_infrared=importepw_2.horizontal_infrared_rad,
    fract_body_exp="1",
    run=falsestart)  # -> report, short_erf, long_erf, short_dmrt, long_dmrt, mrt; plug-in component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
outdoorsolarmrt_2 = LBOutdoorSolarMRT(
    location=importepw.location,
    surface_temp=importepw.dry_bulb_temperature,
    dir_norm_rad=dirsolar.direct,
    diff_horiz_rad=importepw.diffuse_horizontal_rad,
    horiz_infrared=importepw.horizontal_infrared_rad,
    fract_body_exp="1",
    run=falsestart)  # -> report, short_erf, long_erf, short_dmrt, long_dmrt, mrt; plug-in component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
utci = LBUTCIComfort(
    air_temp=importepw_2.dry_bulb_temperature,
    mrt=outdoorsolarmrt.mrt,
    rel_humid=importepw_2.relative_humidity,
    wind_vel=importepw_2.wind_speed,
    run=falsestart)  # -> report, utci, comfort, condition, category, comf_obj; plug-in component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
utci_2 = LBUTCIComfort(
    air_temp=importepw.dry_bulb_temperature,
    mrt=outdoorsolarmrt_2.mrt,
    rel_humid=importepw.relative_humidity,
    wind_vel=importepw.wind_speed,
    run=falsestart)  # -> report, utci, comfort, condition, category, comf_obj; plug-in component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

X = UnitX(Factor=Slider(10, range=0..30))
division = Division(A=graphs_height, B="96")
division_2 = Division(A=lower_graph_width, B="365")

# ----
# Labels and lines
panel_2 = Panel("24")
division_3 = Division(A=graphs_height, B=panel_2)
hourlyplot_2 = LBHourlyPlot(data=importepw.dry_bulb_temperature, x_dim=division_2, y_dim=division_3)  # -> report, mesh, legend, borders, labels, title, vis_set; plug-in component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
txt = Text(hourlyplot_2.labels)
split = SplitList(List=txt, Index="5")  # -> ListA, ListB
dom = ConstructDomain(DomainStart="1", DomainEnd="5")
subset = SubList(List=hourlyplot_2.borders, Domain=dom, Wrap=True)  # -> List, Index
eval = EvaluateCurve(Curve=hourlyplot_2.borders, Parameter="0")  # -> Point, Tangent, Angle
Y = UnitY(Factor=1)
end = EndPoints(Curve=subset.List)  # -> Start, End
mindex = MemberIndex(Set=eval.Tangent, Member=Y)  # -> Index, Count
item = ListItem(List=hourlyplot_2.borders, Index=mindex.Index, Wrap=True)
end_2 = EndPoints(Curve=item)  # -> Start, End
pdecon = Deconstruct(Point=end_2.Start)  # -> XComponent, YComponent, ZComponent
ins = InsertItems(List=pdecon.XComponent, Item="0", Indices="0", Wrap=True)
ins_2 = InsertItems(List=pdecon.XComponent, Item=lower_graph_width, Indices="-1", Wrap=True)
pt = ConstructPoint(XCoordinate=ins, YCoordinate=0, ZCoordinate=0)
pt_2 = ConstructPoint(XCoordinate=ins_2, YCoordinate=0, ZCoordinate=0)
ln = Line(StartPoint=pt, EndPoint=pt_2)
midpt = CurveMiddle(Curve=ln)
addition = Addition(B=labels_offset)
Y_2 = UnitY(Factor=addition)
move = Move(Geometry=midpt, Motion=Y_2)  # -> Geometry, Transform

item_2 = ListItem(List=end.End, Index=0, Wrap=True)
move_2 = Move(Geometry=item_2, Motion=X)  # -> Geometry, Transform

# ----
# Base point
item_3 = ListItem(List=hourlyplot_2.borders, Index=0, Wrap=True)
cpoly = ControlPolygon(Curve=item_3)  # -> Polygon, Points
panel_3 = Panel("""0
1""")
item_4 = ListItem(List=cpoly.Points, Index=panel_3, Wrap=True)
bang = ExplodeTree(Data=graft(item_4))  # -> _0000, _0001
multiplication = Multiplication(A=statistics_bars_height, B="3")
addition_2 = Addition(A=multiplication, B="50")
ln_2 = Line(StartPoint=bang._0000, EndPoint=bang._0001)
neg = Negative(Value=addition_2)
midpt_2 = CurveMiddle(Curve=ln_2)
Y_3 = UnitY(Factor=neg)
move_3 = Move(Geometry=midpt_2, Motion=Y_3)  # -> Geometry, Transform
pt_3 = Point(Point(0, 0, 0))
vec2pt = Vector2Pt(PointA=pt_3, PointB=move_3.Geometry, Unitize=False)  # -> Vector, Length

# ----
# Statistics
X_2 = UnitX(Factor=expr("-x", labels_offset))

# ----
# Delta
X_3 = UnitX(Factor=labels_offset)
move_4 = Move(Geometry=end.Start, Motion=X_3)  # -> Geometry, Transform
tag = TextTag3D(Location=move.Geometry, Text=split.ListB, Size=labels_size, Colour=labels_colour, Justification=2)
preview = CustomPreview(Geometry=hourlyplot_2.borders, Material=main_lines_colour)
tag_2 = TextTag3D(Location=move_4.Geometry, Text=split.ListA, Size=labels_size, Colour=labels_colour, Justification=6)

# ----
# Future
panel_4 = Panel("250")
Y_4 = UnitY(Factor=panel_4)
move_5 = Move(Geometry=move.Geometry, Motion=Y_4)  # -> Geometry, Transform
move_6 = Move(Geometry=move_4.Geometry, Motion=Y_4)  # -> Geometry, Transform
move_7 = Move(Geometry=hourlyplot_2.borders, Motion=Y_4)  # -> Geometry, Transform
preview_2 = CustomPreview(Geometry=move_7.Geometry, Material=main_lines_colour)
tag_3 = TextTag3D(Location=move_6.Geometry, Text=split.ListA, Size=labels_size, Colour=labels_colour, Justification=6)
tag_4 = TextTag3D(Location=move_5.Geometry, Text=split.ListB, Size=labels_size, Colour=labels_colour, Justification=2)

# ----
# Mesh future
xdata = LBDeconstructData(data=utci.utci)  # -> header, simplify(values); plug-in component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
mesh = Mesh(hourlyplot.mesh)
larger = LargerThan(FirstNumber=xdata.values, SecondNumber="46")  # -> LargerThan, OrEqualTo
smaller = SmallerThan(FirstNumber=xdata.values, SecondNumber="46")  # -> SmallerThan, OrEqualTo
smaller_2 = SmallerThan(FirstNumber=xdata.values, SecondNumber="38")  # -> SmallerThan, OrEqualTo
larger_2 = LargerThan(FirstNumber=xdata.values, SecondNumber="38")  # -> LargerThan, OrEqualTo
smaller_3 = SmallerThan(FirstNumber=xdata.values, SecondNumber="32")  # -> SmallerThan, OrEqualTo
larger_3 = LargerThan(FirstNumber=xdata.values, SecondNumber="32")  # -> LargerThan, OrEqualTo
smaller_4 = SmallerThan(FirstNumber=xdata.values, SecondNumber="-40")  # -> SmallerThan, OrEqualTo
larger_4 = LargerThan(FirstNumber=xdata.values, SecondNumber="26")  # -> LargerThan, OrEqualTo
smaller_5 = SmallerThan(FirstNumber=xdata.values, SecondNumber="26")  # -> SmallerThan, OrEqualTo
smaller_6 = SmallerThan(FirstNumber=xdata.values, SecondNumber="-27")  # -> SmallerThan, OrEqualTo
smaller_7 = SmallerThan(FirstNumber=xdata.values, SecondNumber="0")  # -> SmallerThan, OrEqualTo
larger_5 = LargerThan(FirstNumber=xdata.values, SecondNumber="9")  # -> LargerThan, OrEqualTo
larger_6 = LargerThan(FirstNumber=xdata.values, SecondNumber="-40")  # -> LargerThan, OrEqualTo
larger_7 = LargerThan(FirstNumber=xdata.values, SecondNumber="-13")  # -> LargerThan, OrEqualTo
smaller_8 = SmallerThan(FirstNumber=xdata.values, SecondNumber="-13")  # -> SmallerThan, OrEqualTo
larger_8 = LargerThan(FirstNumber=xdata.values, SecondNumber="-27")  # -> LargerThan, OrEqualTo
smaller_9 = SmallerThan(FirstNumber=xdata.values, SecondNumber="9")  # -> SmallerThan, OrEqualTo
larger_9 = LargerThan(FirstNumber=xdata.values, SecondNumber="0")  # -> LargerThan, OrEqualTo
and = GateAnd(A=larger_2.OrEqualTo, B=smaller.SmallerThan)
and_2 = GateAnd(A=larger_3.OrEqualTo, B=smaller_2.SmallerThan)
and_3 = GateAnd(A=larger_4.OrEqualTo, B=smaller_3.SmallerThan)
and_4 = GateAnd(A=larger_5.OrEqualTo, B=smaller_5.SmallerThan)
and_5 = GateAnd(A=larger_6.OrEqualTo, B=smaller_6.SmallerThan)
and_6 = GateAnd(A=larger_7.OrEqualTo, B=smaller_7.SmallerThan)
and_7 = GateAnd(A=larger_8.OrEqualTo, B=smaller_8.SmallerThan)
and_8 = GateAnd(A=larger_9.OrEqualTo, B=smaller_9.SmallerThan)
ma = MassAddition(Input=larger.OrEqualTo)  # -> Result, PartialResults
ma_2 = MassAddition(Input=and_6)  # -> Result, PartialResults
ma_3 = MassAddition(Input=and_7)  # -> Result, PartialResults
ma_4 = MassAddition(Input=and_5)  # -> Result, PartialResults
ma_5 = MassAddition(Input=smaller_4.SmallerThan)  # -> Result, PartialResults
ma_6 = MassAddition(Input=and_8)  # -> Result, PartialResults
ma_7 = MassAddition(Input=and_2)  # -> Result, PartialResults
ma_8 = MassAddition(Input=and_3)  # -> Result, PartialResults
ma_9 = MassAddition(Input=and)  # -> Result, PartialResults
mindex_2 = MemberIndex(Set=and_2, Member=Toggle(True))  # -> Index, Count
mindex_3 = MemberIndex(Set=and_3, Member=Toggle(True))  # -> Index, Count
mindex_4 = MemberIndex(Set=and, Member=Toggle(True))  # -> Index, Count
cullf = CullFaces(Mesh=mesh, Pattern=invert(and_5))
cullf_2 = CullFaces(Mesh=mesh, Pattern=invert(smaller_4.SmallerThan))
cullf_3 = CullFaces(Mesh=mesh, Pattern=invert(and_6))
cullf_4 = CullFaces(Mesh=mesh, Pattern=invert(and_7))
cullf_5 = CullFaces(Mesh=mesh, Pattern=invert(and_2))
cullf_6 = CullFaces(Mesh=mesh, Pattern=invert(and_4))
cullf_7 = CullFaces(Mesh=mesh, Pattern=invert(and_8))
cullf_8 = CullFaces(Mesh=mesh, Pattern=invert(and_3))
cullf_9 = CullFaces(Mesh=mesh, Pattern=invert(and))
cullf_10 = CullFaces(Mesh=mesh, Pattern=invert(larger.OrEqualTo))
mcol = MeshColours(Mesh=cullf_9, Colours=ColourSwatch(SwatchColor=RGB(204, 0, 0)))
mcol_2 = MeshColours(Mesh=cullf_5, Colours=ColourSwatch(SwatchColor=RGB(255, 51, 0)))
mcol_3 = MeshColours(Mesh=cullf_10, Colours=ColourSwatch(SwatchColor=RGB(128, 0, 0)))
mcol_4 = MeshColours(Mesh=cullf_8, Colours=ColourSwatch(SwatchColor=RGB(255, 102, 0)))
mcol_5 = MeshColours(Mesh=cullf_3, Colours=ColourSwatch(SwatchColor=RGB(0, 96, 255)))
mcol_6 = MeshColours(Mesh=cullf_7, Colours=ColourSwatch(SwatchColor=RGB(0, 192, 255)))
mcol_7 = MeshColours(Mesh=cullf_6, Colours=ColourSwatch(SwatchColor=RGB(0, 192, 0)))
mcol_8 = MeshColours(Mesh=cullf_4, Colours=ColourSwatch(SwatchColor=RGB(0, 0, 255)))
mcol_9 = MeshColours(Mesh=cullf, Colours=ColourSwatch(SwatchColor=RGB(0, 0, 192)))
mcol_10 = MeshColours(Mesh=cullf_2, Colours=ColourSwatch(SwatchColor=RGB(0, 0, 128)))
mjoin = MeshJoin(Meshes=[mcol_3, mcol, mcol_2, mcol_4, mcol_7, mcol_6, mcol_5, mcol_8, mcol_9, mcol_10])
scale_nu = ScaleNU(Geometry=mjoin, Plane=PlaneXY(0, 0, 0), ScaleX=division_2, ScaleY=division, ScaleZ=1)  # -> Geometry, Transform
move_8 = Move(Geometry=scale_nu.Geometry, Motion=Y_4)  # -> Geometry, Transform

# ----
# Graphs title
item_5 = ListItem(List=hourlyplot_2.borders, Index=0, Wrap=True)
cpoly_2 = ControlPolygon(Curve=item_5)  # -> Polygon, Points
item_6 = ListItem(List=cpoly_2.Points, Index="-2", Wrap=True)
Y_5 = UnitY(Factor="14")
Y_6 = UnitY(Factor="-50")
move_9 = Move(Geometry=item_6, Motion=Y_5)  # -> Geometry, Transform
move_10 = Move(Geometry=move_9.Geometry, Motion=Y_4)  # -> Geometry, Transform
move_11 = Move(Geometry=Y_6, Motion=Y_5)  # -> Geometry, Transform
move_12 = Move(Geometry=move_10.Geometry, Motion=Y_4)  # -> Geometry, Transform
tag_5 = TextTag3D(Location=move_9.Geometry, Text="Delta", Size=titles_size, Colour=labels_colour, Justification=7)
tag_6 = TextTag3D(Location=move_11.Geometry, Text="Statistics", Size=titles_size, Colour=labels_colour, Justification=7)
tag_7 = TextTag3D(Location=move_12.Geometry, Text="Actual", Size=titles_size, Colour=labels_colour, Justification=7)
tag_8 = TextTag3D(Location=move_10.Geometry, Text="Future", Size=titles_size, Colour=labels_colour, Justification=7)

# ----
# Main title
panel_5 = Panel(",")
split_2 = TextSplit(Text=importepw.location, Separators=panel_5)
item_7 = ListItem(List=split_2, Index=0, Wrap=True)
merge = Merge(Data1="UTCI", Data2=item_7)  # -> flatten(Result)
Y_7 = UnitY(Factor=main_title_position)
move_13 = Move(Geometry=move_12.Geometry, Motion=Y_7)  # -> Geometry, Transform
join = TextJoin(Text=merge, Join="_")
tag_9 = TextTag3D(Location=move_13.Geometry, Text=join, Size=main_title_size, Colour=labels_colour, Justification=7)

# ----
# Actual
panel_6 = Panel("500")
Y_8 = UnitY(Factor=panel_6)
move_14 = Move(Geometry=move.Geometry, Motion=Y_8)  # -> Geometry, Transform
move_15 = Move(Geometry=move_4.Geometry, Motion=Y_8)  # -> Geometry, Transform
move_16 = Move(Geometry=hourlyplot_2.borders, Motion=Y_8)  # -> Geometry, Transform
preview_3 = CustomPreview(Geometry=move_16.Geometry, Material=main_lines_colour)
tag_10 = TextTag3D(Location=move_14.Geometry, Text=split.ListB, Size=labels_size, Colour=labels_colour, Justification=2)
tag_11 = TextTag3D(Location=move_15.Geometry, Text=split.ListA, Size=labels_size, Colour=labels_colour, Justification=6)

# ----
# Mesh actual
xdata_2 = LBDeconstructData(data=utci_2.utci)  # -> header, simplify(values); plug-in component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
mesh_2 = Mesh(hourlyplot.mesh)
larger_10 = LargerThan(FirstNumber=xdata_2.values, SecondNumber="46")  # -> LargerThan, OrEqualTo
smaller_10 = SmallerThan(FirstNumber=xdata_2.values, SecondNumber="46")  # -> SmallerThan, OrEqualTo
smaller_11 = SmallerThan(FirstNumber=xdata_2.values, SecondNumber="38")  # -> SmallerThan, OrEqualTo
larger_11 = LargerThan(FirstNumber=xdata_2.values, SecondNumber="38")  # -> LargerThan, OrEqualTo
smaller_12 = SmallerThan(FirstNumber=xdata_2.values, SecondNumber="32")  # -> SmallerThan, OrEqualTo
larger_12 = LargerThan(FirstNumber=xdata_2.values, SecondNumber="32")  # -> LargerThan, OrEqualTo
smaller_13 = SmallerThan(FirstNumber=xdata_2.values, SecondNumber="-40")  # -> SmallerThan, OrEqualTo
larger_13 = LargerThan(FirstNumber=xdata_2.values, SecondNumber="26")  # -> LargerThan, OrEqualTo
smaller_14 = SmallerThan(FirstNumber=xdata_2.values, SecondNumber="26")  # -> SmallerThan, OrEqualTo
smaller_15 = SmallerThan(FirstNumber=xdata_2.values, SecondNumber="-27")  # -> SmallerThan, OrEqualTo
smaller_16 = SmallerThan(FirstNumber=xdata_2.values, SecondNumber="0")  # -> SmallerThan, OrEqualTo
larger_14 = LargerThan(FirstNumber=xdata_2.values, SecondNumber="9")  # -> LargerThan, OrEqualTo
larger_15 = LargerThan(FirstNumber=xdata_2.values, SecondNumber="-40")  # -> LargerThan, OrEqualTo
larger_16 = LargerThan(FirstNumber=xdata_2.values, SecondNumber="-13")  # -> LargerThan, OrEqualTo
smaller_17 = SmallerThan(FirstNumber=xdata_2.values, SecondNumber="-13")  # -> SmallerThan, OrEqualTo
larger_17 = LargerThan(FirstNumber=xdata_2.values, SecondNumber="-27")  # -> LargerThan, OrEqualTo
smaller_18 = SmallerThan(FirstNumber=xdata_2.values, SecondNumber="9")  # -> SmallerThan, OrEqualTo
larger_18 = LargerThan(FirstNumber=xdata_2.values, SecondNumber="0")  # -> LargerThan, OrEqualTo
and_9 = GateAnd(A=larger_11.OrEqualTo, B=smaller_10.SmallerThan)
and_10 = GateAnd(A=larger_12.OrEqualTo, B=smaller_11.SmallerThan)
and_11 = GateAnd(A=larger_13.OrEqualTo, B=smaller_12.SmallerThan)
and_12 = GateAnd(A=larger_14.OrEqualTo, B=smaller_14.SmallerThan)
and_13 = GateAnd(A=larger_15.OrEqualTo, B=smaller_15.SmallerThan)
and_14 = GateAnd(A=larger_16.OrEqualTo, B=smaller_16.SmallerThan)
and_15 = GateAnd(A=larger_17.OrEqualTo, B=smaller_17.SmallerThan)
and_16 = GateAnd(A=larger_18.OrEqualTo, B=smaller_18.SmallerThan)
ma_10 = MassAddition(Input=larger_10.OrEqualTo)  # -> Result, PartialResults
ma_11 = MassAddition(Input=and_14)  # -> Result, PartialResults
ma_12 = MassAddition(Input=and_15)  # -> Result, PartialResults
ma_13 = MassAddition(Input=and_13)  # -> Result, PartialResults
ma_14 = MassAddition(Input=smaller_13.SmallerThan)  # -> Result, PartialResults
ma_15 = MassAddition(Input=and_16)  # -> Result, PartialResults
ma_16 = MassAddition(Input=and_10)  # -> Result, PartialResults
ma_17 = MassAddition(Input=and_11)  # -> Result, PartialResults
ma_18 = MassAddition(Input=and_9)  # -> Result, PartialResults
mindex_5 = MemberIndex(Set=and_10, Member=Toggle(True))  # -> Index, Count
mindex_6 = MemberIndex(Set=and_11, Member=Toggle(True))  # -> Index, Count
mindex_7 = MemberIndex(Set=and_9, Member=Toggle(True))  # -> Index, Count
cullf_11 = CullFaces(Mesh=mesh_2, Pattern=invert(and_13))
cullf_12 = CullFaces(Mesh=mesh_2, Pattern=invert(smaller_13.SmallerThan))
cullf_13 = CullFaces(Mesh=mesh_2, Pattern=invert(and_14))
cullf_14 = CullFaces(Mesh=mesh_2, Pattern=invert(and_15))
cullf_15 = CullFaces(Mesh=mesh_2, Pattern=invert(and_10))
cullf_16 = CullFaces(Mesh=mesh_2, Pattern=invert(and_12))
cullf_17 = CullFaces(Mesh=mesh_2, Pattern=invert(and_16))
cullf_18 = CullFaces(Mesh=mesh_2, Pattern=invert(and_11))
cullf_19 = CullFaces(Mesh=mesh_2, Pattern=invert(and_9))
cullf_20 = CullFaces(Mesh=mesh_2, Pattern=invert(larger_10.OrEqualTo))
swatch = ColourSwatch(SwatchColor=RGB(128, 0, 0))
swatch_2 = ColourSwatch(SwatchColor=RGB(204, 0, 0))
swatch_3 = ColourSwatch(SwatchColor=RGB(255, 51, 0))
swatch_4 = ColourSwatch(SwatchColor=RGB(255, 102, 0))
swatch_5 = ColourSwatch(SwatchColor=RGB(0, 96, 255))
swatch_6 = ColourSwatch(SwatchColor=RGB(0, 192, 0))
swatch_7 = ColourSwatch(SwatchColor=RGB(0, 192, 255))
swatch_8 = ColourSwatch(SwatchColor=RGB(0, 0, 255))
swatch_9 = ColourSwatch(SwatchColor=RGB(0, 0, 192))
swatch_10 = ColourSwatch(SwatchColor=RGB(0, 0, 128))
mcol_11 = MeshColours(Mesh=cullf_19, Colours=swatch_2)
mcol_12 = MeshColours(Mesh=cullf_15, Colours=swatch_3)
mcol_13 = MeshColours(Mesh=cullf_20, Colours=swatch)
mcol_14 = MeshColours(Mesh=cullf_18, Colours=swatch_4)
mcol_15 = MeshColours(Mesh=cullf_13, Colours=swatch_5)
mcol_16 = MeshColours(Mesh=cullf_17, Colours=swatch_7)
mcol_17 = MeshColours(Mesh=cullf_16, Colours=swatch_6)
mcol_18 = MeshColours(Mesh=cullf_14, Colours=swatch_8)
mcol_19 = MeshColours(Mesh=cullf_11, Colours=swatch_9)
mcol_20 = MeshColours(Mesh=cullf_12, Colours=swatch_10)
mjoin_2 = MeshJoin(Meshes=[mcol_20, mcol_19, mcol_18, mcol_15, mcol_16, mcol_17, mcol_14, mcol_12, mcol_11, mcol_13])
scale_nu_2 = ScaleNU(Geometry=mjoin_2, Plane=PlaneXY(0, 0, 0), ScaleX=division_2, ScaleY=division, ScaleZ=1)  # -> Geometry, Transform
move_17 = Move(Geometry=scale_nu_2.Geometry, Motion=Y_8)  # -> Geometry, Transform

# ----
# Temperatures/divergence 5
swatch_11 = ColourSwatch(SwatchColor=RGB(146, 197, 222))
merge_2 = Merge(
    Data1=ColourSwatch(SwatchColor=RGB(33, 102, 172)),
    Data2=swatch_11,
    Data3=ColourSwatch(SwatchColor=RGB(247, 247, 247)),
    Data4=ColourSwatch(SwatchColor=RGB(244, 165, 130)),
    Data5=ColourSwatch(SwatchColor=RGB(178, 24, 43)))

# ----
# File name
number_slider = Slider(-15, range=-15..0)
Y_9 = UnitY(Factor=number_slider)
move_18 = Move(Geometry=move_13.Geometry, Motion=Y_9)  # -> Geometry, Transform
tag_12 = TextTag3D(
    Location=move_18.Geometry,
    Text="UTCI_actual_future_delta_statistics.gh",
    Size=titles_size,
    Colour=labels_colour,
    Justification=7)

# ----
# Legend Actual and future
panel_7 = Panel("""extreme heat stress
very strong heat stress
strong heat stress
moderate heat stress
no thermal stress
slight cold stress
moderate cold stress
strong cold stress
very strong cold stress
exterme cold stress""")
panel_8 = Panel("""-40
-27
-13
0
9
26
32
38
46""")
merge_3 = Merge(
    Data1=swatch,
    Data2=swatch_2,
    Data3=swatch_3,
    Data4=swatch_4,
    Data5=swatch_6,
    Data6=swatch_7,
    Data7=swatch_5,
    Data8=swatch_8,
    Data9=swatch_9,
    Data10=swatch_10)
rev = ReverseList(List=panel_8)
rev_2 = ReverseList(List=merge_3)
rev_3 = ReverseList(List=panel_7)
legendparcategorized = LBLegendParametersCategorized(domain=rev, colors=rev_2, categories=rev_3, base_plane=move_2.Geometry, seg_height="15", text_height=labels_size)  # -> leg_par; plug-in component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
xdata_3 = LBDeconstructData(data=utci_2.utci)  # -> header, values; plug-in component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
heatmap = LBSpatialHeatmap(values=xdata_3.values, mesh=hourlyplot.mesh, legend_par=legendparcategorized, legend_title="Categories")  # -> mesh, legend, title, colors, legend_par, vis_set; plug-in component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
move_19 = Move(Geometry=heatmap.legend, Motion=Y_4)  # -> Geometry, Transform

# ----
# Delta
merge_4 = Merge(Data1=utci.utci, Data2=utci_2.utci)
xdata_4 = LBDeconstructData(data=merge_4)  # -> header, simplify(values); plug-in component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
larger_19 = LargerThan(FirstNumber=xdata_4.values, SecondNumber="46")  # -> LargerThan, OrEqualTo
smaller_19 = SmallerThan(FirstNumber=xdata_4.values, SecondNumber="46")  # -> SmallerThan, OrEqualTo
smaller_20 = SmallerThan(FirstNumber=xdata_4.values, SecondNumber="38")  # -> SmallerThan, OrEqualTo
larger_20 = LargerThan(FirstNumber=xdata_4.values, SecondNumber="38")  # -> LargerThan, OrEqualTo
smaller_21 = SmallerThan(FirstNumber=xdata_4.values, SecondNumber="32")  # -> SmallerThan, OrEqualTo
larger_21 = LargerThan(FirstNumber=xdata_4.values, SecondNumber="32")  # -> LargerThan, OrEqualTo
smaller_22 = SmallerThan(FirstNumber=xdata_4.values, SecondNumber="-40")  # -> SmallerThan, OrEqualTo
larger_22 = LargerThan(FirstNumber=xdata_4.values, SecondNumber="26")  # -> LargerThan, OrEqualTo
smaller_23 = SmallerThan(FirstNumber=xdata_4.values, SecondNumber="26")  # -> SmallerThan, OrEqualTo
smaller_24 = SmallerThan(FirstNumber=xdata_4.values, SecondNumber="-27")  # -> SmallerThan, OrEqualTo
smaller_25 = SmallerThan(FirstNumber=xdata_4.values, SecondNumber="0")  # -> SmallerThan, OrEqualTo
larger_23 = LargerThan(FirstNumber=xdata_4.values, SecondNumber="9")  # -> LargerThan, OrEqualTo
larger_24 = LargerThan(FirstNumber=xdata_4.values, SecondNumber="-40")  # -> LargerThan, OrEqualTo
larger_25 = LargerThan(FirstNumber=xdata_4.values, SecondNumber="-13")  # -> LargerThan, OrEqualTo
smaller_26 = SmallerThan(FirstNumber=xdata_4.values, SecondNumber="-13")  # -> SmallerThan, OrEqualTo
larger_26 = LargerThan(FirstNumber=xdata_4.values, SecondNumber="-27")  # -> LargerThan, OrEqualTo
smaller_27 = SmallerThan(FirstNumber=xdata_4.values, SecondNumber="9")  # -> SmallerThan, OrEqualTo
larger_27 = LargerThan(FirstNumber=xdata_4.values, SecondNumber="0")  # -> LargerThan, OrEqualTo
and_17 = GateAnd(A=larger_20.OrEqualTo, B=smaller_19.SmallerThan)
and_18 = GateAnd(A=larger_21.OrEqualTo, B=smaller_20.SmallerThan)
and_19 = GateAnd(A=larger_22.OrEqualTo, B=smaller_21.SmallerThan)
and_20 = GateAnd(A=larger_23.OrEqualTo, B=smaller_23.SmallerThan)
and_21 = GateAnd(A=larger_24.OrEqualTo, B=smaller_24.SmallerThan)
and_22 = GateAnd(A=larger_25.OrEqualTo, B=smaller_25.SmallerThan)
and_23 = GateAnd(A=larger_26.OrEqualTo, B=smaller_26.SmallerThan)
and_24 = GateAnd(A=larger_27.OrEqualTo, B=smaller_27.SmallerThan)
ma_19 = MassAddition(Input=larger_19.OrEqualTo)  # -> Result, PartialResults
ma_20 = MassAddition(Input=and_17)  # -> Result, PartialResults
ma_21 = MassAddition(Input=and_22)  # -> Result, PartialResults
ma_22 = MassAddition(Input=and_23)  # -> Result, PartialResults
ma_23 = MassAddition(Input=and_21)  # -> Result, PartialResults
ma_24 = MassAddition(Input=smaller_22.SmallerThan)  # -> Result, PartialResults
ma_25 = MassAddition(Input=and_18)  # -> Result, PartialResults
ma_26 = MassAddition(Input=and_19)  # -> Result, PartialResults
ma_27 = MassAddition(Input=and_24)  # -> Result, PartialResults
dup = DuplicateData(Data="a", Number="8760", Order=True)

bang_2 = ExplodeTree(Data=larger_19.OrEqualTo)  # -> Branch0, Branch1
toggle = BooleanToggle(True)
mindex_8 = MemberIndex(Set=bang_2.Branch0, Member=toggle)  # -> Index, Count
mindex_9 = MemberIndex(Set=bang_2.Branch1, Member=toggle)  # -> Index, Count
replace = ReplaceItems(List=dup, Item="10", Indices=mindex_8.Index, Wrap=False)
replace_2 = ReplaceItems(List=dup, Item="10", Indices=mindex_9.Index, Wrap=False)

bang_3 = ExplodeTree(Data=and_17)  # -> Branch0, Branch1
toggle_2 = BooleanToggle(True)
mindex_10 = MemberIndex(Set=bang_3.Branch0, Member=toggle_2)  # -> Index, Count
mindex_11 = MemberIndex(Set=bang_3.Branch1, Member=toggle_2)  # -> Index, Count
replace_3 = ReplaceItems(List=replace, Item="9", Indices=mindex_10.Index, Wrap=False)
replace_4 = ReplaceItems(List=replace_2, Item="9", Indices=mindex_11.Index, Wrap=False)

bang_4 = ExplodeTree(Data=and_18)  # -> Branch0, Branch1
toggle_3 = BooleanToggle(True)
mindex_12 = MemberIndex(Set=bang_4.Branch0, Member=toggle_3)  # -> Index, Count
mindex_13 = MemberIndex(Set=bang_4.Branch1, Member=toggle_3)  # -> Index, Count
replace_5 = ReplaceItems(List=replace_3, Item="8", Indices=mindex_12.Index, Wrap=False)
replace_6 = ReplaceItems(List=replace_4, Item="8", Indices=mindex_13.Index, Wrap=False)

bang_5 = ExplodeTree(Data=and_19)  # -> Branch0, Branch1
toggle_4 = BooleanToggle(True)
mindex_14 = MemberIndex(Set=bang_5.Branch0, Member=toggle_4)  # -> Index, Count
mindex_15 = MemberIndex(Set=bang_5.Branch1, Member=toggle_4)  # -> Index, Count
replace_7 = ReplaceItems(List=replace_5, Item="7", Indices=mindex_14.Index, Wrap=False)
replace_8 = ReplaceItems(List=replace_6, Item="7", Indices=mindex_15.Index, Wrap=False)

bang_6 = ExplodeTree(Data=and_20)  # -> Branch0, Branch1
toggle_5 = BooleanToggle(True)
mindex_16 = MemberIndex(Set=bang_6.Branch0, Member=toggle_5)  # -> Index, Count
mindex_17 = MemberIndex(Set=bang_6.Branch1, Member=toggle_5)  # -> Index, Count
replace_9 = ReplaceItems(List=replace_7, Item="6", Indices=mindex_16.Index, Wrap=False)
replace_10 = ReplaceItems(List=replace_8, Item="6", Indices=mindex_17.Index, Wrap=False)

bang_7 = ExplodeTree(Data=and_24)  # -> Branch0, Branch1
toggle_6 = BooleanToggle(True)
mindex_18 = MemberIndex(Set=bang_7.Branch0, Member=toggle_6)  # -> Index, Count
mindex_19 = MemberIndex(Set=bang_7.Branch1, Member=toggle_6)  # -> Index, Count
replace_11 = ReplaceItems(List=replace_9, Item="5", Indices=mindex_18.Index, Wrap=False)
replace_12 = ReplaceItems(List=replace_10, Item="5", Indices=mindex_19.Index, Wrap=False)

bang_8 = ExplodeTree(Data=and_22)  # -> Branch0, Branch1
toggle_7 = BooleanToggle(True)
mindex_20 = MemberIndex(Set=bang_8.Branch0, Member=toggle_7)  # -> Index, Count
mindex_21 = MemberIndex(Set=bang_8.Branch1, Member=toggle_7)  # -> Index, Count
replace_13 = ReplaceItems(List=replace_11, Item="4", Indices=mindex_20.Index, Wrap=False)
replace_14 = ReplaceItems(List=replace_12, Item="4", Indices=mindex_21.Index, Wrap=False)

bang_9 = ExplodeTree(Data=and_23)  # -> Branch0, Branch1
toggle_8 = BooleanToggle(True)
mindex_22 = MemberIndex(Set=bang_9.Branch0, Member=toggle_8)  # -> Index, Count
mindex_23 = MemberIndex(Set=bang_9.Branch1, Member=toggle_8)  # -> Index, Count
replace_15 = ReplaceItems(List=replace_13, Item="3", Indices=mindex_22.Index, Wrap=False)
replace_16 = ReplaceItems(List=replace_14, Item="3", Indices=mindex_23.Index, Wrap=False)

bang_10 = ExplodeTree(Data=and_21)  # -> Branch0, Branch1
toggle_9 = BooleanToggle(True)
mindex_24 = MemberIndex(Set=bang_10.Branch0, Member=toggle_9)  # -> Index, Count
mindex_25 = MemberIndex(Set=bang_10.Branch1, Member=toggle_9)  # -> Index, Count
replace_17 = ReplaceItems(List=replace_15, Item="2", Indices=mindex_24.Index, Wrap=False)
replace_18 = ReplaceItems(List=replace_16, Item="2", Indices=mindex_25.Index, Wrap=False)

bang_11 = ExplodeTree(Data=smaller_22.SmallerThan)  # -> Branch0, Branch1
toggle_10 = BooleanToggle(True)
mindex_26 = MemberIndex(Set=bang_11.Branch0, Member=toggle_10)  # -> Index, Count
mindex_27 = MemberIndex(Set=bang_11.Branch1, Member=toggle_10)  # -> Index, Count
replace_19 = ReplaceItems(List=replace_17, Item="1", Indices=mindex_26.Index, Wrap=False)
replace_20 = ReplaceItems(List=replace_18, Item="1", Indices=mindex_27.Index, Wrap=False)

# ----
# Bars
ma_28 = MassAddition(Input=[ma_19.Result, ma_20.Result, ma_25.Result, ma_26.Result])  # -> Result, PartialResults
ma_29 = MassAddition(Input=and_20)  # -> Result, PartialResults
ma_30 = MassAddition(Input=[ma_21.Result, ma_22.Result, ma_23.Result, ma_24.Result, ma_27.Result])  # -> Result, PartialResults
bang_12 = ExplodeTree(Data=ma_28.Result)  # -> Branch0, Branch1
bang_13 = ExplodeTree(Data=ma_29.Result)  # -> Branch0, Branch1
bang_14 = ExplodeTree(Data=ma_30.Result)  # -> Branch0, Branch1
subtraction = Subtraction(A=bang_12.Branch0, B=bang_12.Branch1)
subtraction_2 = Subtraction(A=bang_13.Branch0, B=bang_13.Branch1)
subtraction_3 = Subtraction(A=bang_14.Branch0, B=bang_14.Branch1)
panel_9 = Panel("39")
division_4 = Division(A=subtraction_3, B=statistics_graph_width)
division_5 = Division(A=subtraction_2, B=statistics_graph_width)
division_6 = Division(A=subtraction, B=statistics_graph_width)
rectangle = Rectangle(Plane="0,40,0", XSize=division_6, YSize=statistics_bars_height, Radius=0)  # -> Rectangle, Length
rectangle_2 = Rectangle(Plane=PlaneXY(0, 0, 0), XSize=division_4, YSize=statistics_bars_height, Radius=0)  # -> Rectangle, Length
rectangle_3 = Rectangle(Plane="0,20,0", XSize=division_5, YSize=statistics_bars_height, Radius=0)  # -> Rectangle, Length
pdecon_2 = Deconstruct(Point="0,40,0")  # -> XComponent, YComponent, ZComponent
addition_3 = Addition(A=pdecon_2.YComponent, B=statistics_bars_height)
boundary = BoundarySurfaces(Edges=rectangle.Rectangle)
boundary_2 = BoundarySurfaces(Edges=rectangle_2.Rectangle)
boundary_3 = BoundarySurfaces(Edges=rectangle_3.Rectangle)
mesh_3 = Mesh(boundary)
mesh_4 = Mesh(boundary_2)
mesh_5 = Mesh(boundary_3)
move_20 = Move(Geometry=mesh_3, Motion=vec2pt.Vector)  # -> Geometry, Transform
move_21 = Move(Geometry=mesh_5, Motion=vec2pt.Vector)  # -> Geometry, Transform
move_22 = Move(Geometry=mesh_4, Motion=vec2pt.Vector)  # -> Geometry, Transform
mcol_21 = MeshColours(Mesh=move_20.Geometry, Colours=swatch)
mcol_22 = MeshColours(Mesh=move_21.Geometry, Colours=swatch_6)
mcol_23 = MeshColours(Mesh=move_22.Geometry, Colours=swatch_10)

# ----
# X - axis
panel_10 = Panel("-1250")
dom_2 = ConstructDomain(DomainStart=panel_10, DomainEnd="1250")
range = Range(Domain=dom_2, Steps="10")
cset = CreateSet(List=range)  # -> Set, Map
division_7 = Division(A=cset.Set, B=statistics_graph_width)
pt_4 = ConstructPoint(XCoordinate=division_7, YCoordinate=0, ZCoordinate=0)
pt_5 = Point(Point(0, 0, 0))
pline = PolyLine(Vertices=pt_4, Closed=False)
division_8 = Division(A=statistics_bars_height, B="2")
pt_6 = Point(["0,40,0", "0,20,0", pt_5])
Y_10 = UnitY(Factor=division_8)
move_23 = Move(Geometry=pt_6, Motion=Y_10)  # -> Geometry, Transform
vec2pt_2 = Vector2Pt(PointA=pt_5, PointB=graft(move_23.Geometry), Unitize=False)  # -> Vector, Length
move_24 = Move(Geometry=pline, Motion=vec2pt_2.Vector)  # -> Geometry, Transform
mindex_28 = MemberIndex(Set=pt_4, Member=pt_5)  # -> Index, Count

# ----
# X - axis title
number_slider_2 = Slider(-20, range=-20..0)
item_8 = ListItem(List=pt_4, Index=0, Wrap=True)
Y_11 = UnitY(Factor=number_slider_2)
move_25 = Move(Geometry=item_8, Motion=Y_11)  # -> Geometry, Transform
move_26 = Move(Geometry=move_25.Geometry, Motion=vec2pt.Vector)  # -> Geometry, Transform
tag_13 = TextTag3D(Location=move_26.Geometry, Text="Hours", Size=labels_size, Colour=labels_colour, Justification=7)

# ----
# Values
drec = DeconstuctRectangle(Rectangle=rectangle.Rectangle)  # -> BasePlane, XInterval, YInterval
drec_2 = DeconstuctRectangle(Rectangle=rectangle_2.Rectangle)  # -> BasePlane, XInterval, YInterval
drec_3 = DeconstuctRectangle(Rectangle=rectangle_3.Rectangle)  # -> BasePlane, XInterval, YInterval
pt_7 = Point(drec.BasePlane)
pt_8 = Point(drec_2.BasePlane)
pt_9 = Point(drec_3.BasePlane)
dedomain = DeconstructDomain(Domain=drec.XInterval)  # -> Start, End
dedomain_2 = DeconstructDomain(Domain=drec_2.XInterval)  # -> Start, End
dedomain_3 = DeconstructDomain(Domain=drec_3.XInterval)  # -> Start, End
dedomain_4 = DeconstructDomain(Domain=drec.YInterval)  # -> Start, End
division_9 = Division(A=dedomain_4.End, B="2")
vec = VectorXYZ(XComponent=dedomain_3.End, YComponent=division_9, ZComponent=0)  # -> Vector, Length
vec_2 = VectorXYZ(XComponent=dedomain_2.Start, YComponent=division_9, ZComponent=0)  # -> Vector, Length
vec_3 = VectorXYZ(XComponent=dedomain.End, YComponent=division_9, ZComponent=0)  # -> Vector, Length
move_27 = Move(Geometry=pt_7, Motion=vec_3.Vector)  # -> Geometry, Transform
move_28 = Move(Geometry=pt_8, Motion=vec_2.Vector)  # -> Geometry, Transform
move_29 = Move(Geometry=pt_9, Motion=vec.Vector)  # -> Geometry, Transform
move_30 = Move(Geometry=move_29.Geometry, Motion=X_2)  # -> Geometry, Transform
move_31 = Move(Geometry=move_28.Geometry, Motion=expr("-x", X_2))  # -> Geometry, Transform
move_32 = Move(Geometry=move_27.Geometry, Motion=X_2)  # -> Geometry, Transform
move_33 = Move(Geometry=move_32.Geometry, Motion=vec2pt.Vector)  # -> Geometry, Transform
move_34 = Move(Geometry=move_30.Geometry, Motion=vec2pt.Vector)  # -> Geometry, Transform
move_35 = Move(Geometry=move_31.Geometry, Motion=vec2pt.Vector)  # -> Geometry, Transform
tag_14 = TextTag3D(Location=move_33.Geometry, Text=subtraction, Size=statistics_data_size, Colour=labels_colour, Justification=7)
tag_15 = TextTag3D(Location=move_34.Geometry, Text=subtraction_2, Size=statistics_data_size, Colour=labels_colour, Justification=7)
tag_16 = TextTag3D(Location=move_35.Geometry, Text=subtraction_3, Size=statistics_data_size, Colour=labels_colour, Justification=9)

# ----
# Sub lines
cull_i = CullIndex(List=pt_4, Indices=mindex_28.Index, Wrap=True)
Y_12 = UnitY(Factor=1)
neg_2 = Negative(Value="0.5")
line = LineSDL(Start=cull_i, Direction=Y_12, Length="60")
Y_13 = UnitY(Factor=neg_2)
move_36 = Move(Geometry=line, Motion=Y_13)  # -> Geometry, Transform
move_37 = Move(Geometry=[move_36.Geometry, move_24.Geometry], Motion=vec2pt.Vector)  # -> Geometry, Transform
# x-Axis
# Labels
# Temperatures/divergence 5
preview_4 = CustomPreview(Geometry=move_37.Geometry, Material=ColourSwatch(SwatchColor=RGB(153, 153, 153)))

# ----
# Y - axis
item_9 = ListItem(List=pt_4, Index=mindex_28.Index, Wrap=True)
Y_14 = UnitY(Factor=1)
line_2 = LineSDL(Start=item_9, Direction=Y_14, Length=addition_3)
move_38 = Move(Geometry=line_2, Motion=vec2pt.Vector)  # -> Geometry, Transform
preview_5 = CustomPreview(Geometry=move_38.Geometry, Material=ColourSwatch(SwatchColor=RGB(128, 128, 128)))

# ----
# X - axis labels
Y_15 = UnitY(Factor=labels_offset)
move_39 = Move(Geometry=pt_4, Motion=Y_15)  # -> Geometry, Transform
move_40 = Move(Geometry=move_39.Geometry, Motion=vec2pt.Vector)  # -> Geometry, Transform
tag_17 = TextTag3D(Location=move_40.Geometry, Text=range, Size=labels_size, Colour=labels_colour, Justification=2)

# ----
# Y - axis labels
end_3 = EndPoints(Curve=move_24.Geometry)  # -> Start, flatten(End)
panel_11 = Panel("""Heat stress
No thermal stress
Cold stress""")
move_41 = Move(Geometry=end_3.End, Motion=X_2)  # -> Geometry, Transform
move_42 = Move(Geometry=move_41.Geometry, Motion=vec2pt.Vector)  # -> Geometry, Transform
tag_18 = TextTag3D(Location=move_42.Geometry, Text=panel_11, Size=labels_size, Colour=labels_colour, Justification=7)

subtraction_4 = Subtraction(A=replace_19, B=replace_20)

# ----
# Legend delta
bnd = Bounds(Numbers=subtraction_4)
dedomain_5 = DeconstructDomain(Domain=bnd)  # -> Start, End
abs = Absolute(Value=dedomain_5.Start)
abs_2 = Absolute(Value=dedomain_5.End)
max = Maximum(A=abs, B=abs_2)
neg_3 = Negative(Value=max)
legendpar = LBLegendParameters(min=neg_3, max=max, seg_count="5", colors=merge_2, base_plane=move_2.Geometry, seg_height="15", text_height=labels_size)  # -> leg_par; plug-in component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

heatmap_2 = LBSpatialHeatmap(values=subtraction_4, mesh=hourlyplot.mesh, legend_par=legendpar, legend_title="Δ Categories")  # -> mesh, legend, title, colors, legend_par, vis_set; plug-in component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

geo = Geometry(heatmap_2.legend)

# ----
# Mesh delta
scale_nu_3 = ScaleNU(Geometry=heatmap_2.mesh, Plane=PlaneXY(0, 0, 0), ScaleX=division_2, ScaleY=division, ScaleZ=1)  # -> Geometry, Transform
mesh_6 = Mesh(scale_nu_3.Geometry)
