# Grasshopper definition adaptive_comfort_current_future_delta_statistics.gh (Grasshopper 1.0.8)
# plug-ins: Human, Wombat

# ----
# Settings
vertical_distance_graphs = Slider(30, range=0..100)
small_graphs_width = Slider(285, range=0..1000)
horizontal_spacing = Slider(90, range=0..100)
vertical_spacing = Slider(40, range=0..100)
vertical_position = Slider(60, range=0..100)
vertical_position_2 = Slider(125, range=0..200)
main_title_position = Slider(17.5, range=0..20)
graphs_title_size = Slider(6.5, range=0..10)
lines_thickness = Slider(1, range=0.1..10)
main_title_size = Slider(7, range=0..10)
number_slider = Slider(40, range=0..100)
graph_height = Slider(200, range=0..1000)
labels_offset = Slider(-3, range=-3..0)
graph_width = Slider(600, range=0..1000)
labels_size = Slider(5, range=0..10)
main_lines_colour = ColourSwatch(SwatchColor=RGB(128, 128, 128))
sub_lines_colour = ColourSwatch(SwatchColor=RGB(178, 178, 178))
labels_colour = ColourSwatch(SwatchColor=RGB(0, 0, 0))
swatch = ColourSwatch(SwatchColor=RGB(0, 0, 0))

# ----
# File: adaptive_comfort_current_future_delta_statystics.gh
# Additional plugins: Ladybug Tools v. 1.8.0, Human, Wombat
# 1. Insert path to current EPW
current_epw = FilePath("D:\Marcello\Dropbox\PhD Parma\BERKELEY\CLIMA TOOL\PHASE 2\Paper 1\EPWs\Wien-Hohe_Warte-hour_PRESENT.epw")

# ----
# 2. Insert path to future EPW
future_epw = FilePath("D:\Marcello\Dropbox\PhD Parma\BERKELEY\CLIMA TOOL\PHASE 2\Paper 1\EPWs\Wien-Hohe_Warte-hour_2050.epw")

# ----
# Category I --> strict comfort (sensitive occupants, hospitals, nurseries)
# Category II --> normal comfort (offices, schools, dwellings)
# Category III --> acceptable comfort (storage, less demanding buildings)
list = ValueList({"Category I": 0, "Category II": 1, "Category III": 2}, selected="Category I")

# ----
# Delta colours
swatch_2 = ColourSwatch(SwatchColor=RGB(68, 119, 170))
swatch_3 = ColourSwatch(SwatchColor=RGB(102, 204, 238))
swatch_4 = ColourSwatch(SwatchColor=RGB(34, 136, 51))
swatch_5 = ColourSwatch(SwatchColor=RGB(204, 187, 68))
swatch_6 = ColourSwatch(SwatchColor=RGB(238, 102, 119))
swatch_7 = ColourSwatch(SwatchColor=RGB(170, 51, 119))
swatch_8 = ColourSwatch(SwatchColor=RGB(153, 153, 153))
merge = Merge(
    Data1=swatch_4,
    Data2=swatch_2,
    Data3=swatch_3,
    Data4=swatch_6,
    Data5=swatch_7,
    Data6=swatch_5,
    Data7=ColourSwatch(SwatchColor=RGB(230, 230, 230)))  # -> reverse(Result)

# ----
# Data colours
swatch_9 = ColourSwatch(SwatchColor=RGB(33, 102, 172))
swatch_10 = ColourSwatch(SwatchColor=RGB(178, 24, 43))
swatch_11 = ColourSwatch(SwatchColor=RGB(247, 247, 247))
merge_2 = Merge(Data1=swatch_10, Data2=swatch_11, Data3=swatch_9)

# ----
# Running mean out temperature
panel = Panel("(1-b)*(x+b*y+b^2*z+b^3*u+b^4*v+b^5*w+b^6*a)")
series = Series(Start="364", Step="1", Count="365")
alfa = Slider(0.8, range=0.6..0.9)
series_2 = Series(Start="0", Step=1, Count="365")
series_3 = Series(Start=series, Step="-1", Count="7")
item = ListItem(List=series_2, Index=series_3, Wrap=True)  # -> simplify(Item)

# ---- group: Acceptable indoor operative temperature
en_16798 = Panel("x*0.33+18.8")

# ---- group: Boundaries
filter = StreamFilter(Gate=list, Stream0="2", Stream1="3", Stream2="4")
filter_2 = StreamFilter(Gate=list, Stream0="3", Stream1="4", Stream2="5")

# ----
# Legend parameters
panel_2 = Panel("""Unacceptable Cold
Acceptable
Unacceptable Hot""")
panel_3 = Panel("""Unchanged
Hot -> Cold
Acc. -> Hot
Cold -> Acc.
Hot -> Acc.
Acc. -> Cold
Cold -> Hot""")
panel_4 = Panel("""1.5
2.5""")
panel_5 = Panel("""11.5
20.5""")
panel_6 = Panel("""6.5
7.5
8.5
18.5
19.5
28.5""")
entwine = Entwine(Branch00=panel_4, Branch01=panel_5, Branch02=panel_6, FlattenInputs=True)
entwine_2 = Entwine(Branch00=merge_2, Branch01=merge_2, Branch02=merge, FlattenInputs=True)
entwine_3 = Entwine(Branch00=panel_2, Branch01=panel_2, Branch02=panel_3, FlattenInputs=True)
legendparcategorized = LBLegendParametersCategorized(domain=entwine, colors=entwine_2, categories=entwine_3, text_height=labels_size)  # -> leg_par; plug-in component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

# ----
# Data
# Actual
importepw = LBImportEPW(epw_file=current_epw)  # -> location, dry_bulb_temperature, dew_point_temperature, relative_humidity, wind_speed, wind_direction, direct_normal_rad, diffuse_horizontal_rad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; plug-in component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
xdata = LBDeconstructData(data=importepw.dry_bulb_temperature)  # -> header, values; plug-in component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

# ---- group: Actual
partition = PartitionList(List=xdata.values, Size="24")
avr = Average(Input=partition)  # -> simplify(ArithmeticMean)
item_2 = ListItem(List=avr, Index=item, Wrap=True)
flip = FlipMatrix(Data=item_2)
bang = ExplodeTree(Data=flip)  # -> Branch0, Branch1, Branch2, Branch3, Branch4, Branch5, Branch6
eval = Evaluate(
    F=panel,
    b=alfa,
    x=bang.Branch0,
    y=bang.Branch1,
    z=bang.Branch2,
    u=bang.Branch3,
    v=bang.Branch4,
    w=bang.Branch5,
    a=bang.Branch6)
dup = DuplicateData(Data=graft(eval), Number="24", Order=True)  # -> flatten(Data)

# ----
# Future
importepw_2 = LBImportEPW(epw_file=future_epw)  # -> location, dry_bulb_temperature, dew_point_temperature, relative_humidity, wind_speed, wind_direction, direct_normal_rad, diffuse_horizontal_rad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; plug-in component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
xdata_2 = LBDeconstructData(data=importepw_2.dry_bulb_temperature)  # -> header, values; plug-in component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

# ---- group: Future
partition_2 = PartitionList(List=xdata_2.values, Size="24")
avr_2 = Average(Input=partition_2)  # -> simplify(ArithmeticMean)
item_3 = ListItem(List=avr_2, Index=item, Wrap=True)
flip_2 = FlipMatrix(Data=item_3)
bang_2 = ExplodeTree(Data=flip_2)  # -> Branch0, Branch1, Branch2, Branch3, Branch4, Branch5, Branch6
eval_2 = Evaluate(
    F=panel,
    b=alfa,
    x=bang_2.Branch0,
    y=bang_2.Branch1,
    z=bang_2.Branch2,
    u=bang_2.Branch3,
    v=bang_2.Branch4,
    w=bang_2.Branch5,
    a=bang_2.Branch6)
dup_2 = DuplicateData(Data=graft(eval_2), Number="24", Order=True)  # -> flatten(Data)

# ----
eval_3 = Evaluate(F=en_16798, x=dup)
addition = Addition(A=eval_3, B=filter)  # -> graft(Result)
subtraction = Subtraction(A=eval_3, B=filter_2)  # -> graft(Result)
smaller = SmallerThan(FirstNumber=xdata.values, SecondNumber=flatten(subtraction))  # -> SmallerThan, OrEqualTo
larger = LargerThan(FirstNumber=xdata.values, SecondNumber=flatten(addition))  # -> LargerThan, OrEqualTo
dom = ConstructDomain(DomainStart=subtraction, DomainEnd=addition)
inc = Includes(Value=graft(xdata.values), Domain=dom)  # -> flatten(Includes), Deviation
mindex = MemberIndex(Set=larger.LargerThan, Member=Toggle(True))  # -> Index, Count
mindex_2 = MemberIndex(Set=inc.Includes, Member=Toggle(True))  # -> Index, Count
mindex_3 = MemberIndex(Set=smaller.SmallerThan, Member=Toggle(True))  # -> Index, Count

eval_4 = Evaluate(F=en_16798, x=dup_2)
addition_2 = Addition(A=eval_4, B=filter)  # -> graft(Result)
subtraction_2 = Subtraction(A=eval_4, B=filter_2)  # -> graft(Result)
larger_2 = LargerThan(FirstNumber=xdata_2.values, SecondNumber=flatten(addition_2))  # -> LargerThan, OrEqualTo
smaller_2 = SmallerThan(FirstNumber=xdata_2.values, SecondNumber=flatten(subtraction_2))  # -> SmallerThan, OrEqualTo
dom_2 = ConstructDomain(DomainStart=subtraction_2, DomainEnd=addition_2)
inc_2 = Includes(Value=graft(xdata_2.values), Domain=dom_2)  # -> flatten(Includes), Deviation
mindex_4 = MemberIndex(Set=larger_2.LargerThan, Member=Toggle(True))  # -> Index, Count
mindex_5 = MemberIndex(Set=inc_2.Includes, Member=Toggle(True))  # -> Index, Count
mindex_6 = MemberIndex(Set=smaller_2.SmallerThan, Member=Toggle(True))  # -> Index, Count

# ----
# Applicability
panel_7 = Panel("10")
dom_3 = ConstructDomain(DomainStart=panel_7, DomainEnd="30")
inc_3 = Includes(Value=dup, Domain=dom_3)  # -> Includes, Deviation
lng = ListLength(List=inc_3.Includes)
dup_3 = DuplicateData(Data=Toggle(False), Number=lng, Order=True)
inc_4 = Includes(Value=dup_2, Domain=dom_3)  # -> Includes, Deviation

# ----
# EN 16798
entwine_4 = Entwine(Branch00=inc_3.Includes, Branch01=inc_4.Includes, Branch02=dup_3, FlattenInputs=True)
dup_4 = DuplicateData(Data="a", Number="8760", Order=True)

replace = ReplaceItems(List=dup_4, Item="1", Indices=mindex.Index, Wrap=False)
replace_2 = ReplaceItems(List=replace, Item="2", Indices=mindex_2.Index, Wrap=False)
replace_3 = ReplaceItems(List=replace_2, Item="3", Indices=mindex_3.Index, Wrap=False)

replace_4 = ReplaceItems(List=dup_4, Item="10", Indices=mindex_4.Index, Wrap=False)
replace_5 = ReplaceItems(List=replace_4, Item="20", Indices=mindex_5.Index, Wrap=False)
replace_6 = ReplaceItems(List=replace_5, Item="30", Indices=mindex_6.Index, Wrap=False)

# ----
# Delta
subtraction_3 = Subtraction(A=replace_6, B=replace_3)
panel_8 = Panel("""9
18
27""")
int = Integer(panel_8)
mindex_7 = MemberIndex(Set=subtraction_3, Member=int)  # -> flatten(Index), Count
replace_7 = ReplaceItems(List=subtraction_3, Item="0", Indices=mindex_7.Index, Wrap=False)

# ----
# Plot
entwine_5 = Entwine(Branch00=replace_3, Branch01=replace_6, Branch02=replace_7, FlattenInputs=True)
data = LBConstructData(header=xdata.header, values=entwine_5)  # -> data; plug-in component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
division = Division(A=graph_height, B="24")
division_2 = Division(A=graph_width, B="365")
hourlyplot = LBHourlyPlot(data=data, x_dim=division_2, y_dim=division, legend_par=legendparcategorized)  # -> report, mesh, legend, borders, labels, title, vis_set; plug-in component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
bang_3 = ExplodeTree(Data=hourlyplot.mesh)  # -> Branch0, Branch1, Branch2

cullf = CullFaces(Mesh=simplify([bang_3.Branch0, bang_3.Branch1, bang_3.Branch2]), Pattern=simplify(entwine_4))
mcol = MeshColours(Mesh=cullf, Colours=swatch)
bang_4 = ExplodeTree(Data=mcol)  # -> Branch0, Branch1, Branch2
mesh = Mesh(bang_4.Branch0)
mesh_2 = Mesh(bang_4.Branch1)

# ----
# Basic meshes
entwine_6 = Entwine(Branch00=replace_3, Branch01=replace_6, Branch02=replace_7, FlattenInputs=True)
data_2 = LBConstructData(header=xdata.header, values=entwine_6)  # -> data; plug-in component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
division_3 = Division(A=graph_height, B="24")
division_4 = Division(A=graph_width, B="365")
hourlyplot_2 = LBHourlyPlot(data=data_2, x_dim=division_4, y_dim=division_3, legend_par=legendparcategorized)  # -> report, mesh, legend, borders, labels, title, vis_set; plug-in component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
# Delta
bang_5 = ExplodeTree(Data=hourlyplot_2.mesh)  # -> Branch0, Branch1, Branch2

# ----
# Mesh
mesh_3 = Mesh(bang_5.Branch2)
mesh_4 = Mesh(bang_5.Branch2)
mesh_5 = Mesh(bang_5.Branch2)
mesh_6 = Mesh(bang_5.Branch2)
mesh_7 = Mesh(bang_5.Branch2)
mesh_8 = Mesh(bang_3.Branch1)
mesh_9 = Mesh(bang_5.Branch2)
demesh = DeconstructMesh(Mesh=mesh_3)  # -> Vertices, Faces, Colours, Normals
mesh_10 = Mesh(bang_3.Branch0)
demesh_2 = DeconstructMesh(Mesh=mesh_4)  # -> Vertices, Faces, Colours, Normals
demesh_3 = DeconstructMesh(Mesh=mesh_7)  # -> Vertices, Faces, Colours, Normals
demesh_4 = DeconstructMesh(Mesh=mesh_5)  # -> Vertices, Faces, Colours, Normals
demesh_5 = DeconstructMesh(Mesh=mesh_6)  # -> Vertices, Faces, Colours, Normals
demesh_6 = DeconstructMesh(Mesh=mesh_9)  # -> Vertices, Faces, Colours, Normals
demesh_7 = DeconstructMesh(Mesh=mesh_10)  # -> Vertices, Faces, Colours, Normals
demesh_8 = DeconstructMesh(Mesh=mesh_8)  # -> Vertices, Faces, Colours, Normals
deface = DeconstructFace(Face=graft(demesh.Faces))  # -> CornerA, CornerB, CornerC, CornerD
deface_2 = DeconstructFace(Face=graft(demesh_3.Faces))  # -> CornerA, CornerB, CornerC, CornerD
deface_3 = DeconstructFace(Face=graft(demesh_2.Faces))  # -> CornerA, CornerB, CornerC, CornerD
deface_4 = DeconstructFace(Face=graft(demesh_5.Faces))  # -> CornerA, CornerB, CornerC, CornerD
deface_5 = DeconstructFace(Face=graft(demesh_6.Faces))  # -> CornerA, CornerB, CornerC, CornerD
deface_6 = DeconstructFace(Face=graft(demesh_4.Faces))  # -> CornerA, CornerB, CornerC, CornerD
equals = Equality(FirstNumber=demesh_7.Colours, SecondNumber=demesh_8.Colours)  # -> Equality, Inequality
merge_3 = Merge(Data1=deface.CornerA, Data2=deface.CornerB, Data3=deface.CornerC, Data4=deface.CornerD)
merge_4 = Merge(Data1=deface_2.CornerA, Data2=deface_2.CornerB, Data3=deface_2.CornerC, Data4=deface_2.CornerD)
merge_5 = Merge(Data1=deface_3.CornerA, Data2=deface_3.CornerB, Data3=deface_3.CornerC, Data4=deface_3.CornerD)
merge_6 = Merge(Data1=deface_4.CornerA, Data2=deface_4.CornerB, Data3=deface_4.CornerC, Data4=deface_4.CornerD)
merge_7 = Merge(Data1=deface_5.CornerA, Data2=deface_5.CornerB, Data3=deface_5.CornerC, Data4=deface_5.CornerD)
merge_8 = Merge(Data1=deface_6.CornerA, Data2=deface_6.CornerB, Data3=deface_6.CornerC, Data4=deface_6.CornerD)
cull = CullPattern(List=demesh_7.Vertices, CullPattern=equals.Equality)
cull_2 = CullPattern(List=demesh_7.Colours, CullPattern=equals.Equality)
item_4 = ListItem(List=demesh_5.Colours, Index=merge_6, Wrap=True)
item_5 = ListItem(List=demesh_5.Vertices, Index=merge_6, Wrap=True)
item_6 = ListItem(List=demesh_3.Vertices, Index=merge_4, Wrap=True)
item_7 = ListItem(List=demesh_3.Colours, Index=merge_4, Wrap=True)
col = Colour(swatch_6)
col_2 = Colour(swatch_5)
item_8 = ListItem(List=demesh.Vertices, Index=merge_3, Wrap=True)
item_9 = ListItem(List=demesh.Colours, Index=merge_3, Wrap=True)
item_10 = ListItem(List=demesh_2.Vertices, Index=merge_5, Wrap=True)
item_11 = ListItem(List=demesh_2.Colours, Index=merge_5, Wrap=True)
cset = CreateSet(List=cull_2)  # -> Set, Map
item_12 = ListItem(List=demesh_6.Vertices, Index=merge_7, Wrap=True)
item_13 = ListItem(List=demesh_6.Colours, Index=merge_7, Wrap=True)
item_14 = ListItem(List=demesh_4.Vertices, Index=merge_8, Wrap=True)
item_15 = ListItem(List=demesh_4.Colours, Index=merge_8, Wrap=True)
col_3 = Colour(swatch_7)
col_4 = Colour(item_7)
col_5 = Colour(item_4)
col_6 = Colour(item_9)
col_7 = Colour(item_11)
col_8 = Colour(swatch_3)
col_9 = Colour(swatch_4)
bang_6 = ExplodeTree(Data=graft(cset.Set))  # -> _00000, _00001, _00002
col_10 = Colour(swatch_2)
mindex_8 = MemberIndex(Set=col_4, Member=col_2)  # -> simplify(Index), Count
col_11 = Colour(item_13)
mindex_9 = MemberIndex(Set=col_5, Member=col)  # -> simplify(Index), Count
mindex_10 = MemberIndex(Set=col_6, Member=col_8)  # -> simplify(Index), Count
mindex_11 = MemberIndex(Set=col_7, Member=col_9)  # -> simplify(Index), Count
mindex_12 = MemberIndex(Set=item_15, Member=col_10)  # -> simplify(Index), Count
mindex_13 = MemberIndex(Set=col_11, Member=col_3)  # -> simplify(Index), Count
item_16 = ListItem(List=item_6, Index=mindex_8.Index, Wrap=True)
item_17 = ListItem(List=item_10, Index=mindex_11.Index, Wrap=True)
item_18 = ListItem(List=item_5, Index=mindex_9.Index, Wrap=True)
mindex_14 = MemberIndex(Set=cull_2, Member=bang_6._00000)  # -> Index, Count
item_19 = ListItem(List=item_8, Index=mindex_10.Index, Wrap=True)
mindex_15 = MemberIndex(Set=cull_2, Member=bang_6._00001)  # -> Index, Count
mindex_16 = MemberIndex(Set=cull_2, Member=bang_6._00002)  # -> Index, Count
item_20 = ListItem(List=item_14, Index=mindex_12.Index, Wrap=True)
clean = CleanTree(RemoveNulls=True, RemoveInvalid=True, RemoveEmpty=invert(False), Tree=item_16)
item_21 = ListItem(List=item_12, Index=mindex_13.Index, Wrap=True)
clean_2 = CleanTree(RemoveNulls=True, RemoveInvalid=True, RemoveEmpty=invert(False), Tree=item_19)
clean_3 = CleanTree(RemoveNulls=True, RemoveInvalid=True, RemoveEmpty=invert(False), Tree=item_17)
clean_4 = CleanTree(RemoveNulls=True, RemoveInvalid=True, RemoveEmpty=invert(False), Tree=item_18)
item_22 = ListItem(List=cull, Index=mindex_14.Index, Wrap=True)
clean_5 = CleanTree(RemoveNulls=True, RemoveInvalid=True, RemoveEmpty=invert(False), Tree=item_20)
item_23 = ListItem(List=cull, Index=mindex_15.Index, Wrap=True)
item_24 = ListItem(List=cull, Index=mindex_16.Index, Wrap=True)
clean_6 = CleanTree(RemoveNulls=True, RemoveInvalid=True, RemoveEmpty=invert(False), Tree=item_21)
conmesh = ConstructMesh(Vertices=clean, Faces={A=0, B=1, C=2, D=3})
conmesh_2 = ConstructMesh(Vertices=clean_2, Faces={A=0, B=1, C=2, D=3})
conmesh_3 = ConstructMesh(Vertices=clean_4, Faces={A=0, B=1, C=2, D=3})
conmesh_4 = ConstructMesh(Vertices=clean_3, Faces={A=0, B=1, C=2, D=3})
conmesh_5 = ConstructMesh(Vertices=clean_5, Faces={A=0, B=1, C=2, D=3})
partition_3 = PartitionList(List=item_22, Size="4")
conmesh_6 = ConstructMesh(Vertices=clean_6, Faces={A=0, B=1, C=2, D=3})
partition_4 = PartitionList(List=item_23, Size="4")
partition_5 = PartitionList(List=item_24, Size="4")
mcol_2 = MeshColours(Mesh=conmesh, Colours=swatch_5)
mcol_3 = MeshColours(Mesh=conmesh_3, Colours=swatch_6)
mcol_4 = MeshColours(Mesh=conmesh_4, Colours=swatch_4)
mcol_5 = MeshColours(Mesh=conmesh_2, Colours=swatch_3)
mcol_6 = MeshColours(Mesh=conmesh_5, Colours=swatch_2)
mcol_7 = MeshColours(Mesh=conmesh_6, Colours=swatch_7)
conmesh_7 = ConstructMesh(Vertices=partition_3, Faces={A=0, B=1, C=2, D=3}, Colours=swatch_8)
conmesh_8 = ConstructMesh(Vertices=partition_4, Faces={A=0, B=1, C=2, D=3}, Colours=bang_6._00001)
conmesh_9 = ConstructMesh(Vertices=partition_5, Faces={A=0, B=1, C=2, D=3}, Colours=swatch_8)
merge_9 = Merge(
    Data1=flatten(mcol_6),
    Data2=flatten(mcol_5),
    Data3=flatten(mcol_4),
    Data4=flatten(mcol_2),
    Data5=flatten(mcol_3),
    Data6=flatten(mcol_7))
mjoin = MeshJoin(Meshes=flatten([conmesh_8, conmesh_7, merge_9, conmesh_9]))

# ----
# Labels and lines
hourlyplot_3 = LBHourlyPlot(data=importepw.dry_bulb_temperature, x_dim=division_4, y_dim=division_3)  # -> report, mesh, legend, borders, labels, title, vis_set; plug-in component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
txt = Text(hourlyplot_3.labels)
split = SplitList(List=txt, Index="5")  # -> ListA, ListB
dom_4 = ConstructDomain(DomainStart="1", DomainEnd="5")
subset = SubList(List=hourlyplot_3.borders, Domain=dom_4, Wrap=True)  # -> List, Index
eval_5 = EvaluateCurve(Curve=hourlyplot_3.borders, Parameter="0")  # -> Point, Tangent, Angle
Y = UnitY(Factor=1)
end = EndPoints(Curve=subset.List)  # -> Start, End
mindex_17 = MemberIndex(Set=eval_5.Tangent, Member=Y)  # -> Index, Count
item_25 = ListItem(List=hourlyplot_3.borders, Index=mindex_17.Index, Wrap=True)
end_2 = EndPoints(Curve=item_25)  # -> Start, End
pdecon = Deconstruct(Point=end_2.Start)  # -> XComponent, YComponent, ZComponent
ins = InsertItems(List=pdecon.XComponent, Item="0", Indices="0", Wrap=True)
ins_2 = InsertItems(List=pdecon.XComponent, Item=graph_width, Indices="-1", Wrap=True)
pt = ConstructPoint(XCoordinate=ins, YCoordinate=0, ZCoordinate=0)
pt_2 = ConstructPoint(XCoordinate=ins_2, YCoordinate=0, ZCoordinate=0)
ln = Line(StartPoint=pt, EndPoint=pt_2)
midpt = CurveMiddle(Curve=ln)
neg = Negative(Value=labels_size)
addition_3 = Addition(A=labels_offset, B=neg)
Y_2 = UnitY(Factor=addition_3)
X = UnitX(Factor=labels_offset)
move = Move(Geometry=midpt, Motion=Y_2)  # -> Geometry, Transform
move_2 = Move(Geometry=end.Start, Motion=X)  # -> Geometry, Transform
tag = TextTag3D(Location=move.Geometry, Text=split.ListB, Size=labels_size, Colour=labels_colour, Justification=8)
preview = CustomPreview(Geometry=hourlyplot_3.borders, Material=main_lines_colour)
tag_2 = TextTag3D(Location=move_2.Geometry, Text=split.ListA, Size=labels_size, Colour=labels_colour, Justification=6)

# ----
# Y - axis labels
panel_9 = Panel("-100")
number_slider_2 = Slider(5, range=1..10)
multiplication = Multiplication(A=panel_9, B="-2")
addition_4 = Addition(A=multiplication, B=number_slider_2)
division_5 = Division(A=addition_4, B=number_slider_2)
series_4 = Series(Start=panel_9, Step=number_slider_2, Count=division_5)
num = Number("0")
X_2 = UnitX(Factor=1)
X_3 = UnitX(Factor=labels_offset)

# ----
# Misc
item_26 = ListItem(List=hourlyplot.borders, Index=0, Wrap=True)
cpoly = ControlPolygon(Curve=item_26)  # -> Polygon, Points
item_27 = ListItem(List=cpoly.Points, Index=0, Wrap=True)
cull_3 = CullPattern(List=replace_3, CullPattern=invert(inc_3.Includes))
cull_4 = CullPattern(List=replace_6, CullPattern=invert(inc_4.Includes))
cull_5 = CullPattern(List=replace_3, CullPattern=inc_3.Includes)
cull_6 = CullPattern(List=replace_6, CullPattern=inc_4.Includes)
number_slider_3 = Slider(25, range=0..50)
mindex_18 = MemberIndex(Set=cull_5, Member="1")  # -> Index, Count
mindex_19 = MemberIndex(Set=cull_5, Member="2")  # -> Index, Count
mindex_20 = MemberIndex(Set=cull_5, Member="3")  # -> Index, Count
mindex_21 = MemberIndex(Set=cull_6, Member="10")  # -> Index, Count
mindex_22 = MemberIndex(Set=cull_6, Member="20")  # -> Index, Count
mindex_23 = MemberIndex(Set=cull_6, Member="30")  # -> Index, Count
lng_2 = ListLength(List=cull_3)
lng_3 = ListLength(List=cull_4)
pt_3 = ConstructPoint(XCoordinate=number_slider, YCoordinate=0, ZCoordinate=0)
addition_5 = Addition(A=vertical_spacing, B=vertical_position)
addition_6 = Addition(A=addition_5, B=vertical_position_2)

# ----
# Main title
bang_7 = ExplodeTree(Data=simplify(graft(cpoly.Points)))  # -> Branch0, Branch1, Branch2, Branch3, Branch4
ln_2 = Line(StartPoint=bang_7.Branch0, EndPoint=bang_7.Branch3)
divide = DivideCurve(Curve=ln_2, Count="4", Kinks=False)  # -> Points, Tangents, Parameters
Y_3 = UnitY(Factor=expr("-x", vertical_spacing))
item_28 = ListItem(List=divide.Points, Index=0, Wrap=True)
filter_3 = StreamFilter(Gate=list, Stream0="I", Stream1="II", Stream2="III")
move_3 = Move(Geometry=item_28, Motion=Y_3)  # -> Geometry, Transform
concat = Concatenate(FragmentA="Statystics", FragmentB=filter_3)
tag_3 = TextTag3D(Location=move_3.Geometry, Text="Statystics", Size=graphs_title_size, Colour=labels_colour, Justification=7)

# ----
# Future
division_6 = Division(A=mindex_23.Count, B=8760)
division_7 = Division(A=mindex_21.Count, B=8760)
division_8 = Division(A=lng_3, B=8760)
division_9 = Division(A=mindex_22.Count, B=8760)
multiplication_2 = Multiplication(A=division_7, B=number_slider_3)
multiplication_3 = Multiplication(A=division_6, B=number_slider_3)
multiplication_4 = Multiplication(A=division_8, B=number_slider_3)
multiplication_5 = Multiplication(A=division_9, B=number_slider_3)
cir = Circle(Plane=pt_3, Radius=multiplication_2)
cir_2 = Circle(Plane=pt_3, Radius=multiplication_4)
cir_3 = Circle(Plane=pt_3, Radius=multiplication_3)
cir_4 = Circle(Plane=pt_3, Radius=multiplication_5)
multiplication_6 = Multiplication(A=horizontal_spacing, B=3)
multiplication_7 = Multiplication(A=horizontal_spacing, B=2)
vec = VectorXYZ(XComponent=multiplication_7, YComponent=expr("-x", addition_5), ZComponent=0)  # -> Vector, Length
vec_2 = VectorXYZ(XComponent=horizontal_spacing, YComponent=expr("-x", addition_5), ZComponent=0)  # -> Vector, Length
vec_3 = VectorXYZ(XComponent=0, YComponent=expr("-x", addition_5), ZComponent=0)  # -> Vector, Length
vec_4 = VectorXYZ(XComponent=multiplication_6, YComponent=expr("-x", addition_5), ZComponent=0)  # -> Vector, Length
move_4 = Move(Geometry=cir_4, Motion=vec.Vector)  # -> Geometry, Transform
move_5 = Move(Geometry=cir_3, Motion=vec_2.Vector)  # -> Geometry, Transform
move_6 = Move(Geometry=cir, Motion=vec_4.Vector)  # -> Geometry, Transform
move_7 = Move(Geometry=cir_2, Motion=vec_3.Vector)  # -> Geometry, Transform
boundary = BoundarySurfaces(Edges=move_4.Geometry)
boundary_2 = BoundarySurfaces(Edges=move_7.Geometry)
boundary_3 = BoundarySurfaces(Edges=move_5.Geometry)
boundary_4 = BoundarySurfaces(Edges=move_6.Geometry)
mesh_11 = Mesh(boundary_3)
mesh_12 = Mesh(boundary)
mesh_13 = Mesh(boundary_2)
mesh_14 = Mesh(boundary_4)
mcol_8 = MeshColours(Mesh=mesh_13, Colours=swatch)
mcol_9 = MeshColours(Mesh=mesh_11, Colours=swatch_9)
mcol_10 = MeshColours(Mesh=mesh_12, Colours=swatch_11)
mcol_11 = MeshColours(Mesh=mesh_14, Colours=swatch_10)

# ----
# Actual
division_10 = Division(A=mindex_18.Count, B=8760)
division_11 = Division(A=lng_2, B=8760)
division_12 = Division(A=mindex_19.Count, B=8760)
division_13 = Division(A=mindex_20.Count, B=8760)
multiplication_8 = Multiplication(A=division_10, B=number_slider_3)
multiplication_9 = Multiplication(A=division_12, B=number_slider_3)
multiplication_10 = Multiplication(A=division_13, B=number_slider_3)
multiplication_11 = Multiplication(A=division_11, B=number_slider_3)
cir_5 = Circle(Plane=pt_3, Radius=multiplication_8)
cir_6 = Circle(Plane=pt_3, Radius=multiplication_11)
cir_7 = Circle(Plane=pt_3, Radius=multiplication_10)
cir_8 = Circle(Plane=pt_3, Radius=multiplication_9)
vec_5 = VectorXYZ(XComponent=multiplication_6, YComponent=expr("-x", vertical_position), ZComponent=0)  # -> Vector, Length
vec_6 = VectorXYZ(XComponent=multiplication_7, YComponent=expr("-x", vertical_position), ZComponent=0)  # -> Vector, Length
vec_7 = VectorXYZ(XComponent=horizontal_spacing, YComponent=expr("-x", vertical_position), ZComponent=0)  # -> Vector, Length
vec_8 = VectorXYZ(XComponent=0, YComponent=expr("-x", vertical_position), ZComponent=0)  # -> Vector, Length
move_8 = Move(Geometry=cir_5, Motion=vec_5.Vector)  # -> Geometry, Transform
move_9 = Move(Geometry=cir_8, Motion=vec_6.Vector)  # -> Geometry, Transform
move_10 = Move(Geometry=cir_7, Motion=vec_7.Vector)  # -> Geometry, Transform
move_11 = Move(Geometry=cir_6, Motion=vec_8.Vector)  # -> Geometry, Transform
boundary_5 = BoundarySurfaces(Edges=move_8.Geometry)
boundary_6 = BoundarySurfaces(Edges=move_9.Geometry)
boundary_7 = BoundarySurfaces(Edges=move_10.Geometry)
boundary_8 = BoundarySurfaces(Edges=move_11.Geometry)
mesh_15 = Mesh(boundary_5)
mesh_16 = Mesh(boundary_6)
mesh_17 = Mesh(boundary_8)
mesh_18 = Mesh(boundary_7)
mcol_12 = MeshColours(Mesh=mesh_15, Colours=swatch_10)
mcol_13 = MeshColours(Mesh=mesh_18, Colours=swatch_9)
mcol_14 = MeshColours(Mesh=mesh_17, Colours=swatch)
mcol_15 = MeshColours(Mesh=mesh_16, Colours=swatch_11)

# ----
# Values
merge_10 = Merge(
    Data1=boundary_5,
    Data2=boundary_6,
    Data3=boundary_7,
    Data4=boundary_8,
    Data5=boundary_4,
    Data6=boundary,
    Data7=boundary_3,
    Data8=boundary_2)
merge_11 = Merge(
    Data1=division_10,
    Data2=division_12,
    Data3=division_13,
    Data4=division_11,
    Data5=division_7,
    Data6=division_9,
    Data7=division_6,
    Data8=division_8)
area = Area(Geometry=merge_10)  # -> Area, graft(Centroid)
multiplication_12 = Multiplication(A=merge_11, B="100")
round = Round(Number=multiplication_12)  # -> Nearest, Floor, Ceiling
concat_2 = Concatenate(FragmentA=round.Nearest, FragmentB="%")  # -> graft(Result)
text2crv = TextOutlines(TextContent=concat_2, Plane=area.Centroid, Face="Arial", Size=labels_size, Bold=False, Italics=False)  # -> TextCurves, TextBoundingBox
boundary_9 = BoundarySurfaces(Edges=text2crv.TextCurves)
mjoin_2 = MeshJoin(Meshes=boundary_9)
bbox = BoundingBox(Content=mjoin_2, Plane=PlaneXY(0, 0, 0))  # -> Box, Box_2
debox = DeconstructBox(Box=bbox.Box)  # -> Plane, flatten(X), Y, Z
edges = BrepEdges(Brep=bbox.Box)  # -> Naked, Interior, NonManifold
join = JoinCurves(Curves=edges.Naked, Preserve=False)
pcen = PolygonCenter(Polyline=join)  # -> CenterV, CenterE, CenterA
num_2 = Number(debox.X)
num_3 = Number(debox.Y)
vec2pt = Vector2Pt(PointA=pcen.CenterV, PointB=area.Centroid, Unitize=False)  # -> Vector, Length
move_12 = Move(Geometry=boundary_9, Motion=vec2pt.Vector)  # -> simplify(Geometry), Transform
mesh_19 = Mesh(move_12.Geometry)
mjoin_3 = MeshJoin(Meshes=mesh_19)  # -> flatten(Mesh)

# ----
# Ouside the circle if too big
number_slider_4 = Slider(0.5, range=0..1)
darc = DeconstructArc(Arc=merge_10)  # -> BasePlane, Radius, Angle
multiplication_13 = Multiplication(A=num_2, B=number_slider_4)  # -> simplify(Result)
larger_3 = LargerThan(FirstNumber=multiplication_13, SecondNumber=darc.Radius)  # -> LargerThan, OrEqualTo
cull_7 = CullPattern(List=flatten(num_3), CullPattern=larger_3.LargerThan)
cull_8 = CullPattern(List=darc.Radius, CullPattern=larger_3.LargerThan)
addition_7 = Addition(A=cull_8, B=cull_7)
dispatch = Dispatch(List=mjoin_3, DispatchPattern=larger_3.LargerThan)  # -> ListA, ListB
Y_4 = UnitY(Factor=addition_7)
move_13 = Move(Geometry=dispatch.ListA, Motion=Y_4)  # -> Geometry, Transform

# ----
# White if circle is dark
merge_12 = Merge(Data1=mcol_12, Data2=mcol_15, Data3=mcol_13, Data4=mcol_14, Data5=mcol_11, Data6=mcol_10, Data7=mcol_9, Data8=mcol_8)
cull_9 = CullPattern(List=merge_12, CullPattern=invert(larger_3.LargerThan))
demesh_9 = DeconstructMesh(Mesh=cull_9)  # -> Vertices, Faces, Colours, Normals
item_29 = ListItem(List=demesh_9.Colours, Index=0, Wrap=True)
ahsl = SplitAHSL(Colour=flatten(item_29))  # -> Alpha, Hue, Saturation, Luminance
larger_4 = LargerThan(FirstNumber=ahsl.Luminance, SecondNumber="0.5")  # -> LargerThan, OrEqualTo
dispatch_2 = Dispatch(List=dispatch.ListB, DispatchPattern=larger_4.LargerThan)  # -> ListA, ListB

# ----
# Statistics graphs
preview_2 = CustomPreview(Geometry=[move_13.Geometry, dispatch_2.ListA], Material=labels_colour)
preview_3 = CustomPreview(Geometry=dispatch_2.ListB, Material=ColourSwatch(SwatchColor=RGB(255, 255, 255)))

# ----
# Legend
panel_10 = Panel("""Always acc.
Hot -> Cold
Acc. -> Hot
Cold -> Acc.
Hot -> Acc.
Acc. -> Cold
Cold -> Hot
Always unacc.""")
merge_13 = Merge(Data1=swatch_8, Data2=merge)  # -> reverse(Result)
panel_11 = Panel("""0
6.5
7.5
8.5
18.5
19.5
28.5""")
num_4 = Number(13.57142857)
panel_12 = Panel("3.8")
legendparcategorized_2 = LBLegendParametersCategorized(domain=panel_11, colors=merge_13, categories=panel_10, seg_height=num_4, seg_width="6.8", text_height=labels_size)  # -> leg_par; plug-in component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

item_30 = ListItem(List=hourlyplot_2.borders, Index=0, Wrap=True)
item_31 = ListItem(List=hourlyplot_2.borders, Index=0, Wrap=True)
cpoly_2 = ControlPolygon(Curve=item_31)  # -> Polygon, Points
item_32 = ListItem(List=cpoly_2.Points, Index="1", Wrap=True)
X_4 = UnitX(Factor="6.8")
X_5 = UnitX(Factor="6.8")
Y_5 = UnitY(Factor=vertical_distance_graphs)
addition_8 = Addition(A=graph_height, B=vertical_distance_graphs)
division_14 = Division(A=small_graphs_width, B=graph_width)
Y_6 = UnitY(Factor=addition_8)
move_14 = Move(Geometry=item_32, Motion=X_4)  # -> Geometry, Transform

createlegend = LBCreateLegend(values=panel_11, base_plane=move_14.Geometry, title="Categories Shift", legend_par=legendparcategorized_2)  # -> mesh, title_obj, label_objs, label_text, colors; plug-in component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

# ----
# Actual
pt_4 = Point(Point(0, 0, 0))
scale = Scale(Geometry=ln, Center=pt_4, Factor=division_14)  # -> Geometry, Transform
scale_2 = Scale(Geometry=end.Start, Center=pt_4, Factor=division_14)  # -> Geometry, Transform
midpt_2 = CurveMiddle(Curve=scale.Geometry)
X_6 = UnitX(Factor=labels_offset)
Y_7 = UnitY(Factor=addition_3)
scale_3 = Scale(Geometry=hourlyplot_2.borders, Center=pt_4, Factor=division_14)  # -> Geometry, Transform
move_15 = Move(Geometry=midpt_2, Motion=Y_7)  # -> Geometry, Transform
move_16 = Move(Geometry=scale_2.Geometry, Motion=X_6)  # -> Geometry, Transform
scale_4 = Scale(Geometry=mesh, Center=pt_4, Factor=division_14)  # -> Geometry, Transform
scale_5 = Scale(Geometry=bang_5.Branch0, Center=pt_4, Factor=division_14)  # -> Geometry, Transform
move_17 = Move(Geometry=scale_3.Geometry, Motion=Y_6)  # -> Geometry, Transform
move_18 = Move(Geometry=move_15.Geometry, Motion=Y_6)  # -> Geometry, Transform
move_19 = Move(Geometry=move_16.Geometry, Motion=Y_6)  # -> Geometry, Transform
move_20 = Move(Geometry=scale_5.Geometry, Motion=Y_6)  # -> Geometry, Transform
move_21 = Move(Geometry=scale_4.Geometry, Motion=Y_6)  # -> Geometry, Transform
tag_4 = TextTag3D(Location=move_18.Geometry, Text=split.ListB, Size=labels_size, Colour=labels_colour, Justification=8)
preview_4 = CustomPreview(Geometry=move_17.Geometry, Material=main_lines_colour)
tag_5 = TextTag3D(Location=move_19.Geometry, Text=split.ListA, Size=labels_size, Colour=labels_colour, Justification=6)

# ----
# Future
panel_13 = Panel("-1")
item_33 = ListItem(List=pt_2, Index=panel_13, Wrap=True)
scale_6 = Scale(Geometry=end.Start, Center=item_33, Factor=division_14)  # -> Geometry, Transform
scale_7 = Scale(Geometry=ln, Center=item_33, Factor=division_14)  # -> Geometry, Transform
midpt_3 = CurveMiddle(Curve=scale_7.Geometry)
Y_8 = UnitY(Factor=addition_3)
X_7 = UnitX(Factor=labels_offset)
scale_8 = Scale(Geometry=hourlyplot_2.borders, Center=item_33, Factor=division_14)  # -> Geometry, Transform
move_22 = Move(Geometry=scale_6.Geometry, Motion=X_7)  # -> Geometry, Transform
move_23 = Move(Geometry=midpt_3, Motion=Y_8)  # -> Geometry, Transform
scale_9 = Scale(Geometry=bang_5.Branch1, Center=item_33, Factor=division_14)  # -> Geometry, Transform
scale_10 = Scale(Geometry=mesh_2, Center=item_33, Factor=division_14)  # -> Geometry, Transform
move_24 = Move(Geometry=scale_8.Geometry, Motion=Y_6)  # -> Geometry, Transform
move_25 = Move(Geometry=move_22.Geometry, Motion=Y_6)  # -> Geometry, Transform
move_26 = Move(Geometry=move_23.Geometry, Motion=Y_6)  # -> Geometry, Transform
move_27 = Move(Geometry=scale_9.Geometry, Motion=Y_6)  # -> Geometry, Transform
move_28 = Move(Geometry=scale_10.Geometry, Motion=Y_6)  # -> Geometry, Transform
tag_6 = TextTag3D(Location=move_26.Geometry, Text=split.ListB, Size=labels_size, Colour=labels_colour, Justification=8)
preview_5 = CustomPreview(Geometry=move_24.Geometry, Material=main_lines_colour)
tag_7 = TextTag3D(Location=move_25.Geometry, Text=split.ListA, Size=labels_size, Colour=labels_colour, Justification=6)

# ----
# Heatmaps
item_34 = ListItem(List=move_17.Geometry, Index=0, Wrap=True)
item_35 = ListItem(List=move_24.Geometry, Index=0, Wrap=True)
cp = ControlPoints(Curve=[item_34, item_35, item_30])  # -> Points, Weights, Knots
drec = DeconstuctRectangle(Rectangle=item_34)  # -> BasePlane, XInterval, YInterval
int_2 = Integer(drec.YInterval)
division_15 = Division(A=int_2, B="7")
item_36 = ListItem(List=move_24.Geometry, Index=0, Wrap=True)
item_37 = ListItem(List=cp.Points, Index="3", Wrap=True)  # -> simplify(Item)
flatten = FlattenTree(Tree=item_37, Path="{0}")
cpoly_3 = ControlPolygon(Curve=item_36)  # -> Polygon, Points
item_38 = ListItem(List=flatten, Index=0, Wrap=True)
item_39 = ListItem(List=cpoly_3.Points, Index="1", Wrap=True)
move_29 = Move(Geometry=item_38, Motion=Y_5)  # -> Geometry, Transform
move_30 = Move(Geometry=item_39, Motion=X_5)  # -> Geometry, Transform

# ----
# Main title
panel_14 = Panel("Adaptive comfort_EN 16798 - Category ")
filter_4 = StreamFilter(Gate=list, Stream0="I", Stream1="II", Stream2="III")
split_2 = TextSplit(Text=importepw.location, Separators=",")
concat_3 = Concatenate(FragmentA=panel_14, FragmentB=filter_4)
item_40 = ListItem(List=split_2, Index=0, Wrap=True)
merge_14 = Merge(Data1=concat_3, Data2=item_40)  # -> flatten(Result)
Y_9 = UnitY(Factor=main_title_position)
join_2 = TextJoin(Text=merge_14, Join="_")
move_31 = Move(Geometry=move_29.Geometry, Motion=Y_9)  # -> Geometry, Transform
tag_8 = TextTag3D(Location=move_31.Geometry, Text=join_2, Size=main_title_size, Colour=labels_colour, Justification=7)

# ----
# Small titles
number_slider_5 = Slider(7, range=0..10)
entwine_7 = Entwine(Branch00="Actual", Branch01="Future", Branch02="Delta", FlattenInputs=True)  # -> simplify(Result)
Y_10 = UnitY(Factor=number_slider_5)
move_32 = Move(Geometry=item_37, Motion=Y_10)  # -> simplify(Geometry), Transform
tag_9 = TextTag3D(Location=move_32.Geometry, Text=entwine_7, Size=graphs_title_size, Colour=labels_colour, Justification=7)

# ----
# Legend
panel_15 = Panel("""Unacceptable Cold
Acceptable
Unacceptable Hot
Not applicable""")
merge_15 = Merge(Data1=swatch, Data2=merge_2)  # -> reverse(Result)
panel_16 = Panel("""0
1
2""")
legendparcategorized_3 = LBLegendParametersCategorized(domain=panel_16, colors=merge_15, categories=panel_15, seg_height=division_15, seg_width="6.8", text_height=labels_size)  # -> leg_par; plug-in component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
panel_17 = Panel("""0
2""")
createlegend_2 = LBCreateLegend(values=panel_17, base_plane=move_30.Geometry, title="Categories", legend_par=legendparcategorized_3)  # -> mesh, title_obj, label_objs, label_text, colors; plug-in component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

# ----
# File name
panel_18 = Panel("adaptive_comfort_current_future_delta_statystics.gh")
Y_11 = UnitY(Factor=Slider(-13, range=-15..0))
move_33 = Move(Geometry=move_31.Geometry, Motion=Y_11)  # -> Geometry, Transform
tag_10 = TextTag3D(Location=move_33.Geometry, Text=panel_18, Size="6.3", Colour=labels_colour, Justification=7)

Y_12 = UnitY(Factor=expr("-x/1.5", addition_6))

# ----
# Y - axis title
number_slider_6 = Slider(-10, range=-10..0)
addition_9 = Addition(A=labels_offset, B=number_slider_6)
X_8 = UnitX(Factor=addition_9)

# ----
# Rows titles
Y_13 = UnitY(Factor=expr("-x", vertical_position))
Y_14 = UnitY(Factor=expr("-x", vertical_spacing))
move_34 = Move(Geometry=item_27, Motion=Y_13)  # -> Geometry, Transform
move_35 = Move(Geometry=move_34.Geometry, Motion=Y_14)  # -> Geometry, Transform
subtraction_4 = Subtraction(A=labels_offset, B=Slider(0, range=0..20))
X_9 = UnitX(Factor=subtraction_4)
panel_19 = Panel("""Actual
Future
Delta""")

# ----
# X - axis labels
Y_15 = UnitY(Factor=expr("-x", 1))
Y_16 = UnitY(Factor=labels_offset)
panel_20 = Panel("""Unacceptable Hot
Acceptable
Unacceptable Cold
Not applicable""")

# ----
# Delta
subtraction_5 = Subtraction(A=mindex_23.Count, B=mindex_20.Count)
subtraction_6 = Subtraction(A=lng_3, B=lng_2)
subtraction_7 = Subtraction(A=mindex_22.Count, B=mindex_19.Count)
subtraction_8 = Subtraction(A=mindex_21.Count, B=mindex_18.Count)
division_16 = Division(A=subtraction_6, B="87.60")
division_17 = Division(A=subtraction_8, B="87.60")
division_18 = Division(A=subtraction_7, B="87.60")
division_19 = Division(A=subtraction_5, B="87.60")
X_10 = UnitX(Factor=horizontal_spacing)
vec_9 = VectorXYZ(XComponent=number_slider, YComponent=expr("-x/1.5", addition_6), ZComponent=0)  # -> Vector, Length
division_20 = Division(A=Slider(10, range=0..10), B="2")
move_36 = Move(Geometry=item_27, Motion=vec_9.Vector)  # -> Geometry, Transform
move_37 = Move(Geometry=move_36.Geometry, Motion=X_10)  # -> Geometry, Transform
move_38 = Move(Geometry=move_37.Geometry, Motion=X_10)  # -> Geometry, Transform
move_39 = Move(Geometry=move_38.Geometry, Motion=X_10)  # -> Geometry, Transform
dom_5 = ConstructDomain(DomainStart=expr("-x", division_20), DomainEnd=division_20)
panel_21 = Panel("5")

bnd = Bounds(Numbers=flatten([division_16, division_17, division_18, division_19]))

dedomain = DeconstructDomain(Domain=bnd)  # -> Start, End

smaller_3 = SmallerThan(FirstNumber=dedomain.Start, SecondNumber=series_4)  # -> SmallerThan, OrEqualTo
smaller_4 = SmallerThan(FirstNumber=dedomain.End, SecondNumber=series_4)  # -> SmallerThan, OrEqualTo
mindex_24 = MemberIndex(Set=smaller_3.SmallerThan, Member=Toggle(False))  # -> Index, Count
mindex_25 = MemberIndex(Set=smaller_4.OrEqualTo, Member=Toggle(True))  # -> Index, Count
bnd_2 = Bounds(Numbers=mindex_25.Index)
bnd_3 = Bounds(Numbers=mindex_24.Index)
dedomain_2 = DeconstructDomain(Domain=bnd_2)  # -> Start, End
dedomain_3 = DeconstructDomain(Domain=bnd_3)  # -> Start, End
item_41 = ListItem(List=series_4, Index=dedomain_3.End, Wrap=True)
item_42 = ListItem(List=series_4, Index=dedomain_2.Start, Wrap=True)
abs = Absolute(Value=item_41)
abs_2 = Absolute(Value=item_42)
addition_10 = Addition(A=abs_2, B=abs)
division_21 = Division(A=addition_10, B=number_slider_2)
dom_6 = ConstructDomain(DomainStart=item_42, DomainEnd=item_41)
division_22 = Division(A=Slider(50, range=0..1000), B=addition_10)
range = Range(Domain=dom_6, Steps=division_21)
round_2 = Round(Number=range)  # -> Nearest, Floor, Ceiling
multiplication_14 = Multiplication(A=round_2.Nearest, B=division_22)
pt_5 = ConstructPoint(XCoordinate=Slider(15, range=0..100), YCoordinate=multiplication_14, ZCoordinate=0)
pdecon_2 = Deconstruct(Point=pt_5)  # -> XComponent, YComponent, ZComponent
mindex_26 = MemberIndex(Set=pdecon_2.YComponent, Member=num)  # -> Index, Count
move_40 = Move(Geometry=pt_5, Motion=Y_12)  # -> Geometry, Transform
line = LineSDL(Start=move_40.Geometry, Direction=X_2, Length=Slider(342, range=0..1000))
end_3 = EndPoints(Curve=line)  # -> Start, End
move_41 = Move(Geometry=end_3.Start, Motion=X_3)  # -> Geometry, Transform
tag_11 = TextTag3D(Location=move_41.Geometry, Text=round_2.Nearest, Size=labels_size, Colour=labels_colour, Justification=6)

bnd_4 = Bounds(Numbers=pdecon_2.YComponent)
dedomain_4 = DeconstructDomain(Domain=bnd_4)  # -> Start, End
mindex_27 = MemberIndex(Set=pdecon_2.YComponent, Member=dedomain_4.Start)  # -> Index, Count
item_43 = ListItem(List=line, Index=mindex_27.Index, Wrap=True)

end_4 = EndPoints(Curve=item_43)  # -> Start, End
move_42 = Move(Geometry=end_4.Start, Motion=X_8)  # -> Geometry, Transform
prot = RotatePlane(Plane=move_42.Geometry, Angle=degrees("90"))
move_43 = Move(Geometry=prot, Motion=Vector(0, 0, 10))  # -> Geometry, Transform
tag_12 = TextTag3D(Location=move_43.Geometry, Text="%", Size=labels_size, Colour=labels_colour, Justification=7)

merge_16 = Merge(Data1=move_36.Geometry, Data2=move_37.Geometry, Data3=move_38.Geometry, Data4=move_39.Geometry)
project = ProjectPoint(Point=merge_16, Direction=Y_15, Geometry=item_43)  # -> Point, Index
move_44 = Move(Geometry=project.Point, Motion=Y_16)  # -> Geometry, Transform
tag_13 = TextTag3D(Location=reverse(move_44.Geometry), Text=panel_20, Size=labels_size, Colour=labels_colour, Justification=2)

# ----
# Horizontal secondary line
cull_i = CullIndex(List=line, Indices=mindex_26.Index, Wrap=True)
previewlw = CustomPreviewLineweights(Geometry=flatten(cull_i), Shader=sub_lines_colour, Thickness=lines_thickness, Absolute=False)

# ----
# Horizontal main line
item_44 = ListItem(List=line, Index=mindex_26.Index, Wrap=True)
previewlw_2 = CustomPreviewLineweights(Geometry=item_44, Shader=main_lines_colour, Thickness=lines_thickness, Absolute=False)

end_5 = EndPoints(Curve=item_44)  # -> Start, End
pdecon_3 = Deconstruct(Point=end_5.Start)  # -> XComponent, YComponent, ZComponent
pt_6 = ConstructPoint(XCoordinate=labels_offset, YCoordinate=pdecon_3.YComponent, ZCoordinate=0)
merge_17 = Merge(Data1=move_34.Geometry, Data2=move_35.Geometry, Data3=pt_6)  # -> flatten(Result)
move_45 = Move(Geometry=merge_17, Motion=X_9)  # -> Geometry, Transform
tag_14 = TextTag3D(Location=move_45.Geometry, Text=panel_19, Size=labels_size, Colour=labels_colour, Justification=6)

multiplication_15 = Multiplication(A=division_18, B=division_22)
multiplication_16 = Multiplication(A=division_17, B=division_22)
multiplication_17 = Multiplication(A=division_19, B=division_22)
multiplication_18 = Multiplication(A=division_16, B=division_22)
rectangle = Rectangle(Plane=move_38.Geometry, XSize=dom_5, YSize=multiplication_15, Radius=0)  # -> Rectangle, Length
rectangle_2 = Rectangle(Plane=move_37.Geometry, XSize=dom_5, YSize=multiplication_17, Radius=0)  # -> Rectangle, Length
rectangle_3 = Rectangle(Plane=move_39.Geometry, XSize=dom_5, YSize=multiplication_16, Radius=0)  # -> Rectangle, Length
rectangle_4 = Rectangle(Plane=move_36.Geometry, XSize=dom_5, YSize=multiplication_18, Radius=0)  # -> Rectangle, Length
boundary_10 = BoundarySurfaces(Edges=rectangle_2.Rectangle)
boundary_11 = BoundarySurfaces(Edges=rectangle_3.Rectangle)
boundary_12 = BoundarySurfaces(Edges=rectangle.Rectangle)
boundary_13 = BoundarySurfaces(Edges=rectangle_4.Rectangle)
mesh_20 = Mesh(boundary_10)
mesh_21 = Mesh(boundary_12)
mesh_22 = Mesh(boundary_11)
mesh_23 = Mesh(boundary_13)
mcol_16 = MeshColours(Mesh=mesh_23, Colours=swatch)
mcol_17 = MeshColours(Mesh=mesh_20, Colours=swatch_9)
mcol_18 = MeshColours(Mesh=mesh_21, Colours=swatch_11)
mcol_19 = MeshColours(Mesh=mesh_22, Colours=swatch_10)

# ---- group: White circle border
previewlw_3 = CustomPreviewLineweights(
    Geometry=[move_9.Geometry, move_4.Geometry, rectangle.Rectangle],
    Shader=main_lines_colour,
    Thickness=Slider(0.2, range=0.1..5),
    Absolute=True)
