# Grasshopper definition dry_bulb_temperature_calendar_delta_and_violin_plot.gh (Grasshopper 1.0.8)

# ----
# Settings
violin_graph_s_horizontal_intervals = Slider(50, range=1..100, expression="x*5")
violin_delta_graph_s_vertical_intervals = Slider(5, range=1..100)
violin_graph_s_vertical_intervals = Slider(1, range=1..20, expression="x*5")
vertical_distance_graphs = Slider(30, range=0..100)
violin_graph_s_width = Slider(120, range=0..1000)
upper_graph_width = Slider(450, range=0..1000)
lower_graph_width = Slider(450, range=0..1000)
graphs_height = Slider(150, range=0..1000)
graphs_title_size = Slider(6.3, range=0..10)
main_title_size = Slider(7, range=0..10)
labels_offset = Slider(-3, range=-3..0)
labels_size = Slider(5, range=0..10)
violin_delta_bars_colour = ColourSwatch(SwatchColor=RGB(0, 0, 0))
labels_colour = ColourSwatch(SwatchColor=RGB(0, 0, 0))
lines_colour = ColourSwatch(SwatchColor=RGB(128, 128, 128))

# ----
# File: dry_bulb_temperature_calendar_delta_and_violin_plot.gh
# Additional plugins: Ladybug Tools version 1.8.0
# 1. Insert path to current EPW
current_epw = FilePath("D:\Marcello\Dropbox\PhD Parma\BERKELEY\CLIMA TOOL\PHASE 2\Paper 1\EPWs\Roma_Ciampino-hour_PRESENT.epw")

# ----
# 2. Insert path to future EPW
future_epw = FilePath("D:\Marcello\Dropbox\PhD Parma\BERKELEY\CLIMA TOOL\PHASE 2\Paper 1\EPWs\Roma_Ciampino-hour_2050.epw")

# ---- group: Data colours
swatch = ColourSwatch(SwatchColor=RGB(254, 218, 139))
swatch_2 = ColourSwatch(SwatchColor=RGB(165, 0, 38))
swatch_3 = ColourSwatch(SwatchColor=RGB(221, 61, 45))
swatch_4 = ColourSwatch(SwatchColor=RGB(246, 126, 75))
swatch_5 = ColourSwatch(SwatchColor=RGB(253, 179, 102))
swatch_6 = ColourSwatch(SwatchColor=RGB(234, 236, 204))
swatch_7 = ColourSwatch(SwatchColor=RGB(194, 228, 239))
swatch_8 = ColourSwatch(SwatchColor=RGB(152, 202, 225))
swatch_9 = ColourSwatch(SwatchColor=RGB(110, 166, 205))
swatch_10 = ColourSwatch(SwatchColor=RGB(74, 123, 183))
swatch_11 = ColourSwatch(SwatchColor=RGB(54, 75, 154))

# ----
# Data management
importepw = LBImportEPW(epw_file=future_epw)  # -> location, dry_bulb_temperature, dew_point_temperature, relative_humidity, wind_speed, wind_direction, direct_normal_rad, diffuse_horizontal_rad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; plug-in component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
importepw_2 = LBImportEPW(epw_file=current_epw)  # -> location, dry_bulb_temperature, dew_point_temperature, relative_humidity, wind_speed, wind_direction, direct_normal_rad, diffuse_horizontal_rad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; plug-in component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
xdata = LBDeconstructData(data=importepw.dry_bulb_temperature)  # -> header, values; plug-in component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
xdata_2 = LBDeconstructData(data=importepw_2.dry_bulb_temperature)  # -> header, values; plug-in component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
subtraction = Subtraction(A=flatten(xdata.values), B=flatten(xdata_2.values))
data = Data(flatten([xdata_2.values, xdata.values]))
bnd = Bounds(Numbers=flatten(data))
bnd_2 = Bounds(Numbers=subtraction)
dedomain = DeconstructDomain(Domain=bnd_2)  # -> Start, End
dedomain_2 = DeconstructDomain(Domain=bnd)  # -> Start, End
merge = Merge(Data1=swatch_2, Data2=ColourSwatch(SwatchColor=RGB(255, 255, 255)), Data3=swatch_11)  # -> reverse(Result)
abs = Absolute(Value=dedomain.Start)
abs_2 = Absolute(Value=dedomain.End)
max = Maximum(A=abs, B=abs_2)
addition = Addition(A=graphs_height, B=vertical_distance_graphs)
merge_2 = Merge(
    Data1=swatch_2,
    Data2=swatch_3,
    Data3=swatch_4,
    Data4=swatch_5,
    Data5=swatch,
    Data6=swatch_6,
    Data7=swatch_7,
    Data8=swatch_8,
    Data9=swatch_9,
    Data10=swatch_10,
    Data11=swatch_11)  # -> reverse(Result)
Y = UnitY(Factor=addition)
addition_2 = Addition(A=lower_graph_width, B="6.8")
round = Round(Number=max)  # -> Nearest, Floor, Ceiling
round_2 = Round(Number=dedomain_2.End)  # -> Nearest, Floor, Ceiling
round_3 = Round(Number=dedomain_2.Start)  # -> Nearest, Floor, Ceiling
neg = Negative(Value=round.Nearest)
xy = XYPlane(Origin=Point(0, 0, 0))
vec = VectorXYZ(XComponent=addition_2, YComponent=addition, ZComponent=0)  # -> Vector, Length
entwine = Entwine(Branch00=round_3.Nearest, Branch01=round_3.Nearest, Branch02=neg, FlattenInputs=True)  # -> simplify(Result)
entwine_2 = Entwine(Branch00=round_2.Nearest, Branch01=round_2.Nearest, Branch02=round.Nearest, FlattenInputs=True)  # -> simplify(Result)
entwine_3 = Entwine(Branch00=merge_2, Branch01=merge_2, Branch02=merge, FlattenInputs=True)  # -> simplify(Result)
move = Move(Geometry=xy, Motion=vec.Vector)  # -> Geometry, Transform
division = Division(A=graphs_height, B="7")
entwine_4 = Entwine(Branch00=move.Geometry, Branch01=move.Geometry, FlattenInputs=True)  # -> simplify(Result)
subtraction_2 = Subtraction(A=xdata.values, B=xdata_2.values)
data_2 = LBConstructData(header=xdata.header, values=subtraction_2)  # -> simplify(data); plug-in component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
pshift = ShiftPaths(Data=data_2, Offset=-1)
legendpar = LBLegendParameters(
    min=entwine,
    max=entwine_2,
    seg_count="7",
    colors=entwine_3,
    continuous_leg=Toggle(True),
    num_decimals="0",
    base_plane=entwine_4,
    seg_height=division,
    seg_width="6.8",
    text_height=labels_size)  # -> leg_par; plug-in component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
entwine_5 = Entwine(Branch00=importepw_2.dry_bulb_temperature, Branch01=importepw.dry_bulb_temperature, Branch02=pshift, FlattenInputs=True)  # -> simplify(Result)
division_2 = Division(A=graphs_height, B="24")
division_3 = Division(A=lower_graph_width, B="365")
hourlyplot = LBHourlyPlot(data=entwine_5, x_dim=division_3, y_dim=division_2, legend_par=legendpar)  # -> report, mesh, legend, borders, labels, title, vis_set; plug-in component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
partition = PartitionList(List=hourlyplot.labels, Size="17")
partition_2 = PartitionList(List=hourlyplot.borders, Size="17")
bang = ExplodeTree(Data=partition_2)  # -> Branch0, Branch1, Branch2
bang_2 = ExplodeTree(Data=partition)  # -> Branch0, Branch1, Branch2
bang_3 = ExplodeTree(Data=hourlyplot.mesh)  # -> Branch0, Branch1, Branch2
split = SplitList(List=bang_2.Branch0, Index="5")  # -> ListA, ListB
mesh = Mesh(bang_3.Branch0)

bang_4 = ExplodeTree(Data=legendpar)  # -> Branch0, Branch1, Branch2

# ----
# DELTA HEATMAP
panel = Panel("1")
dom = ConstructDomain(DomainStart=panel, DomainEnd="5")
subset = SubList(List=bang.Branch0, Domain=dom, Wrap=True)  # -> List, Index
eval = EvaluateCurve(Curve=bang.Branch0, Parameter="0")  # -> Point, Tangent, Angle
Y_2 = UnitY(Factor=1)
mindex = MemberIndex(Set=eval.Tangent, Member=Y_2)  # -> Index, Count
end = EndPoints(Curve=subset.List)  # -> Start, End
item = ListItem(List=bang.Branch0, Index=mindex.Index, Wrap=True)
end_2 = EndPoints(Curve=item)  # -> Start, End
pdecon = Deconstruct(Point=end_2.Start)  # -> XComponent, YComponent, ZComponent
ins = InsertItems(List=pdecon.XComponent, Item="0", Indices="0", Wrap=True)
ins_2 = InsertItems(List=pdecon.XComponent, Item=lower_graph_width, Indices="-1", Wrap=True)
pt = ConstructPoint(XCoordinate=ins, YCoordinate=0, ZCoordinate=0)
pt_2 = ConstructPoint(XCoordinate=ins_2, YCoordinate=0, ZCoordinate=0)
ln = Line(StartPoint=pt, EndPoint=pt_2)
neg_2 = Negative(Value=labels_size)
bang_5 = ExplodeTree(Data=legendpar)  # -> Branch0, Branch1, Branch2
midpt = CurveMiddle(Curve=ln)
addition_3 = Addition(A=labels_offset, B=neg_2)
heatmap = LBSpatialHeatmap(values=subtraction_2, mesh=mesh, legend_par=bang_5.Branch2, legend_title="Δ°C")  # -> mesh, legend, title, colors, legend_par, vis_set; plug-in component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
X = UnitX(Factor=labels_offset)
Y_3 = UnitY(Factor=addition_3)
move_2 = Move(Geometry=end.Start, Motion=X)  # -> Geometry, Transform
move_3 = Move(Geometry=midpt, Motion=Y_3)  # -> Geometry, Transform
mesh_2 = Mesh(heatmap.mesh)
geo = Geometry(heatmap.legend)
tag = TextTag3D(Location=move_3.Geometry, Text=split.ListB, Size=labels_size, Colour=labels_colour, Justification=8)
preview = CustomPreview(Geometry=bang.Branch0, Material=lines_colour)
tag_2 = TextTag3D(Location=move_2.Geometry, Text=split.ListA, Size=labels_size, Colour=labels_colour, Justification=6)

# ----
# ACTUAL HEATMAP
division_4 = Division(A=upper_graph_width, B=lower_graph_width)
panel_2 = Panel("17")
pt_3 = Point(Point(0, 0, 0))
scale = Scale(Geometry=ln, Center=pt_3, Factor=division_4)  # -> Geometry, Transform
scale_2 = Scale(Geometry=end.Start, Center=pt_3, Factor=division_4)  # -> Geometry, Transform
move_4 = Move(Geometry=mesh, Motion=Y)  # -> Geometry, Transform
midpt_2 = CurveMiddle(Curve=scale.Geometry)
X_2 = UnitX(Factor=labels_offset)
Y_4 = UnitY(Factor=addition_3)
heatmap_2 = LBSpatialHeatmap(values=xdata_2.values, mesh=move_4.Geometry, legend_par=bang_4.Branch0, legend_title="°C")  # -> mesh, legend, title, colors, legend_par, vis_set; plug-in component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
scale_3 = Scale(Geometry=bang.Branch0, Center=pt_3, Factor=division_4)  # -> Geometry, Transform
move_5 = Move(Geometry=midpt_2, Motion=Y_4)  # -> Geometry, Transform
move_6 = Move(Geometry=scale_2.Geometry, Motion=X_2)  # -> Geometry, Transform
move_7 = Move(Geometry=move_5.Geometry, Motion=Y)  # -> Geometry, Transform
move_8 = Move(Geometry=scale_3.Geometry, Motion=Y)  # -> Geometry, Transform
move_9 = Move(Geometry=move_6.Geometry, Motion=Y)  # -> Geometry, Transform
tag_3 = TextTag3D(Location=move_7.Geometry, Text=split.ListB, Size=labels_size, Colour=labels_colour, Justification=8)
preview_2 = CustomPreview(Geometry=move_8.Geometry, Material=lines_colour)
tag_4 = TextTag3D(Location=move_9.Geometry, Text=split.ListA, Size=labels_size, Colour=labels_colour, Justification=6)
geo_2 = Geometry(heatmap_2.mesh)
geo_3 = Geometry(heatmap_2.legend)

# ---- group: Total data range
merge_3 = Merge(Data1=xdata.values, Data2=xdata_2.values)
bnd_3 = Bounds(Numbers=flatten(merge_3))
dedomain_3 = DeconstructDomain(Domain=bnd_3)  # -> Start, End

# ----
# Reference points
item_2 = ListItem(List=bang.Branch0, Index=0, Wrap=True)
# Titles
item_3 = ListItem(List=move_8.Geometry, Index=0, Wrap=True)
cp = ControlPoints(Curve=[item_3, item_2])  # -> Points, Weights, Knots
item_4 = ListItem(List=cp.Points, Index="3", Wrap=True)  # -> simplify(Item)

# ----
# Small titles - Heatmaps
number_slider = Slider(7, range=0..10)
entwine_6 = Entwine(Branch00="Delta", Branch01="Actual", FlattenInputs=True)  # -> simplify(Result)
Y_5 = UnitY(Factor=number_slider)
move_10 = Move(Geometry=item_4, Motion=Y_5)  # -> simplify(Geometry), Transform
tag_5 = TextTag3D(Location=move_10.Geometry, Text=entwine_6, Size=graphs_title_size, Colour=labels_colour, Justification=7)

# ----
# Main title
panel_3 = Panel(",")
split_2 = TextSplit(Text=importepw_2.location, Separators=panel_3)
panel_4 = Panel("File: dry_bulb_temperature_calendar_delta_and_violin_plot.gh")
item_5 = ListItem(List=split_2, Index=0, Wrap=True)
flatten = FlattenTree(Tree=item_4, Path="{0}")
item_6 = ListItem(List=flatten, Index=0, Wrap=True)
merge_4 = Merge(Data1="Dry bulb temperature", Data2=item_5)  # -> flatten(Result)
Y_6 = UnitY(Factor=Slider(50, range=0..50))
Y_7 = UnitY(Factor=Slider(-13.3, range=-20..0))
join = TextJoin(Text=merge_4, Join="_")
move_11 = Move(Geometry=item_6, Motion=Y_6)  # -> Geometry, Transform
move_12 = Move(Geometry=move_11.Geometry, Motion=Y_7)  # -> Geometry, Transform
tag_6 = TextTag3D(Location=move_12.Geometry, Text=panel_4, Size=graphs_title_size, Colour=labels_colour, Justification=7)
tag_7 = TextTag3D(Location=move_11.Geometry, Text=join, Size=main_title_size, Colour=labels_colour, Justification=7)

# ---- group: Horizontal positioning
division_5 = Division(A=violin_graph_s_width, B="2")
addition_4 = Addition(A=division_5, B=lower_graph_width, C=vertical_distance_graphs, D="45")
X_3 = UnitX(Factor=addition_4)

# ---- group: Small title - Violin
bang_6 = ExplodeTree(Data=move_10.Geometry)  # -> Branch0, Branch1
devec = DeconstructVector(Vector=X_3)  # -> XComponent, YComponent, ZComponent
subtraction_3 = Subtraction(A=devec.XComponent, B=division_5)
X_4 = UnitX(Factor=subtraction_3)
move_13 = Move(Geometry=bang_6.Branch1, Motion=X_4)  # -> Geometry, Transform
tag_8 = TextTag3D(Location=move_13.Geometry, Text="Temperature frequency", Size=graphs_title_size, Colour=labels_colour, Justification=7)

# ----
# Frequency
bnd_4 = Bounds(Numbers=flatten([xdata_2.values, xdata.values]))
dedomain_4 = DeconstructDomain(Domain=bnd_4)  # -> Start, End
round_4 = Round(Number=dedomain_4.End)  # -> Nearest, Floor, Ceiling
round_5 = Round(Number=dedomain_4.Start)  # -> Nearest, Floor, Ceiling
subtraction_4 = Subtraction(A=round_4.Ceiling, B=round_5.Floor)
addition_5 = Addition(A=subtraction_4, B="1")
series = Series(Start=round_5.Floor, Step=1, Count=addition_5)
round_6 = Round(Number=xdata.values)  # -> Nearest, Floor, Ceiling
round_7 = Round(Number=xdata_2.values)  # -> Nearest, Floor, Ceiling
equals = Equality(FirstNumber=round_7.Nearest, SecondNumber=graft(series))  # -> Equality, Inequality
equals_2 = Equality(FirstNumber=round_6.Nearest, SecondNumber=graft(series))  # -> Equality, Inequality
ma = MassAddition(Input=equals_2.Equality)  # -> flatten(Result), PartialResults
ma_2 = MassAddition(Input=equals.Equality)  # -> flatten(Result), PartialResults

# ---- group: Horizontal coeficient
int = Integer([ma_2.Result, ma.Result])
bnd_5 = Bounds(Numbers=int)
dedomain_5 = DeconstructDomain(Domain=bnd_5)  # -> Start, End
series_2 = Series(Start=0, Step=violin_graph_s_horizontal_intervals, Count="8760")
smaller = SmallerThan(FirstNumber=series_2, SecondNumber=dedomain_5.End)  # -> SmallerThan, OrEqualTo
mindex_2 = MemberIndex(Set=smaller.OrEqualTo, Member=Toggle(False))  # -> Index, Count
bnd_6 = Bounds(Numbers=mindex_2.Index)
dedomain_6 = DeconstructDomain(Domain=bnd_6)  # -> Start, End
item_7 = ListItem(List=series_2, Index=dedomain_6.Start, Wrap=True)

# ----
# Colors
round_8 = Round(Number=dedomain_3.End)  # -> Nearest, Floor, Ceiling
round_9 = Round(Number=dedomain_3.Start)  # -> Nearest, Floor, Ceiling
subtraction_5 = Subtraction(A=round_8.Ceiling, B=round_9.Floor)
legendpar_2 = LBLegendParameters(colors=merge_2)  # -> leg_par; plug-in component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
series_3 = Series(Start=round_5.Floor, Step=1, Count=expr("x+1", subtraction_5))
createlegend = LBCreateLegend(values=series_3, legend_par=legendpar_2)  # -> mesh, title_obj, label_objs, label_text, colors; plug-in component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

# ----
# VIOLIN
number_slider_2 = Slider(-10, range=-100..0)

# ----
# Horizontal framework
panel_5 = Panel("-50")
series_4 = Series(Start=panel_5, Step=violin_graph_s_vertical_intervals, Count="21")
smaller_2 = SmallerThan(FirstNumber=dedomain_3.End, SecondNumber=series_4)  # -> SmallerThan, OrEqualTo
larger = LargerThan(FirstNumber=dedomain_3.Start, SecondNumber=series_4)  # -> LargerThan, OrEqualTo
mindex_3 = MemberIndex(Set=smaller_2.OrEqualTo, Member=Toggle(True))  # -> Index, Count
mindex_4 = MemberIndex(Set=larger.OrEqualTo, Member=Toggle(True))  # -> Index, Count
bnd_7 = Bounds(Numbers=mindex_4.Index)
bnd_8 = Bounds(Numbers=mindex_3.Index)
dedomain_7 = DeconstructDomain(Domain=bnd_7)  # -> Start, End
dedomain_8 = DeconstructDomain(Domain=bnd_8)  # -> Start, End
item_8 = ListItem(List=series_4, Index=dedomain_8.Start, Wrap=True)
item_9 = ListItem(List=series_4, Index=dedomain_7.End, Wrap=True)
dom_2 = ConstructDomain(DomainStart=item_9, DomainEnd=item_8)
subtraction_6 = Subtraction(A=item_8, B=item_9)
division_6 = Division(A=subtraction_6, B=violin_delta_graph_s_vertical_intervals)
range = Range(Domain=dom_2, Steps=division_6)
int_2 = Integer(range)
int_3 = Integer("0")
mindex_5 = MemberIndex(Set=int_2, Member=int_3)  # -> Index, Count
panel_6 = Panel("""1
-1""")
division_7 = Division(A=violin_graph_s_width, B="2")
X_5 = UnitX(Factor=panel_6)
X_6 = UnitX(Factor=labels_offset)

# ---- group: Vertical distance per degree
division_8 = Division(A=graphs_height, B=subtraction_6)  # -> simplify(graft(Result))

# ----
multiplication = Multiplication(A=int_2, B=division_8)
pt_4 = ConstructPoint(XCoordinate=0, YCoordinate=multiplication, ZCoordinate=0)
vec2pt = Vector2Pt(PointA="0,0,0", PointB=pt_4, Unitize=False)  # -> Vector, Length
item_10 = ListItem(List=pt_4, Index=mindex_5.Index, Wrap=True)
line = LineSDL(Start=item_10, Direction=X_5, Length=division_7)
join_2 = JoinCurves(Curves=line, Preserve=False)
move_14 = Move(Geometry=join_2, Motion=vec2pt.Vector)  # -> Geometry, Transform
end_3 = EndPoints(Curve=move_14.Geometry)  # -> Start, End
cull_i = CullIndex(List=move_14.Geometry, Indices=mindex_5.Index, Wrap=True)
move_15 = Move(Geometry=end_3.End, Motion=X_6)  # -> Geometry, Transform
item_11 = ListItem(List=move_15.Geometry, Index=0, Wrap=True)
pdecon_2 = Deconstruct(Point=item_11)  # -> XComponent, YComponent, ZComponent
abs_3 = Absolute(Value=pdecon_2.YComponent)
addition_6 = Addition(A=abs_3, B=graphs_height, C=vertical_distance_graphs)
Y_8 = UnitY(Factor=addition_6)

# ---- group: Vertical positioning
multiplication_2 = Multiplication(A=series, B=division_8)
pt_5 = ConstructPoint(XCoordinate=0, YCoordinate=multiplication_2, ZCoordinate=0)

# ---- group: Y - Labels
move_16 = Move(Geometry=flatten(move_15.Geometry), Motion=Vector(0, 0, 10))  # -> Geometry, Transform
move_17 = Move(Geometry=move_16.Geometry, Motion=X_3)  # -> Geometry, Transform
move_18 = Move(Geometry=move_17.Geometry, Motion=Y_8)  # -> Geometry, Transform
tag_9 = TextTag3D(Location=move_18.Geometry, Text=int_2, Size=labels_size, Colour=labels_colour, Justification=6)

# ---- group: Average actual
avr = Average(Input=xdata_2.values)
multiplication_3 = Multiplication(A=avr, B=division_8)
pt_6 = ConstructPoint(XCoordinate=0, YCoordinate=multiplication_3, ZCoordinate=0)

# ----
fragment = TextFragment(Text=avr, Start="0", Count="4")

# ---- group: Average future
avr_2 = Average(Input=xdata.values)
multiplication_4 = Multiplication(A=avr_2, B=division_8)
pt_7 = ConstructPoint(XCoordinate=0, YCoordinate=multiplication_4, ZCoordinate=0)

# ----
# X axis
panel_7 = Panel("2")
division_9 = Division(A=violin_graph_s_width, B=panel_7)
division_10 = Division(A=item_7, B=violin_graph_s_horizontal_intervals)
neg_3 = Negative(Value=violin_graph_s_horizontal_intervals)
division_11 = Division(A=item_7, B=violin_graph_s_horizontal_intervals)
series_5 = Series(Start=neg_3, Step=neg_3, Count=division_10)
series_6 = Series(Start=violin_graph_s_horizontal_intervals, Step=violin_graph_s_horizontal_intervals, Count=division_11)
item_12 = ListItem(List=multiplication, Index=0, Wrap=True)
Y_9 = UnitY(Factor=1)
pt_8 = ConstructPoint(XCoordinate=0, YCoordinate=item_12, ZCoordinate=0)
line_2 = LineSDL(Start=pt_8, Direction=Y_9, Length=graphs_height)

# ---- group: Width coefficient
division_12 = Division(A=division_9, B=item_7)

# ----
multiplication_5 = Multiplication(A=series_5, B=division_12)
multiplication_6 = Multiplication(A=series_6, B=division_12)
pt_9 = ConstructPoint(XCoordinate=multiplication_6, YCoordinate=item_12, ZCoordinate=0)
pt_10 = ConstructPoint(XCoordinate=multiplication_5, YCoordinate=item_12, ZCoordinate=0)
item_13 = ListItem(List=pt_9, Index="-1", Wrap=True)
line_3 = LineSDL(Start=[pt_9, pt_10], Direction=Y_9, Length=graphs_height)
item_14 = ListItem(List=pt_10, Index="-1", Wrap=True)
ln_2 = Line(StartPoint=item_14, EndPoint=item_13)

# ---- group: Average actual (continued)
vec2pt_2 = Vector2Pt(PointA=pt_8, PointB=pt_6, Unitize=False)  # -> Vector, Length
move_19 = Move(Geometry=item_14, Motion=vec2pt_2.Vector)  # -> Geometry, Transform
ln_3 = Line(StartPoint=pt_6, EndPoint=move_19.Geometry)

# ---- group: Average future (continued)
vec2pt_3 = Vector2Pt(PointA=pt_8, PointB=pt_7, Unitize=False)  # -> Vector, Length
move_20 = Move(Geometry=item_13, Motion=vec2pt_3.Vector)  # -> Geometry, Transform
ln_4 = Line(StartPoint=pt_7, EndPoint=move_20.Geometry)

# ----
# Average lines
panel_8 = Panel("""5
3""")
dash = DashPattern(Curve=[ln_3, ln_4], Pattern=panel_8)  # -> Dashes, Gaps
X_7 = UnitX(Factor=1)

# ---- group: Average lines
move_21 = Move(Geometry=dash.Dashes, Motion=X_7)  # -> Geometry, Transform
panel_9 = Panel("   Average: ")
panel_10 = Panel(" °C")
concat = Concatenate(FragmentA=panel_9, FragmentB=fragment, FragmentC=panel_10)
move_22 = Move(Geometry=move_21.Geometry, Motion=X_3)  # -> Geometry, Transform
move_23 = Move(Geometry=move_22.Geometry, Motion=Y_8)  # -> Geometry, Transform
preview_3 = CustomPreview(Geometry=move_23.Geometry, Material=ColourSwatch(SwatchColor=RGB(255, 0, 0)))

# ---- group: Average tags
fragment_2 = TextFragment(Text=avr_2, Start="0", Count="4")
move_24 = Move(Geometry=move_20.Geometry, Motion=X_7)  # -> Geometry, Transform
concat_2 = Concatenate(FragmentA=panel_9, FragmentB=fragment_2, FragmentC=panel_10)
move_25 = Move(Geometry=move_19.Geometry, Motion=X_7)  # -> Geometry, Transform
move_26 = Move(Geometry=move_25.Geometry, Motion=X_3)  # -> Geometry, Transform
move_27 = Move(Geometry=move_24.Geometry, Motion=X_3)  # -> Geometry, Transform
move_28 = Move(Geometry=move_26.Geometry, Motion=Y_8)  # -> Geometry, Transform
move_29 = Move(Geometry=move_27.Geometry, Motion=Y_8)  # -> Geometry, Transform
tag_10 = TextTag3D(Location=move_28.Geometry, Text=concat, Size=labels_size, Colour=labels_colour, Justification=1)
tag_11 = TextTag3D(Location=move_29.Geometry, Text=concat_2, Size=labels_size, Colour=labels_colour, Justification=3)

# ---- group: X - Labels
Y_10 = UnitY(Factor=labels_offset)
merge_5 = Merge(Data1=flatten(series_5), Data2="0", Data3=flatten(series_6))
merge_6 = Merge(Data1=pt_10, Data2=pt_8, Data3=pt_9)
move_30 = Move(Geometry=merge_6, Motion=Y_10)  # -> Geometry, Transform
move_31 = Move(Geometry=flatten(move_30.Geometry), Motion=X_7)  # -> Geometry, Transform
move_32 = Move(Geometry=move_31.Geometry, Motion=X_3)  # -> Geometry, Transform
abs_4 = Absolute(Value=merge_5)
move_33 = Move(Geometry=move_32.Geometry, Motion=Y_8)  # -> Geometry, Transform
tag_12 = TextTag3D(Location=move_33.Geometry, Text=abs_4, Size=labels_size, Colour=labels_colour, Justification=2)

# ---- group: Y - Title
X_8 = UnitX(Factor=number_slider_2)
move_34 = Move(Geometry=item_14, Motion=X_8)  # -> Geometry, Transform
prot = RotatePlane(Plane=move_34.Geometry, Angle=degrees("90"))
move_35 = Move(Geometry=prot, Motion=X_3)  # -> Geometry, Transform
move_36 = Move(Geometry=move_35.Geometry, Motion=Y_8)  # -> Geometry, Transform
tag_13 = TextTag3D(
    Location=move_36.Geometry,
    Text="Temperature (°C)",
    Size=expr("x*1.2", labels_size),
    Colour=labels_colour,
    Justification=7)

# ---- group: Future Bars
division_13 = Division(A=division_8, B="2")
dom_3 = ConstructDomain(DomainStart=expr("-x", division_13), DomainEnd=division_13)
multiplication_7 = Multiplication(A=ma.Result, B=division_12)
rectangle = Rectangle(Plane=flatten(pt_5), XSize=multiplication_7, YSize=dom_3, Radius=0)  # -> Rectangle, Length
drec = DeconstructRectangle(Rectangle=rectangle.Rectangle)  # -> BasePlane, XInterval, YInterval
equals_3 = Equality(FirstNumber=drec.XInterval, SecondNumber="0")  # -> Equality, Inequality
cull = CullPattern(List=rectangle.Rectangle, CullPattern=invert(equals_3.Equality))
mplane = MeshPlane(Boundary=cull, WidthCount="1", HeightCount="1")  # -> Mesh, Area
mcol = MeshColours(Mesh=graft(mplane.Mesh), Colours=graft(createlegend.colors))
move_37 = Move(Geometry=mcol, Motion=X_7)  # -> Geometry, Transform

# ---- group: Delta bars
# Bars
subtraction_7 = Subtraction(A=ma.Result, B=ma_2.Result)
division_14 = Division(A=division_8, B="3")
dom_4 = ConstructDomain(DomainStart=expr("-x", division_14), DomainEnd=division_14)
multiplication_8 = Multiplication(A=subtraction_7, B=division_12)
rectangle_2 = Rectangle(Plane=flatten(pt_5), XSize=multiplication_8, YSize=dom_4, Radius=0)  # -> Rectangle, Length
drec_2 = DeconstructRectangle(Rectangle=rectangle_2.Rectangle)  # -> BasePlane, XInterval, YInterval
equals_4 = Equality(FirstNumber=drec_2.XInterval, SecondNumber="0")  # -> Equality, Inequality
cull_2 = CullPattern(List=rectangle_2.Rectangle, CullPattern=invert(equals_4.Equality))
mplane_2 = MeshPlane(Boundary=cull_2, WidthCount="1", HeightCount="1")  # -> Mesh, Area
mcol_2 = MeshColours(Mesh=graft(mplane_2.Mesh), Colours=graft(violin_delta_bars_colour))
move_38 = Move(Geometry=mcol_2, Motion=X_7)  # -> Geometry, Transform

# ---- group: Actual Bars
neg_4 = Negative(Value=ma_2.Result)
multiplication_9 = Multiplication(A=neg_4, B=division_12)
rectangle_3 = Rectangle(Plane=flatten(pt_5), XSize=multiplication_9, YSize=dom_3, Radius=0)  # -> Rectangle, Length
drec_3 = DeconstructRectangle(Rectangle=rectangle_3.Rectangle)  # -> BasePlane, XInterval, YInterval
equals_5 = Equality(FirstNumber=drec_3.XInterval, SecondNumber="0")  # -> Equality, Inequality
cull_3 = CullPattern(List=rectangle_3.Rectangle, CullPattern=invert(equals_5.Equality))
mplane_3 = MeshPlane(Boundary=cull_3, WidthCount="1", HeightCount="1")  # -> Mesh, Area
mcol_3 = MeshColours(Mesh=graft(mplane_3.Mesh), Colours=graft(createlegend.colors))
move_39 = Move(Geometry=mcol_3, Motion=X_7)  # -> Geometry, Transform

# ---- group: X - Title
Y_11 = UnitY(Factor=number_slider_2)
move_40 = Move(Geometry=item_14, Motion=Y_11)  # -> Geometry, Transform
move_41 = Move(Geometry=move_40.Geometry, Motion=X_3)  # -> Geometry, Transform
move_42 = Move(Geometry=move_41.Geometry, Motion=Y_8)  # -> Geometry, Transform
tag_14 = TextTag3D(Location=move_42.Geometry, Text="Hours", Size=expr("x*1.2", labels_size), Colour=labels_colour, Justification=1)

# ---- group: Violin lines
move_43 = Move(Geometry=flatten([line_3, cull_i]), Motion=X_7)  # -> Geometry, Transform
move_44 = Move(Geometry=move_43.Geometry, Motion=X_3)  # -> Geometry, Transform
move_45 = Move(Geometry=move_44.Geometry, Motion=Y_8)  # -> Geometry, Transform
preview_4 = CustomPreview(Geometry=move_45.Geometry, Material=lines_colour)

# ---- group: Violin main lines
move_46 = Move(Geometry=flatten([ln_2, line_2, join_2]), Motion=X_7)  # -> Geometry, Transform
move_47 = Move(Geometry=move_46.Geometry, Motion=X_3)  # -> Geometry, Transform
move_48 = Move(Geometry=move_47.Geometry, Motion=Y_8)  # -> Geometry, Transform
preview_5 = CustomPreview(Geometry=move_48.Geometry, Material=lines_colour)

# ----
# Legend
panel_11 = Panel("95")
item_15 = ListItem(List=move_46.Geometry, Index=0, Wrap=True)
division_15 = Division(A=panel_11, B="7")
end_4 = EndPoints(Curve=item_15)  # -> Start, End
legendpar_3 = LBLegendParameters(seg_height=division_15, seg_width="6.8")  # -> leg_par; plug-in component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
X_9 = UnitX(Factor="6.8")
move_49 = Move(Geometry=end_4.End, Motion=X_9)  # -> Geometry, Transform
move_50 = Move(Geometry=move_49.Geometry, Motion=X_3)  # -> Geometry, Transform
move_51 = Move(Geometry=move_50.Geometry, Motion=Y_8)  # -> Geometry, Transform
createlegend_2 = LBCreateLegend(values="1", base_plane=move_51.Geometry, title="Δ°C", legend_par=legendpar_3)  # -> mesh, title_obj, label_objs, label_text, colors; plug-in component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
mcol_4 = MeshColours(Mesh=createlegend_2.mesh, Colours=violin_delta_bars_colour)
item_16 = ListItem(List=createlegend_2.title_obj, Index=0, Wrap=True)

# ---- group: Bars
move_52 = Move(Geometry=[move_39.Geometry, move_37.Geometry, move_38.Geometry], Motion=X_3)  # -> Geometry, Transform
move_53 = Move(Geometry=move_52.Geometry, Motion=Y_8)  # -> Geometry, Transform
