# Grasshopper definition future_climate_optimized_overhang.gh (Grasshopper 1.0.8)
# plug-ins: Human, LadybugGrasshopper

# ----
# Settings
text_horizontal_position = Slider(-305, range=-500..200)
graph_lines_thickness = Slider(0.7, range=0..10)
title_vertical_position = Slider(70, range=-200..500)
solar_geometry_size = Slider(0.26, range=0..1)
graph_scale = Slider(9, range=1..10)
text_size = Slider(6.3, range=0..10)
title_size = Slider(7, range=0..10)
sunpath_lines_colour = ColourSwatch(SwatchColor=RGB(204, 204, 204))
labels_colour = ColourSwatch(SwatchColor=RGB(0, 0, 0))
section_hatch = ColourSwatch(SwatchColor=RGB(153, 153, 153))

# ----
# File: future_climate_optimized_overhang.gh
# Additional plugins: Ladybug Tools version 1.8.0, Human
# 1. Insert path to current EPW
current_epw = FilePath("D:\Marcello\Dropbox\PhD Parma\BERKELEY\CLIMA TOOL\PHASE 2\Paper 1\EPWs\Riyadh_King_Khalid-hour_PRESENT.epw")

# ----
# 2. Insert path to future EPW
future_epw = FilePath("D:\Marcello\Dropbox\PhD Parma\BERKELEY\CLIMA TOOL\PHASE 2\Paper 1\EPWs\Riyadh_King_Khalid-hour_2050.epw")

# ----
# 4. Set the window height
window_height_cm = Slider(240, range=0..1000)

# ----
# 5. Turn the toggle into "true" to run the script
falsestart = LBFalseStartToggle(True)

# ----
# 6. Turn the toggle into "true" to visualize the solar geometry
falsestart_2 = LBFalseStartToggle(True)

# ----
# Data colours
swatch = ColourSwatch(SwatchColor=RGB(54, 75, 154))
swatch_2 = ColourSwatch(SwatchColor=RGB(230, 172, 0))
swatch_3 = ColourSwatch(SwatchColor=RGB(74, 123, 183))
swatch_4 = ColourSwatch(SwatchColor=RGB(165, 0, 38))
swatch_5 = ColourSwatch(SwatchColor=RGB(221, 61, 45))

yz = YZPlane(Origin=Point(0, 0, 0))

# ---- group: Window geometry
# Section dimensions
window_thickness = Slider(0.5, range=0..1)
upper_part = Slider(6, range=0..100)
wall_thickness = Slider(3, range=0..100)
lower_part = Slider(-10, range=-100..100)

# ----
# 3- Set the thresholds for weather conditions
actual_dry_bulb_temperature_c = Slider(28, range=20..50)
actual_global_horizontal_radiation_wh_m2 = Slider(900, range=200..1500)

# ----
# Data
number_slider = Slider(12, range=1..12)
analysisperiod = LBAnalysisPeriod(start_hour=number_slider, end_hour=number_slider)  # -> period, hoys, dates; plug-in component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
series = Series(Start=0, Step=1, Count="8760")
dispatch = Dispatch(List=future_epw, DispatchPattern=falsestart)  # -> ListA, ListB
partition = PartitionList(List=series, Size="24")
dispatch_2 = Dispatch(List=current_epw, DispatchPattern=falsestart)  # -> ListA, ListB
importepw = LBImportEPW(epw_file=dispatch.ListA)  # -> location, dry_bulb_temperature, dew_point_temperature, relative_humidity, wind_speed, wind_direction, direct_normal_rad, diffuse_horizontal_rad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; plug-in component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
applyper = LBApplyAnalysisPeriod(data=importepw.dry_bulb_temperature, period=analysisperiod.period)  # -> data; plug-in component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
applyper_2 = LBApplyAnalysisPeriod(data=importepw.global_horizontal_rad, period=analysisperiod.period)  # -> data; plug-in component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
xdata = LBDeconstructData(data=applyper)  # -> header, values; plug-in component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
xdata_2 = LBDeconstructData(data=applyper_2)  # -> header, values; plug-in component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
larger = LargerThan(FirstNumber=xdata.values, SecondNumber=actual_dry_bulb_temperature_c)  # -> LargerThan, OrEqualTo
larger_2 = LargerThan(FirstNumber=xdata_2.values, SecondNumber=actual_global_horizontal_radiation_wh_m2)  # -> LargerThan, OrEqualTo
and = GateAnd(A=larger.OrEqualTo, B=larger_2.OrEqualTo)
number_slider_2 = Slider(0.35, range=0..1)
importepw_2 = LBImportEPW(epw_file=dispatch_2.ListA)  # -> location, dry_bulb_temperature, dew_point_temperature, relative_humidity, wind_speed, wind_direction, direct_normal_rad, diffuse_horizontal_rad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; plug-in component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
applyper_3 = LBApplyAnalysisPeriod(data=importepw_2.dry_bulb_temperature, period=analysisperiod.period)  # -> data; plug-in component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
applyper_4 = LBApplyAnalysisPeriod(data=importepw_2.global_horizontal_rad, period=analysisperiod.period)  # -> data; plug-in component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
xdata_3 = LBDeconstructData(data=applyper_3)  # -> header, values; plug-in component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
xdata_4 = LBDeconstructData(data=applyper_4)  # -> header, values; plug-in component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
larger_3 = LargerThan(FirstNumber=xdata_3.values, SecondNumber=actual_dry_bulb_temperature_c)  # -> LargerThan, OrEqualTo
larger_4 = LargerThan(FirstNumber=xdata_4.values, SecondNumber=actual_global_horizontal_radiation_wh_m2)  # -> LargerThan, OrEqualTo
and_2 = GateAnd(A=larger_3.OrEqualTo, B=larger_4.OrEqualTo)
item = ListItem(List=partition, Index="12", Wrap=True)  # -> flatten(Item)
cull = CullPattern(List=item, CullPattern=and)
cull_2 = CullPattern(List=item, CullPattern=and_2)
multiplication = Multiplication(A=graph_scale, B=number_slider_2)
multiplication_2 = Multiplication(A=graph_scale, B=number_slider_2)
sunpath = LBSunPath(location=importepw.location, hoys=cull_2, scale=multiplication)  # -> report, vectors, altitudes, azimuths, hoys, sun_pts, analemma, daily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; plug-in component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
sunpath_2 = LBSunPath(location=importepw_2.location, hoys=cull, scale=multiplication_2)  # -> report, vectors, altitudes, azimuths, hoys, sun_pts, analemma, daily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; plug-in component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

# ----
# Max thresholds
xdata_5 = LBDeconstructData(data=importepw_2.global_horizontal_rad)  # -> header, values; plug-in component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
xdata_6 = LBDeconstructData(data=importepw_2.dry_bulb_temperature)  # -> header, values; plug-in component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
bnd = Bounds(Numbers=xdata_3.values)
bnd_2 = Bounds(Numbers=xdata_4.values)
dedomain = DeconstructDomain(Domain=bnd_2)  # -> Start, End
dedomain_2 = DeconstructDomain(Domain=bnd)  # -> Start, End
concat = Concatenate(FragmentA="(Max ", FragmentB=dedomain_2.End, FragmentC=" °C)")
concat_2 = Concatenate(FragmentA="(Max ", FragmentB=dedomain.End, FragmentC=" Wh/m2)")

panel = Panel(concat_2)
panel_2 = Panel(concat)

# ---- group: Solar geometry / Diagram
orient = Orient(Geometry=[sunpath_2.analemma, sunpath_2.daily], Source=yz, Target=PlaneXY(0, 0, 0))  # -> Geometry, Transform

# ----
cset = CreateSet(List=sunpath.sun_pts)  # -> Set, Map
cset_2 = CreateSet(List=sunpath_2.sun_pts)  # -> Set, Map
intersection = SetIntersection(SetA=cset.Set, SetB=cset_2.Set)
pdecon = Deconstruct(Point=cset_2.Set)  # -> XComponent, YComponent, ZComponent
pdecon_2 = Deconstruct(Point=cset.Set)  # -> XComponent, YComponent, ZComponent
sort = SortList(Keys=pdecon.ZComponent)  # -> Keys, ValuesA
sort_2 = SortList(Keys=pdecon_2.ZComponent)  # -> Keys, ValuesA
item_2 = ListItem(List=sort.Keys, Index=0, Wrap=True)
item_3 = ListItem(List=sort_2.Keys, Index=0, Wrap=True)
Y = UnitY(Factor=1)
addition = Addition(A=Slider(282, range=0..500), B=window_height_cm)
mindex = MemberIndex(Set=pdecon_2.ZComponent, Member=item_3)  # -> Index, Count
mindex_2 = MemberIndex(Set=pdecon.ZComponent, Member=item_2)  # -> Index, Count
item_4 = ListItem(List=cset.Set, Index=mindex.Index, Wrap=True)
pt = Point(Point(0, 0, 0))
item_5 = ListItem(List=cset_2.Set, Index=mindex_2.Index, Wrap=True)
yz_2 = YZPlane(Origin=Point(0, 0, 0))
ln = Line(StartPoint=pt, EndPoint=item_5)
number_slider_3 = Slider(45, range=0..100)
ln_2 = Line(StartPoint=pt, EndPoint=item_4)
end = EndPoints(Curve=ln)  # -> Start, End
project = Project(Geometry=ln_2, Plane=yz_2)  # -> Geometry, Transform
project_2 = Project(Geometry=ln, Plane=yz_2)  # -> Geometry, Transform
eval = EvaluateCurve(Curve=project_2.Geometry, Parameter="0")  # -> Point, Tangent, Angle
eval_2 = EvaluateCurve(Curve=project.Geometry, Parameter="0")  # -> Point, Tangent, Angle
ext = ExtendCurve(Curve=project.Geometry, Type=0, Start="0", End=number_slider_3)
ext_2 = ExtendCurve(Curve=project_2.Geometry, Type=0, Start="0", End=number_slider_3)
eval_3 = EvaluateCurve(Curve=ext, Parameter="0")  # -> Point, Tangent, Angle
eval_4 = EvaluateCurve(Curve=ext_2, Parameter="0")  # -> Point, Tangent, Angle
Y_2 = UnitY(Factor="-1")
X = UnitX(Factor=1)
X_2 = UnitX(Factor=1)
vrot = Rotate(Vector=eval_3.Tangent, Axis=X, Angle=degrees("90"))
vrot_2 = Rotate(Vector=eval_4.Tangent, Axis=X_2, Angle=degrees("90"))
angle = Angle(VectorA=ext, VectorB=Y_2)  # -> Angle, Reflex
angle_2 = Angle(VectorA=ext_2, VectorB=Y_2)  # -> Angle, Reflex

# ----
# Solar points
future_values_ray = Slider(2, range=0..5)
future_values_ray_2 = Slider(0.8, range=0..5)
xy = XYPlane(Origin=cset_2.Set)
X_3 = UnitX(Factor=1)
xy_2 = XYPlane(Origin=intersection)
X_4 = UnitX(Factor=1)
xy_3 = XYPlane(Origin=cset.Set)
X_5 = UnitX(Factor=1)
padjust = AdjustPlane(Plane=xy, Normal=X_3)
padjust_2 = AdjustPlane(Plane=xy_2, Normal=X_4)
padjust_3 = AdjustPlane(Plane=xy_3, Normal=X_5)
cir = Circle(Plane=padjust_3, Radius=future_values_ray)
cir_2 = Circle(Plane=padjust, Radius=future_values_ray)
cir_3 = Circle(Plane=padjust_2, Radius=future_values_ray_2)

# ---- group: Solar geometry / Cerchi
orient_2 = Orient(Geometry=cir_2, Source=yz, Target=PlaneXY(0, 0, 0))  # -> Geometry, Transform
orient_3 = Orient(Geometry=cir_3, Source=yz, Target=PlaneXY(0, 0, 0))  # -> Geometry, Transform
orient_4 = Orient(Geometry=cir, Source=yz, Target=PlaneXY(0, 0, 0))  # -> Geometry, Transform

# ----
# Legend
panel_3 = Panel("4")
number_slider_4 = Slider(10, range=0..50)
number_slider_5 = Slider(16, range=0..50)
neg = Negative(Value=panel_3)
neg_2 = Negative(Value="4")
number_slider_6 = Slider(140, range=0..1000)
neg_3 = Negative(Value="4")
neg_4 = Negative(Value="4")
neg_5 = Negative(Value="4")
neg_6 = Negative(Value="4")
Z = UnitZ(Factor=number_slider_5)
neg_7 = Negative(Value="4")
neg_8 = Negative(Value="4")
Z_2 = UnitZ(Factor=number_slider_5)
item_6 = ListItem(List=cir, Index=0, Wrap=True)
item_7 = ListItem(List=cir_2, Index=0, Wrap=True)
Z_3 = UnitZ(Factor=number_slider_5)
item_8 = ListItem(List=cir_3, Index=0, Wrap=True)
dom = ConstructDomain(DomainStart=neg_3, DomainEnd="4")
Z_4 = UnitZ(Factor=number_slider_5)
dom_2 = ConstructDomain(DomainStart=neg, DomainEnd=panel_3)
dom_3 = ConstructDomain(DomainStart=neg_2, DomainEnd="4")
dom_4 = ConstructDomain(DomainStart=neg_4, DomainEnd="4")
dom_5 = ConstructDomain(DomainStart=neg_5, DomainEnd="4")
dom_6 = ConstructDomain(DomainStart=neg_6, DomainEnd="4")
dom_7 = ConstructDomain(DomainStart=neg_7, DomainEnd="4")
dom_8 = ConstructDomain(DomainStart=neg_8, DomainEnd="4")
darc = DeconstructArc(Arc=item_6)  # -> BasePlane, Radius, Angle
darc_2 = DeconstructArc(Arc=item_7)  # -> BasePlane, Radius, Angle
darc_3 = DeconstructArc(Arc=item_8)  # -> BasePlane, Radius, Angle
multiplication_3 = Multiplication(A=number_slider_5, B="2")
Y_3 = UnitY(Factor=Slider(16, range=0..100))
deplane = DeconstructPlane(Plane=darc.BasePlane)  # -> Origin, XAxis, YAxis, ZAxis
deplane_2 = DeconstructPlane(Plane=darc_2.BasePlane)  # -> Origin, XAxis, YAxis, ZAxis
pt_2 = ConstructPoint(XCoordinate=0, YCoordinate=number_slider_6, ZCoordinate=multiplication_3)
pt_3 = ConstructPoint(XCoordinate=0, YCoordinate=number_slider_6, ZCoordinate=number_slider_5)
deplane_3 = DeconstructPlane(Plane=darc_3.BasePlane)  # -> Origin, XAxis, YAxis, ZAxis
pt_4 = ConstructPoint(XCoordinate=0, YCoordinate=number_slider_6, ZCoordinate=0)
Y_4 = UnitY(Factor=1)
neg_9 = Negative(Value=Y_4)
Y_5 = UnitY(Factor=1)
neg_10 = Negative(Value=Y_5)
vec2pt = Vector2Pt(PointA=deplane.Origin, PointB=pt_2, Unitize=False)  # -> Vector, Length
vec2pt_2 = Vector2Pt(PointA=deplane_2.Origin, PointB=pt_3, Unitize=False)  # -> Vector, Length
vec2pt_3 = Vector2Pt(PointA=deplane_3.Origin, PointB=pt_4, Unitize=False)  # -> Vector, Length
move = Move(Geometry=item_6, Motion=vec2pt.Vector)  # -> Geometry, Transform
move_2 = Move(Geometry=move.Geometry, Motion=Z_3)  # -> Geometry, Transform
move_3 = Move(Geometry=move_2.Geometry, Motion=Z_2)  # -> Geometry, Transform
move_4 = Move(Geometry=move_3.Geometry, Motion=Z)  # -> Geometry, Transform
darc_4 = DeconstructArc(Arc=move_4.Geometry)  # -> BasePlane, Radius, Angle
move_5 = Move(Geometry=darc_4.BasePlane, Motion=Z_4)  # -> Geometry, Transform
darc_5 = DeconstructArc(Arc=move_3.Geometry)  # -> BasePlane, Radius, Angle
darc_6 = DeconstructArc(Arc=move_2.Geometry)  # -> BasePlane, Radius, Angle
rectangle = Rectangle(Plane=move_5.Geometry, XSize=dom, YSize=dom_2, Radius=0)  # -> Rectangle, Length
rectangle_2 = Rectangle(Plane=darc_4.BasePlane, XSize=dom_4, YSize=dom_3, Radius=0)  # -> Rectangle, Length
mplane = MeshPlane(Boundary=rectangle.Rectangle, WidthCount="1", HeightCount="1")  # -> Mesh, Area
mplane_2 = MeshPlane(Boundary=rectangle_2.Rectangle, WidthCount="1", HeightCount="1")  # -> Mesh, Area
move_6 = Move(Geometry=item_7, Motion=vec2pt_2.Vector)  # -> Geometry, Transform
move_7 = Move(Geometry=item_8, Motion=vec2pt_3.Vector)  # -> Geometry, Transform
Y_6 = UnitY(Factor=number_slider_4)
orient_5 = Orient(Geometry=move_7.Geometry, Source=yz, Target=PlaneXY(0, 0, 0))  # -> Geometry, Transform
orient_6 = Orient(Geometry=move_6.Geometry, Source=yz, Target=PlaneXY(0, 0, 0))  # -> Geometry, Transform
mcol = MeshColours(Mesh=mplane.Mesh, Colours=swatch_5)
mcol_2 = MeshColours(Mesh=mplane_2.Mesh, Colours=swatch_3)
orient_7 = Orient(Geometry=move.Geometry, Source=yz, Target=PlaneXY(0, 0, 0))  # -> Geometry, Transform
Y_7 = UnitY(Factor=number_slider_4)
Y_8 = UnitY(Factor=number_slider_4)
orient_8 = Orient(Geometry=[rectangle_2.Rectangle, rectangle.Rectangle], Source=yz, Target=PlaneXY(0, 0, 0))  # -> Geometry, Transform
move_8 = Move(Geometry=move.Geometry, Motion=Y_6)  # -> Geometry, Transform
move_9 = Move(Geometry=orient_8.Geometry, Motion=Y_3)  # -> Geometry, Transform
Z_5 = UnitZ(Factor=number_slider_5)
move_10 = Move(Geometry=orient_5.Geometry, Motion=Y_3)  # -> Geometry, Transform
move_11 = Move(Geometry=orient_6.Geometry, Motion=Y_3)  # -> Geometry, Transform
previewlw = CustomPreviewLineweights(Geometry=move_11.Geometry, Shader=swatch, Thickness=graph_lines_thickness, Absolute=True)
orient_9 = Orient(Geometry=mcol, Source=yz, Target=PlaneXY(0, 0, 0))  # -> Geometry, Transform
preview = CustomPreview(Geometry=move_10.Geometry, Material=swatch_2)
move_12 = Move(Geometry=move_7.Geometry, Motion=Y_7)  # -> Geometry, Transform
line = LineSDL(Start=darc_5.BasePlane, Direction=[Y_4, neg_9], Length=Slider(8, range=0..10))
move_13 = Move(Geometry=move_6.Geometry, Motion=Y_8)  # -> Geometry, Transform
move_14 = Move(Geometry=orient_7.Geometry, Motion=Y_3)  # -> Geometry, Transform
line_2 = LineSDL(Start=darc_6.BasePlane, Direction=[Y_5, neg_10], Length=Slider(8, range=0..10))
previewlw_2 = CustomPreviewLineweights(Geometry=move_14.Geometry, Shader=swatch_4, Thickness=graph_lines_thickness, Absolute=True)
Z_6 = UnitZ(Factor=number_slider_5)
Z_7 = UnitZ(Factor=number_slider_5)
yz_3 = YZPlane(Origin=move_8.Geometry)
orient_10 = Orient(Geometry=mcol_2, Source=yz, Target=PlaneXY(0, 0, 0))  # -> Geometry, Transform
Z_8 = UnitZ(Factor=number_slider_5)
preview_2 = CustomPreview(Geometry=move_9.Geometry, Material=labels_colour)
yz_4 = YZPlane(Origin=move_12.Geometry)
yz_5 = YZPlane(Origin=move_13.Geometry)
orient_11 = Orient(Geometry=line_2, Source=yz, Target=PlaneXY(0, 0, 0))  # -> Geometry, Transform
mesh = Mesh(orient_9.Geometry)
orient_12 = Orient(Geometry=line, Source=yz, Target=PlaneXY(0, 0, 0))  # -> Geometry, Transform
mesh_2 = Mesh(orient_10.Geometry)
rotate = Rotate(Geometry=move_8.Geometry, Angle=degrees("90"), Plane=yz_3)  # -> Geometry, Transform
darc_7 = DeconstructArc(Arc=rotate.Geometry)  # -> BasePlane, Radius, Angle
move_15 = Move(Geometry=rotate.Geometry, Motion=Z_7)  # -> Geometry, Transform
move_16 = Move(Geometry=move_15.Geometry, Motion=Z_5)  # -> Geometry, Transform
move_17 = Move(Geometry=move_16.Geometry, Motion=Z_6)  # -> Geometry, Transform
move_18 = Move(Geometry=move_17.Geometry, Motion=Z_8)  # -> Geometry, Transform
move_19 = Move(Geometry=mesh, Motion=Y_3)  # -> Geometry, Transform
rotate_2 = Rotate(Geometry=move_12.Geometry, Angle=degrees("90"), Plane=yz_4)  # -> Geometry, Transform
darc_8 = DeconstructArc(Arc=rotate_2.Geometry)  # -> BasePlane, Radius, Angle
orient_13 = Orient(Geometry=darc_8.BasePlane, Source=yz, Target=PlaneXY(0, 0, 0))  # -> Geometry, Transform
move_20 = Move(Geometry=orient_11.Geometry, Motion=Y_3)  # -> Geometry, Transform
rotate_3 = Rotate(Geometry=move_13.Geometry, Angle=degrees("90"), Plane=yz_5)  # -> Geometry, Transform
darc_9 = DeconstructArc(Arc=rotate_3.Geometry)  # -> BasePlane, Radius, Angle
move_21 = Move(Geometry=mesh_2, Motion=Y_3)  # -> Geometry, Transform
orient_14 = Orient(Geometry=move_15.Geometry, Source=yz, Target=PlaneXY(0, 0, 0))  # -> Geometry, Transform
orient_15 = Orient(Geometry=move_16.Geometry, Source=yz, Target=PlaneXY(0, 0, 0))  # -> Geometry, Transform
orient_16 = Orient(Geometry=darc_7.BasePlane, Source=yz, Target=PlaneXY(0, 0, 0))  # -> Geometry, Transform
orient_17 = Orient(Geometry=move_17.Geometry, Source=yz, Target=PlaneXY(0, 0, 0))  # -> Geometry, Transform
move_22 = Move(Geometry=orient_12.Geometry, Motion=Y_3)  # -> Geometry, Transform
orient_18 = Orient(Geometry=move_18.Geometry, Source=yz, Target=PlaneXY(0, 0, 0))  # -> Geometry, Transform
orient_19 = Orient(Geometry=darc_9.BasePlane, Source=yz, Target=PlaneXY(0, 0, 0))  # -> Geometry, Transform
move_23 = Move(Geometry=orient_13.Geometry, Motion=Y_3)  # -> Geometry, Transform
move_24 = Move(Geometry=orient_18.Geometry, Motion=Y_3)  # -> Geometry, Transform
move_25 = Move(Geometry=orient_14.Geometry, Motion=Y_3)  # -> Geometry, Transform
tag = TextTag3D(
    Location=move_24.Geometry,
    Text="Future adapted overhang extension",
    Size=text_size,
    Colour=labels_colour,
    Justification=4)
previewlw_3 = CustomPreviewLineweights(Geometry=move_22.Geometry, Shader=swatch_4, Thickness=graph_lines_thickness, Absolute=True)
move_26 = Move(Geometry=orient_19.Geometry, Motion=Y_3)  # -> Geometry, Transform
previewlw_4 = CustomPreviewLineweights(Geometry=move_20.Geometry, Shader=swatch, Thickness=graph_lines_thickness, Absolute=True)
move_27 = Move(Geometry=orient_16.Geometry, Motion=Y_3)  # -> Geometry, Transform
move_28 = Move(Geometry=orient_17.Geometry, Motion=Y_3)  # -> Geometry, Transform
move_29 = Move(Geometry=orient_15.Geometry, Motion=Y_3)  # -> Geometry, Transform
tag_2 = TextTag3D(
    Location=move_28.Geometry,
    Text="Overhang in current climate condition",
    Size=text_size,
    Colour=labels_colour,
    Justification=4)
tag_3 = TextTag3D(Location=move_29.Geometry, Text="Future solar inclination", Size=text_size, Colour=labels_colour, Justification=4)
tag_4 = TextTag3D(
    Location=move_27.Geometry,
    Text="Only future sun positions at noon",
    Size=text_size,
    Colour=labels_colour,
    Justification=4)
tag_5 = TextTag3D(Location=move_25.Geometry, Text="Current solar inclination", Size=text_size, Colour=labels_colour, Justification=4)
tag_6 = TextTag3D(Location=move_23.Geometry, Text="Shared sun positions at noon", Size=text_size, Colour=labels_colour, Justification=4)
tag_7 = TextTag3D(
    Location=move_26.Geometry,
    Text="Only actual sun positions at noon",
    Size=text_size,
    Colour=labels_colour,
    Justification=4)

orient_20 = Orient(Geometry=ext, Source=yz, Target=PlaneXY(0, 0, 0))  # -> Geometry, Transform

# ----
# Main title
panel_4 = Panel("Future climate optimized south oriented overhang_")
split = TextSplit(Text=importepw_2.location, Separators=",")
item_9 = ListItem(List=split, Index=0, Wrap=True)
concat_3 = Concatenate(FragmentA=panel_4, FragmentB=item_9)

# ----
# File name
number_slider_7 = Slider(-13, range=-15..0)
Y_9 = UnitY(Factor=number_slider_7)

# ---- group: Window geometry
division = Division(A=window_height_cm, B="10")
multiplication_4 = Multiplication(A=upper_part, B=graph_scale)
multiplication_5 = Multiplication(A=division, B=graph_scale)
multiplication_6 = Multiplication(A=lower_part, B=graph_scale)
multiplication_7 = Multiplication(A=wall_thickness, B=graph_scale)
multiplication_8 = Multiplication(A=window_thickness, B=graph_scale)
division_2 = Division(A=multiplication_7, B="3")
pt_5 = ConstructPoint(XCoordinate=0, YCoordinate=0, ZCoordinate=multiplication_5)
xy_4 = XYPlane(Origin=pt_5)
xy_5 = XYPlane(Origin=pt_5)
plx = LinePlane(Line=ext, Plane=xy_4)  # -> Point, ParamL, ParamP
plx_2 = LinePlane(Line=ext_2, Plane=xy_5)  # -> Point, ParamL, ParamP
pdecon_3 = Deconstruct(Point=plx.Point)  # -> XComponent, YComponent, ZComponent
pdecon_4 = Deconstruct(Point=plx_2.Point)  # -> XComponent, YComponent, ZComponent
number_slider_8 = Slider(305, range=1..500)
dist = Distance(PointA=pt_5, PointB=plx_2.Point)  # -> expr("-x", Distance)
dist_2 = Distance(PointA=plx_2.Point, PointB=plx.Point)
yz_6 = YZPlane(Origin=pt_5)
yz_7 = YZPlane(Origin=pt_5)
larger_5 = LargerThan(FirstNumber=pdecon_4.YComponent, SecondNumber=pdecon_3.YComponent)  # -> LargerThan, OrEqualTo
yz_8 = YZPlane(Origin=plx_2.Point)
neg_11 = Negative(Value=dist_2)
rectangle_3 = Rectangle(Plane=yz_2, XSize=multiplication_7, YSize=multiplication_6, Radius=0)  # -> Rectangle, Length
rectangle_4 = Rectangle(Plane=yz_6, XSize=dist, YSize=division_2, Radius=0)  # -> Rectangle, Length
rectangle_5 = Rectangle(Plane=yz_2, XSize=multiplication_7, YSize=multiplication_5, Radius=0)  # -> Rectangle, Length
rectangle_6 = Rectangle(Plane=yz_7, XSize=multiplication_7, YSize=multiplication_4, Radius=0)  # -> Rectangle, Length
neg_12 = Negative(Value=number_slider_8)
filter = StreamFilter(Gate=larger_5.LargerThan, Stream0=dist_2, Stream1=neg_11)
rectangle_7 = Rectangle(Plane=yz_8, XSize=filter, YSize=division_2, Radius=0)  # -> Rectangle, Length
swatch_6 = ColourSwatch(SwatchColor=RGB(178, 178, 178))
mplane_3 = MeshPlane(Boundary=rectangle_4.Rectangle, WidthCount="1", HeightCount="1")  # -> Mesh, Area
mplane_4 = MeshPlane(Boundary=rectangle_7.Rectangle, WidthCount="1", HeightCount="1")  # -> Mesh, Area
explode = Explode(Curve=rectangle_5.Rectangle, Recursive=True)  # -> Segments, Vertices
mplane_5 = MeshPlane(Boundary=rectangle_6.Rectangle, WidthCount="1", HeightCount="1")  # -> Mesh, Area
Y_10 = UnitY(Factor=1)
division_3 = Division(A=division_2, B="2")
orient_21 = Orient(Geometry=mplane_4.Mesh, Source=yz, Target=PlaneXY(0, 0, 0))  # -> Geometry, Transform
orient_22 = Orient(Geometry=mplane_5.Mesh, Source=yz, Target=PlaneXY(0, 0, 0))  # -> Geometry, Transform
orient_23 = Orient(Geometry=mplane_3.Mesh, Source=yz, Target=PlaneXY(0, 0, 0))  # -> Geometry, Transform
addition_2 = Addition(A=division_3, B=Slider(5, range=1..10))
item_10 = ListItem(List=explode.Segments, Index="-1", Wrap=True)
line_3 = LineSDL(Start=pt, Direction=Y_10, Length=[neg_12, number_slider_8])
area = Area(Geometry=rectangle_7.Rectangle)  # -> Area, Centroid
vec = VectorXYZ(XComponent=Slider(400, range=1..400), YComponent=0, ZComponent=addition_2)  # -> Vector, Length
area_2 = Area(Geometry=rectangle_4.Rectangle)  # -> Area, Centroid
offset = OffsetCurve(Curve=item_10, Distance=expr("-x", multiplication_8), Plane=yz_6, Corners=1)
move_30 = Move(Geometry=area.Centroid, Motion=vec.Vector)  # -> Geometry, Transform
move_31 = Move(Geometry=area_2.Centroid, Motion=vec.Vector)  # -> Geometry, Transform
yz_9 = YZPlane(Origin=move_31.Geometry)
yz_10 = YZPlane(Origin=move_30.Geometry)
orient_24 = Orient(Geometry=yz_9, Source=yz, Target=PlaneXY(0, 0, 0))  # -> Geometry, Transform
orient_25 = Orient(Geometry=yz_10, Source=yz, Target=PlaneXY(0, 0, 0))  # -> Geometry, Transform
orient_26 = Orient(
    Geometry=[rectangle_5.Rectangle, rectangle_6.Rectangle, rectangle_7.Rectangle, offset, rectangle_4.Rectangle, line_3],
    Source=yz,
    Target=PlaneXY(0, 0, 0))  # -> Geometry, Transform
mcol_3 = MeshColours(Mesh=orient_23.Geometry, Colours=swatch_3)
mcol_4 = MeshColours(Mesh=orient_21.Geometry, Colours=swatch_5)
mcol_5 = MeshColours(Mesh=orient_22.Geometry, Colours=section_hatch)
preview_3 = CustomPreview(Geometry=orient_26.Geometry, Material=labels_colour)

# ----
line_4 = LineSDL(Start=pt_5, Direction=expr("-x", Y), Length=addition)
Z_9 = UnitZ(Factor=multiplication_4)
move_32 = Move(Geometry=line_4, Motion=Z_9)  # -> Geometry, Transform
project_3 = ProjectPoint(Point=pt, Direction=eval_2.Tangent, Geometry=move_32.Geometry)  # -> Point, Index
project_4 = ProjectPoint(Point=pt, Direction=eval.Tangent, Geometry=move_32.Geometry)  # -> Point, Index
dist_3 = Distance(PointA=end.End, PointB=project_3.Point)
ln_3 = Line(StartPoint=pt, EndPoint=project_3.Point)
ln_4 = Line(StartPoint=pt, EndPoint=project_4.Point)

addition_3 = Addition(A=multiplication_5, B=multiplication_4)
addition_4 = Addition(A=title_vertical_position, B=addition_3)
pt_6 = ConstructPoint(XCoordinate=0, YCoordinate=text_horizontal_position, ZCoordinate=addition_4)
yz_11 = YZPlane(Origin=pt_6)
orient_27 = Orient(Geometry=yz_11, Source=yz, Target=PlaneXY(0, 0, 0))  # -> Geometry, Transform
tag_8 = TextTag3D(Location=orient_27.Geometry, Text=concat_3, Size=title_size, Colour=labels_colour, Justification=7)

move_33 = Move(Geometry=orient_27.Geometry, Motion=Y_9)  # -> Geometry, Transform
tag_9 = TextTag3D(
    Location=move_33.Geometry,
    Text="uture_climate_optimized_overhang.gh",
    Size=text_size,
    Colour=labels_colour,
    Justification=7)

# ----
# Actual angle
end_2 = EndPoints(Curve=ln_4)  # -> Start, End
deg = Degrees(Radians=angle_2.Angle)
unit = UnitVector(Vector=vrot_2)
yz_12 = YZPlane(Origin=end_2.End)
round = Round(Number=deg)  # -> Nearest, Floor, Ceiling
prot = RotatePlane(Plane=yz_12, Angle=expr("-x", angle_2.Angle))
amp = Amplitude(Vector=unit, Amplitude=expr("-x", division_3))
concat_4 = Concatenate(FragmentA=round.Nearest, FragmentB="°")
move_34 = Move(Geometry=prot, Motion=amp)  # -> Geometry, Transform
orient_28 = Orient(Geometry=move_34.Geometry, Source=yz, Target=PlaneXY(0, 0, 0))  # -> Geometry, Transform
tag_10 = TextTag3D(Location=orient_28.Geometry, Text=concat_4, Size=text_size, Colour=labels_colour, Justification=7)

# ----
# Future angle
end_3 = EndPoints(Curve=ln_3)  # -> Start, End
deg_2 = Degrees(Radians=angle.Angle)
unit_2 = UnitVector(Vector=vrot)
yz_13 = YZPlane(Origin=end_3.End)
round_2 = Round(Number=deg_2)  # -> Nearest, Floor, Ceiling
prot_2 = RotatePlane(Plane=yz_13, Angle=expr("-x", angle.Angle))
amp_2 = Amplitude(Vector=unit_2, Amplitude=expr("-x", division_3))
concat_5 = Concatenate(FragmentA=round_2.Nearest, FragmentB="°")
move_35 = Move(Geometry=prot_2, Motion=amp_2)  # -> Geometry, Transform
orient_29 = Orient(Geometry=move_35.Geometry, Source=yz, Target=PlaneXY(0, 0, 0))  # -> Geometry, Transform
tag_11 = TextTag3D(Location=orient_29.Geometry, Text=concat_5, Size=text_size, Colour=labels_colour, Justification=7)

orient_30 = Orient(Geometry=ln_4, Source=yz, Target=PlaneXY(0, 0, 0))  # -> Geometry, Transform

# ----
# Parameters panel
division_4 = Division(A=filter, B=graph_scale)
division_5 = Division(A=dist, B=graph_scale)
multiplication_9 = Multiplication(A=division_4, B="10")
multiplication_10 = Multiplication(A=division_5, B="10")
round_3 = Round(Number=window_height_cm)  # -> Nearest, Floor, Ceiling
round_4 = Round(Number=multiplication_9)  # -> Nearest, Floor, Ceiling
round_5 = Round(Number=multiplication_10)  # -> Nearest, Floor, Ceiling
abs = Absolute(Value=round_3.Nearest)
abs_2 = Absolute(Value=round_5.Nearest)
neg_13 = Negative(Value=round_4.Nearest)
concat_6 = Concatenate(FragmentA="Window height: ", FragmentB=abs, FragmentC=" cm")
concat_7 = Concatenate(FragmentB=abs_2, FragmentC=" cm")
concat_8 = Concatenate(FragmentB=neg_13, FragmentC=" cm")
panel_5 = Panel(""" °C
Global Horizontal Radiation > """)
panel_6 = Panel("""Parameters

Dry bulb temperature > """)
pt_7 = ConstructPoint(XCoordinate=0, YCoordinate=text_horizontal_position, ZCoordinate=Slider(-18, range=-200..200))
yz_14 = YZPlane(Origin=pt_7)
orient_31 = Orient(Geometry=yz_14, Source=yz, Target=PlaneXY(0, 0, 0))  # -> Geometry, Transform

# ---- group: Window geometry (continued)
tag_12 = TextTag3D(Location=orient_24.Geometry, Text=concat_7, Size=text_size, Colour=labels_colour, Justification=8)
tag_13 = TextTag3D(Location=orient_25.Geometry, Text=concat_8, Size=text_size, Colour=labels_colour, Justification=8)

# ---- group: Solar geometry
orient_32 = Orient(Geometry=ln_3, Source=yz, Target=PlaneXY(0, 0, 0))  # -> Geometry, Transform
dispatch_3 = Dispatch(List="Solar geometry", DispatchPattern=falsestart_2)  # -> ListA, ListB
dispatch_4 = Dispatch(List=orient_31.Geometry, DispatchPattern=falsestart_2)  # -> ListA, ListB
previewlw_5 = CustomPreviewLineweights(Geometry=orient_30.Geometry, Shader=swatch, Thickness=graph_lines_thickness, Absolute=True)
previewlw_6 = CustomPreviewLineweights(Geometry=orient_32.Geometry, Shader=swatch_4, Thickness=graph_lines_thickness, Absolute=True)
horizontal_position = Slider(0.75, range=0..1)
vertical_position = Slider(85, range=0..100)
orient_33 = Orient(Geometry=ext_2, Source=yz, Target=PlaneXY(0, 0, 0))  # -> Geometry, Transform
scale = Scale(Geometry=orient.Geometry, Center=Point(0, 0, 0), Factor=solar_geometry_size)  # -> Geometry, Transform
scale_2 = Scale(Geometry=orient_4.Geometry, Center=Point(0, 0, 0), Factor=solar_geometry_size)  # -> Geometry, Transform
scale_3 = Scale(Geometry=orient_2.Geometry, Center=Point(0, 0, 0), Factor=solar_geometry_size)  # -> Geometry, Transform
scale_4 = Scale(Geometry=orient_3.Geometry, Center=Point(0, 0, 0), Factor=solar_geometry_size)  # -> Geometry, Transform
scale_5 = Scale(Geometry=orient_33.Geometry, Center=Point(0, 0, 0), Factor=solar_geometry_size)  # -> Geometry, Transform
scale_6 = Scale(Geometry=orient_20.Geometry, Center=Point(0, 0, 0), Factor=solar_geometry_size)  # -> Geometry, Transform
bbox = BoundingBox(Content=scale.Geometry, Plane=PlaneXY(0, 0, 0))  # -> Box, Box_2
orient_34 = Orient(Geometry=sunpath_2.compass, Source=yz, Target=PlaneXY(0, 0, 0))  # -> Geometry, Transform
multiplication_11 = Multiplication(A=solar_geometry_size, B=horizontal_position)
debox = DeconstructBox(Box=bbox.Box)  # -> Plane, X, Y, Z
scale_7 = Scale(Geometry=orient_34.Geometry, Center=Point(0, 0, 0), Factor=multiplication_11)  # -> Geometry, Transform
num = Number(debox.Y)
num_2 = Number(debox.X)
bnd_3 = Bounds(Numbers=num_2)
bnd_4 = Bounds(Numbers=num)
dedomain_3 = DeconstructDomain(Domain=bnd_3)  # -> Start, End
dedomain_4 = DeconstructDomain(Domain=bnd_4)  # -> Start, End
addition_5 = Addition(A=dedomain_4.End, B=vertical_position)
vec_2 = VectorXYZ(XComponent=dedomain_3.End, YComponent=expr("-x", addition_5), ZComponent=0)  # -> Vector, Length
pdecon_5 = Deconstruct(Point=dispatch_4.ListA)  # -> XComponent, YComponent, ZComponent
pt_8 = Point(dispatch_4.ListA)
move_36 = Move(Geometry=pt_8, Motion=vec_2.Vector)  # -> Geometry, Transform
vec2pt_4 = Vector2Pt(PointA="0,0,0", PointB=move_36.Geometry, Unitize=False)  # -> Vector, Length
move_37 = Move(Geometry=scale_7.Geometry, Motion=vec2pt_4.Vector)  # -> Geometry, Transform
item_11 = ListItem(List=move_37.Geometry, Index="2", Wrap=True)
cpoly = ControlPolygon(Curve=item_11)  # -> Polygon, Points
item_12 = ListItem(List=cpoly.Points, Index=Slider(7, range=0..8), Wrap=True)
pdecon_6 = Deconstruct(Point=item_12)  # -> XComponent, YComponent, ZComponent
subtraction = Subtraction(A=pdecon_5.XComponent, B=pdecon_6.XComponent)
X_6 = UnitX(Factor=subtraction)
move_38 = Move(Geometry=scale.Geometry, Motion=vec2pt_4.Vector)  # -> Geometry, Transform
move_39 = Move(Geometry=scale_2.Geometry, Motion=vec2pt_4.Vector)  # -> Geometry, Transform
move_40 = Move(Geometry=scale_3.Geometry, Motion=vec2pt_4.Vector)  # -> Geometry, Transform
move_41 = Move(Geometry=scale_4.Geometry, Motion=vec2pt_4.Vector)  # -> Geometry, Transform
move_42 = Move(Geometry=scale_5.Geometry, Motion=vec2pt_4.Vector)  # -> Geometry, Transform
move_43 = Move(Geometry=scale_5.Geometry, Motion=vec2pt_4.Vector)  # -> Geometry, Transform
move_44 = Move(Geometry=scale_6.Geometry, Motion=vec2pt_4.Vector)  # -> Geometry, Transform
move_45 = Move(Geometry=scale_7.Geometry, Motion=vec2pt_4.Vector)  # -> Geometry, Transform
item_13 = ListItem(List=move_45.Geometry, Index="2", Wrap=True)
move_46 = Move(Geometry=move_39.Geometry, Motion=X_6)  # -> Geometry, Transform
move_47 = Move(Geometry=move_38.Geometry, Motion=X_6)  # -> Geometry, Transform
move_48 = Move(Geometry=move_40.Geometry, Motion=X_6)  # -> Geometry, Transform
move_49 = Move(Geometry=move_41.Geometry, Motion=X_6)  # -> Geometry, Transform
move_50 = Move(Geometry=move_42.Geometry, Motion=X_6)  # -> Geometry, Transform
move_51 = Move(Geometry=move_43.Geometry, Motion=X_6)  # -> Geometry, Transform
move_52 = Move(Geometry=move_44.Geometry, Motion=X_6)  # -> Geometry, Transform
move_53 = Move(Geometry=item_13, Motion=X_6)  # -> Geometry, Transform
preview_4 = CustomPreview(Geometry=move_53.Geometry, Material=sunpath_lines_colour)
preview_5 = CustomPreview(Geometry=move_49.Geometry, Material=swatch_2)
previewlw_7 = CustomPreviewLineweights(Geometry=move_50.Geometry, Shader=swatch, Thickness=graph_lines_thickness, Absolute=True)
previewlw_8 = CustomPreviewLineweights(Geometry=move_51.Geometry, Shader=swatch, Thickness=graph_lines_thickness, Absolute=True)
previewlw_9 = CustomPreviewLineweights(Geometry=move_48.Geometry, Shader=swatch, Thickness=graph_lines_thickness, Absolute=True)
previewlw_10 = CustomPreviewLineweights(Geometry=move_52.Geometry, Shader=swatch_4, Thickness=graph_lines_thickness, Absolute=True)
preview_6 = CustomPreview(Geometry=move_47.Geometry, Material=sunpath_lines_colour)
previewlw_11 = CustomPreviewLineweights(Geometry=move_46.Geometry, Shader=swatch_4, Thickness=graph_lines_thickness, Absolute=True)

# ----
concat_9 = Concatenate(
    FragmentA=panel_6,
    FragmentE=actual_dry_bulb_temperature_c,
    FragmentC=panel_5,
    FragmentG=actual_global_horizontal_radiation_wh_m2,
    FragmentD=" kw/m2",
    FragmentB=concat_6,
    FragmentH=dispatch_3.ListA)
tag_14 = TextTag3D(Location=orient_31.Geometry, Text=concat_9, Size=text_size, Colour=labels_colour, Justification=7)
