# Grasshopper definition global_horizontal_illuminance_calendar_current_future_delta_and_sky_cover_plot.gh (Grasshopper 1.0.8)

# ----
# Settings
vertical_distance_between_graphs = Slider(60, range=0..100)
delta_graph_s_vertical_intervals = Slider(5, range=1..100)
delta_graph_s_height = Slider(50, range=0..100)
main_graph_s_height = Slider(200, range=0..1000)
graph_s_width = Slider(600, range=0..1000)
main_title_size = Slider(7, range=0..10)
title_position = Slider(20, range=0..40)
sub_title_size = Slider(6.5, range=0.1..10)
labels_offset = Slider(-3, range=-3..0)
labels_size = Slider(5, range=0.1..10)
main_lines_colour = ColourSwatch(SwatchColor=RGB(128, 128, 128))
sub_lines_colour = ColourSwatch(SwatchColor=RGB(178, 178, 178))
labels_colour = ColourSwatch(SwatchColor=RGB(0, 0, 0))

# ----
# Illuminance graphs
vertical_distance_graphs = Slider(30, range=0..100)
small_graphs_width = Slider(285, range=0..1000)
main_graph_width = Slider(600, range=0..1000)
main_graph_height = Slider(200, range=0..1000)

# ----
# File: global_horizontal_illuminance_calendar_current_future_delta_and_sky_cover_plot.gh
# Additional plugin: Ladybug Tools v. 1.8.0
# 1. Insert path to current EPW
current_epw = FilePath("D:\Marcello\Dropbox\PhD Parma\BERKELEY\CLIMA TOOL\PHASE 2\Paper 1\EPWs\Wien-Hohe_Warte-hour_PRESENT.epw")

# ----
# Illuminance colors
swatch = ColourSwatch(SwatchColor=RGB(254, 218, 139))
swatch_2 = ColourSwatch(SwatchColor=RGB(165, 0, 38))
swatch_3 = ColourSwatch(SwatchColor=RGB(54, 75, 154))

# ----
# 2. Insert path to future EPW
future_epw = FilePath("D:\Marcello\Dropbox\PhD Parma\BERKELEY\CLIMA TOOL\PHASE 2\Paper 1\EPWs\Wien-Hohe_Warte-hour_2050.epw")

# ----
# Sky cover colors
colour_swatch = ColourSwatch(SwatchColor=RGB(191, 191, 191))
colour_swatch_2 = ColourSwatch(SwatchColor=RGB(0, 128, 255))
colour_swatch_3 = ColourSwatch(SwatchColor=RGB(102, 102, 102))

number_slider = Slider(17, range=0..20)
panel = Panel("""Jan
Feb
Mar
Apr
May
Jun
Jul
Aug
Sep
Oct
Nov
Dec""")
addition = Addition(A=delta_graph_s_height, B=vertical_distance_between_graphs)
Y = UnitY(Factor=title_position)
addition_2 = Addition(A=vertical_distance_between_graphs, B=main_graph_height)
Y_2 = UnitY(Factor=addition_2)

# ----
# Data
importepw = LBImportEPW(epw_file=current_epw)  # -> location, dry_bulb_temperature, dew_point_temperature, relative_humidity, wind_speed, wind_direction, direct_normal_rad, diffuse_horizontal_rad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; plug-in component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
importepw_2 = LBImportEPW(epw_file=future_epw)  # -> location, dry_bulb_temperature, dew_point_temperature, relative_humidity, wind_speed, wind_direction, direct_normal_rad, diffuse_horizontal_rad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; plug-in component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
xdata = LBDeconstructData(data=importepw.global_horizontal_ill)  # -> header, values; plug-in component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
xdata_2 = LBDeconstructData(data=importepw_2.global_horizontal_ill)  # -> header, values; plug-in component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
subtraction = Subtraction(A=flatten(xdata_2.values), B=flatten(xdata.values))
data = Data(flatten([xdata_2.values, xdata.values]))
bnd = Bounds(Numbers=flatten(data))
bnd_2 = Bounds(Numbers=subtraction)
dedomain = DeconstructDomain(Domain=bnd_2)  # -> Start, End
dedomain_2 = DeconstructDomain(Domain=bnd)  # -> Start, End
abs = Absolute(Value=dedomain.Start)
abs_2 = Absolute(Value=dedomain.End)
addition_3 = Addition(A=main_graph_height, B=vertical_distance_between_graphs)
max = Maximum(A=abs, B=abs_2)
Y_3 = UnitY(Factor=addition_3)
merge = Merge(Data1=swatch_2, Data2=ColourSwatch(SwatchColor=RGB(255, 255, 255)), Data3=swatch_3)  # -> reverse(Result)
merge_2 = Merge(
    Data1=swatch_2,
    Data2=ColourSwatch(SwatchColor=RGB(221, 61, 45)),
    Data3=ColourSwatch(SwatchColor=RGB(246, 126, 75)),
    Data4=ColourSwatch(SwatchColor=RGB(253, 179, 102)),
    Data5=swatch,
    Data6=ColourSwatch(SwatchColor=RGB(234, 236, 204)),
    Data7=ColourSwatch(SwatchColor=RGB(194, 228, 239)),
    Data8=ColourSwatch(SwatchColor=RGB(152, 202, 225)),
    Data9=ColourSwatch(SwatchColor=RGB(110, 166, 205)),
    Data10=ColourSwatch(SwatchColor=RGB(74, 123, 183)),
    Data11=swatch_3)  # -> reverse(Result)
addition_4 = Addition(A=main_graph_width, B="6.8")
round = Round(Number=max)  # -> Nearest, Floor, Ceiling
round_2 = Round(Number=dedomain_2.End)  # -> Nearest, Floor, Ceiling
round_3 = Round(Number=dedomain_2.Start)  # -> Nearest, Floor, Ceiling
neg = Negative(Value=round.Nearest)
xy = XYPlane(Origin=Point(0, 0, 0))
vec = VectorXYZ(XComponent=addition_4, YComponent=addition_3, ZComponent=0)  # -> Vector, Length
entwine = Entwine(Branch00=round_3.Nearest, Branch01=round_3.Nearest, Branch02=neg, FlattenInputs=True)  # -> simplify(Result)
entwine_2 = Entwine(Branch00=round_2.Nearest, Branch01=round_2.Nearest, Branch02=round.Nearest, FlattenInputs=True)  # -> simplify(Result)
entwine_3 = Entwine(Branch00=merge_2, Branch01=merge_2, Branch02=merge, FlattenInputs=True)  # -> simplify(Result)
move = Move(Geometry=xy, Motion=vec.Vector)  # -> Geometry, Transform
entwine_4 = Entwine(Branch00=importepw.global_horizontal_ill, Branch01=importepw_2.global_horizontal_ill, FlattenInputs=True)  # -> simplify(Result)
division = Division(A=main_graph_height, B="24")
division_2 = Division(A=main_graph_width, B="365")
entwine_5 = Entwine(Branch00=move.Geometry, Branch01=move.Geometry, FlattenInputs=True)  # -> simplify(Result)
xdata_3 = LBDeconstructData(data=importepw.global_horizontal_ill)  # -> header, values; plug-in component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
xdata_4 = LBDeconstructData(data=importepw_2.global_horizontal_ill)  # -> header, values; plug-in component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
subtraction_2 = Subtraction(A=xdata_4.values, B=xdata_3.values)
division_3 = Division(A=small_graphs_width, B=main_graph_width)

# ----
# Sky cover
# Sky cover bars
panel_2 = Panel("1")
series = Series(Start=panel_2, Step=1, Count="12")
number_slider_2 = Slider(4, range=0..10)
analysisperiod = LBAnalysisPeriod(start_month=series, start_day=1, start_hour=0, end_month=series)  # -> simplify(period), hoys, dates; plug-in component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
applyper = LBApplyAnalysisPeriod(data=importepw.total_sky_cover, period=analysisperiod.period)  # -> data; plug-in component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
addition_5 = Addition(A=number_slider, B=number_slider, C=number_slider_2)
xdata_5 = LBDeconstructData(data=applyper)  # -> header, values; plug-in component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
multiplication = Multiplication(A=addition_5, B="12")
lng = ListLength(List=xdata_5.values)
addition_6 = Addition(A=multiplication, B="8", C="8")
dom = ConstructDomain(DomainStart="0", DomainEnd="2")
dom_2 = ConstructDomain(DomainStart="3", DomainEnd="7")
dom_3 = ConstructDomain(DomainStart="8", DomainEnd="10")
subtraction_3 = Subtraction(A=graph_s_width, B=addition_6)
inc = Includes(Value=xdata_5.values, Domain=dom)  # -> Includes, Deviation
inc_2 = Includes(Value=xdata_5.values, Domain=dom_2)  # -> Includes, Deviation
inc_3 = Includes(Value=xdata_5.values, Domain=dom_3)  # -> Includes, Deviation
division_4 = Division(A=subtraction_3, B="11")
ma = MassAddition(Input=inc_2.Includes)  # -> Result, PartialResults
ma_2 = MassAddition(Input=inc_3.Includes)  # -> Result, PartialResults
ma_3 = MassAddition(Input=inc.Includes)  # -> Result, PartialResults
division_5 = Division(A=graph_s_width, B="36")
addition_7 = Addition(A=addition_5, B=division_4)
division_6 = Division(A=ma_3.Result, B=lng)
division_7 = Division(A=ma.Result, B=lng)
applyper_2 = LBApplyAnalysisPeriod(data=importepw_2.total_sky_cover, period=analysisperiod.period)  # -> data; plug-in component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
# Sky cover text
division_8 = Division(A=ma_2.Result, B=lng)
multiplication_2 = Multiplication(A=division_6, B=main_graph_s_height)
xdata_6 = LBDeconstructData(data=applyper_2)  # -> header, values; plug-in component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
multiplication_3 = Multiplication(A=division_7, B=main_graph_s_height)
series_2 = Series(Start="8", Step=addition_7, Count="12")  # -> graft(Series)
addition_8 = Addition(A=series_2, B=number_slider, C=number_slider_2)
lng_2 = ListLength(List=xdata_6.values)
pt = ConstructPoint(XCoordinate=series_2, YCoordinate=addition, ZCoordinate=0)
multiplication_4 = Multiplication(A=division_8, B=main_graph_s_height)
rectangle = Rectangle(Plane=pt, XSize=number_slider, YSize=multiplication_2, Radius=0)  # -> Rectangle, Length
inc_4 = Includes(Value=xdata_6.values, Domain=dom)  # -> Includes, Deviation
inc_5 = Includes(Value=xdata_6.values, Domain=dom_2)  # -> Includes, Deviation
inc_6 = Includes(Value=xdata_6.values, Domain=dom_3)  # -> Includes, Deviation
ma_4 = MassAddition(Input=inc_4.Includes)  # -> Result, PartialResults
ma_5 = MassAddition(Input=inc_5.Includes)  # -> Result, PartialResults
ma_6 = MassAddition(Input=inc_6.Includes)  # -> Result, PartialResults
equals = Equality(FirstNumber=multiplication_4, SecondNumber="0")  # -> Equality, Inequality
division_9 = Division(A=ma_4.Result, B=lng_2)
equals_2 = Equality(FirstNumber=multiplication_3, SecondNumber="0")  # -> Equality, Inequality
division_10 = Division(A=ma_5.Result, B=lng_2)
equals_3 = Equality(FirstNumber=multiplication_2, SecondNumber="0")  # -> Equality, Inequality
division_11 = Division(A=ma_6.Result, B=lng_2)
multiplication_5 = Multiplication(A=division_9, B=main_graph_s_height)
pt_2 = ConstructPoint(XCoordinate=addition_8, YCoordinate=addition, ZCoordinate=0)
multiplication_6 = Multiplication(A=division_11, B=main_graph_s_height)
cull = CullPattern(List=rectangle.Rectangle, CullPattern=invert(equals_3.Equality))
Y_4 = UnitY(Factor=multiplication_5)
multiplication_7 = Multiplication(A=division_10, B=main_graph_s_height)
move_2 = Move(Geometry=pt_2, Motion=Y_4)  # -> Geometry, Transform
rectangle_2 = Rectangle(Plane=pt_2, XSize=number_slider, YSize=multiplication_5, Radius=0)  # -> Rectangle, Length
rectangle_3 = Rectangle(Plane=move_2.Geometry, XSize=number_slider, YSize=multiplication_7, Radius=0)  # -> Rectangle, Length
mplane = MeshPlane(Boundary=[rectangle_2.Rectangle, cull], WidthCount="1", HeightCount="1")  # -> Mesh, Area
mcol = MeshColours(Mesh=mplane.Mesh, Colours=colour_swatch_2)

# ----
# X - axis labels
number_slider_3 = Slider(1, range=0..4)
cpoly = ControlPolygon(Curve=rectangle.Rectangle)  # -> Polygon, Points
division_12 = Division(A=number_slider_2, B="2")
item = ListItem(List=cpoly.Points, Index=number_slider_3, Wrap=True)
X = UnitX(Factor=division_12)
move_3 = Move(Geometry=item, Motion=X)  # -> Geometry, Transform
Y_5 = UnitY(Factor=labels_offset)
move_4 = Move(Geometry=move_3.Geometry, Motion=Y_5)  # -> Geometry, Transform
tag = TextTag3D(Location=move_4.Geometry, Text=graft(panel), Size=labels_size, Colour=labels_colour, Justification=2)

Y_6 = UnitY(Factor=multiplication_2)
Y_7 = UnitY(Factor=multiplication_3)
move_5 = Move(Geometry=pt, Motion=Y_6)  # -> Geometry, Transform
move_6 = Move(Geometry=move_5.Geometry, Motion=Y_7)  # -> Geometry, Transform
Y_8 = UnitY(Factor=multiplication_7)
move_7 = Move(Geometry=move_2.Geometry, Motion=Y_8)  # -> Geometry, Transform

rectangle_4 = Rectangle(Plane=move_5.Geometry, XSize=number_slider, YSize=multiplication_3, Radius=0)  # -> Rectangle, Length
rectangle_5 = Rectangle(Plane=move_6.Geometry, XSize=number_slider, YSize=multiplication_4, Radius=0)  # -> Rectangle, Length
cull_2 = CullPattern(List=rectangle_4.Rectangle, CullPattern=invert(equals_2.Equality))
cull_3 = CullPattern(List=rectangle_5.Rectangle, CullPattern=invert(equals.Equality))
rectangle_6 = Rectangle(Plane=move_7.Geometry, XSize=number_slider, YSize=multiplication_6, Radius=0)  # -> Rectangle, Length
mplane_2 = MeshPlane(Boundary=[rectangle_3.Rectangle, cull_2], WidthCount="1", HeightCount="1")  # -> Mesh, Area
mplane_3 = MeshPlane(Boundary=[cull_3, rectangle_6.Rectangle], WidthCount="1", HeightCount="1")  # -> Mesh, Area
mcol_2 = MeshColours(Mesh=mplane_2.Mesh, Colours=colour_swatch)
mcol_3 = MeshColours(Mesh=mplane_3.Mesh, Colours=colour_swatch_3)

# ----
# X - axis upper labels
panel_3 = Panel("2")
division_13 = Division(A=multiplication_4, B=panel_3)
area = Area(Geometry=rectangle_5.Rectangle)  # -> Area, Centroid
Y_9 = UnitY(Factor=division_13)
Y_10 = UnitY(Factor=expr("-x", labels_offset))
move_8 = Move(Geometry=area.Centroid, Motion=Y_9)  # -> Geometry, Transform
move_9 = Move(Geometry=move_8.Geometry, Motion=Y_10)  # -> Geometry, Transform
tag_2 = TextTag3D(Location=move_9.Geometry, Text="Actual", Size=labels_size, Colour=labels_colour, Justification=8)
area_2 = Area(Geometry=rectangle_6.Rectangle)  # -> Area, Centroid
division_14 = Division(A=multiplication_6, B=panel_3)
Y_11 = UnitY(Factor=division_14)
move_10 = Move(Geometry=area_2.Centroid, Motion=Y_11)  # -> Geometry, Transform
move_11 = Move(Geometry=move_10.Geometry, Motion=Y_10)  # -> Geometry, Transform
tag_3 = TextTag3D(Location=move_11.Geometry, Text="Future", Size=labels_size, Colour=labels_colour, Justification=8)

# ----
# Sky cover delta
# Delta graph horizontal lines
panel_4 = Panel("-100")
series_3 = Series(Start=panel_4, Step=delta_graph_s_vertical_intervals, Count="200")
pt_3 = Point(Point(0, 0, 0))
X_2 = UnitX(Factor=1)
Y_12 = UnitY(Factor=expr("-x", vertical_distance_between_graphs))
move_12 = Move(Geometry=pt_3, Motion=Y_12)  # -> Geometry, Transform

# ----
# Delta
Y_13 = UnitY(Factor=vertical_distance_between_graphs)
addition_9 = Addition(
    A=main_graph_s_height,
    B=vertical_distance_between_graphs,
    C=delta_graph_s_height,
    D=vertical_distance_between_graphs,
    E=labels_offset)
Y_14 = UnitY(Factor=addition_9)
equals_4 = Equality(FirstNumber=subtraction_2, SecondNumber="0")  # -> Equality, Inequality

# ----
# Illuminance main title
panel_5 = Panel(",")
split = TextSplit(Text=importepw.location, Separators=panel_5)
item_2 = ListItem(List=split, Index=0, Wrap=True)
merge_3 = Merge(Data1="Global horizontal illuminance", Data2=item_2)  # -> flatten(Result)
Y_15 = UnitY(Factor="70")
join = TextJoin(Text=merge_3, Join="_")

# ----
# Y - axis labels
panel_6 = Panel("10")
division_15 = Division(A=main_graph_s_height, B=panel_6)
X_3 = UnitX(Factor=labels_offset)
dom_4 = ConstructDomain(DomainStart="0", DomainEnd="100")
range = Range(Domain=dom_4, Steps=panel_6)

# ----
# Y- axis title
number_slider_4 = Slider(-10, range=-10..0)

# ----
# File name
panel_7 = Panel("global_horizontal_illuminance_calendar_current_future_delta_and_sky_cover_plot.gh")
Y_16 = UnitY(Factor="-15")

# ----
# Illuminance sub titles
panel_8 = Panel("Actual")
entwine_6 = Entwine(Branch00=panel_8, Branch01="Future", Branch02="Delta", FlattenInputs=True)  # -> simplify(Result)
Y_17 = UnitY(Factor=title_position)
Y_18 = UnitY(Factor="350")

# ----
# Delta bars
subtraction_4 = Subtraction(A=division_10, B=division_7)
subtraction_5 = Subtraction(A=division_11, B=division_8)
subtraction_6 = Subtraction(A=division_9, B=division_6)
multiplication_8 = Multiplication(A=subtraction_5, B="100")
multiplication_9 = Multiplication(A=subtraction_6, B="100")
multiplication_10 = Multiplication(A=subtraction_4, B="100")
division_16 = Division(A=addition_5, B="3")
X_4 = UnitX(Factor=division_16)
X_5 = UnitX(Factor=division_16)

bnd_3 = Bounds(Numbers=flatten([multiplication_9, multiplication_10, multiplication_8]))
dedomain_3 = DeconstructDomain(Domain=bnd_3)  # -> Start, End
smaller = SmallerThan(FirstNumber=dedomain_3.Start, SecondNumber=series_3)  # -> SmallerThan, OrEqualTo
smaller_2 = SmallerThan(FirstNumber=dedomain_3.End, SecondNumber=series_3)  # -> SmallerThan, OrEqualTo
mindex = MemberIndex(Set=smaller.SmallerThan, Member=Toggle(False))  # -> Index, Count
mindex_2 = MemberIndex(Set=smaller_2.OrEqualTo, Member=Toggle(True))  # -> Index, Count
bnd_4 = Bounds(Numbers=flatten(mindex.Index))
bnd_5 = Bounds(Numbers=flatten(mindex_2.Index))
dedomain_4 = DeconstructDomain(Domain=bnd_4)  # -> Start, End
item_3 = ListItem(List=series_3, Index=dedomain_4.End, Wrap=True)
dedomain_5 = DeconstructDomain(Domain=bnd_5)  # -> Start, End
item_4 = ListItem(List=series_3, Index=dedomain_5.Start, Wrap=True)
subtraction_7 = Subtraction(A=item_4, B=item_3)
dom_5 = ConstructDomain(DomainStart=item_3, DomainEnd=item_4)
division_17 = Division(A=delta_graph_s_height, B=subtraction_7)
division_18 = Division(A=subtraction_7, B=delta_graph_s_vertical_intervals)
range_2 = Range(Domain=dom_5, Steps=division_18)
multiplication_11 = Multiplication(A=range_2, B=division_17)
pt_4 = ConstructPoint(XCoordinate=0, YCoordinate=multiplication_11, ZCoordinate=0)
bnd_6 = Bounds(Numbers=flatten(multiplication_11))
dedomain_6 = DeconstructDomain(Domain=bnd_6)  # -> Start, End
mindex_3 = MemberIndex(Set=multiplication_11, Member=[dedomain_6.End, dedomain_6.Start])  # -> Index, Count
mindex_4 = MemberIndex(Set=pt_4, Member=pt_3)  # -> Index, Count
item_5 = ListItem(List=pt_4, Index="-1", Wrap=True)  # -> flatten(Item)
round_4 = Round(Number=range_2)  # -> Nearest, Floor, Ceiling
vec2pt = Vector2Pt(PointA=item_5, PointB=move_12.Geometry, Unitize=False)  # -> Vector, Length

item_6 = ListItem(List=multiplication_11, Index=0, Wrap=True)
pt_5 = ConstructPoint(XCoordinate=0, YCoordinate=item_6, ZCoordinate=0)
vec2pt_2 = Vector2Pt(PointA=pt_5, PointB=pt_3, Unitize=False)  # -> Vector, Length

Y_19 = UnitY(Factor=vec2pt_2.Vector)
move_13 = Move(Geometry=pt_4, Motion=Y_19)  # -> Geometry, Transform
line = LineSDL(Start=move_13.Geometry, Direction=X_2, Length=graph_s_width)
item_7 = ListItem(List=line, Index=[mindex_3.Index, mindex_4.Index], Wrap=True)  # -> flatten(Item)
cull_i = CullIndex(List=line, Indices=flatten([mindex_3.Index, mindex_4.Index]), Wrap=True)
move_14 = Move(Geometry=item_7, Motion=vec2pt.Vector)  # -> Geometry, Transform
preview = CustomPreview(Geometry=cull_i, Material=sub_lines_colour)
preview_2 = CustomPreview(Geometry=item_7, Material=main_lines_colour)

item_8 = ListItem(List=item_7, Index=0, Wrap=True)
end = EndPoints(Curve=item_8)  # -> Start, End

# ----
# Y- axis title
number_slider_5 = Slider(-13, range=-20..0)
item_9 = ListItem(List=move_14.Geometry, Index="2", Wrap=True)
addition_10 = Addition(A=labels_offset, B=number_slider_5)
end_2 = EndPoints(Curve=item_9)  # -> Start, End
X_6 = UnitX(Factor=addition_10)
move_15 = Move(Geometry=end_2.Start, Motion=X_6)  # -> Geometry, Transform
vec2pt_3 = Vector2Pt(PointA=end_2.Start, PointB="0,0,0", Unitize=False)  # -> Vector, Length
prot = RotatePlane(Plane=move_15.Geometry, Angle=degrees("90"))
move_16 = Move(Geometry=prot, Motion=vec2pt_3.Vector)  # -> Geometry, Transform
tag_4 = TextTag3D(Location=move_16.Geometry, Text="Delta (Δ%)", Size=labels_size, Colour=labels_colour, Justification=7)

pt_6 = ConstructPoint(XCoordinate=series_2, YCoordinate=vec2pt_3.Vector, ZCoordinate=0)
move_17 = Move(Geometry=pt_6, Motion=vec2pt.Vector)  # -> Geometry, Transform
move_18 = Move(Geometry=move_17.Geometry, Motion=X_4)  # -> Geometry, Transform
multiplication_12 = Multiplication(A=multiplication_10, B=division_17)
multiplication_13 = Multiplication(A=multiplication_9, B=division_17)
move_19 = Move(Geometry=move_18.Geometry, Motion=X_5)  # -> Geometry, Transform
multiplication_14 = Multiplication(A=multiplication_8, B=division_17)
rectangle_7 = Rectangle(Plane=graft(move_17.Geometry), XSize=division_16, YSize=multiplication_13, Radius=0)  # -> Rectangle, Length
rectangle_8 = Rectangle(Plane=graft(move_18.Geometry), XSize=division_16, YSize=multiplication_12, Radius=0)  # -> Rectangle, Length
rectangle_9 = Rectangle(Plane=graft(move_19.Geometry), XSize=division_16, YSize=multiplication_14, Radius=0)  # -> Rectangle, Length
drec = DeconstructRectangle(Rectangle=rectangle_7.Rectangle)  # -> BasePlane, XInterval, YInterval
drec_2 = DeconstructRectangle(Rectangle=rectangle_9.Rectangle)  # -> BasePlane, XInterval, YInterval
drec_3 = DeconstructRectangle(Rectangle=rectangle_8.Rectangle)  # -> BasePlane, XInterval, YInterval
num = Number(drec.YInterval)
num_2 = Number(drec_2.YInterval)
num_3 = Number(drec_3.YInterval)
equals_5 = Equality(FirstNumber=num, SecondNumber="0")  # -> Equality, Inequality
equals_6 = Equality(FirstNumber=num_2, SecondNumber="0")  # -> Equality, Inequality
equals_7 = Equality(FirstNumber=num_3, SecondNumber="0")  # -> Equality, Inequality
cull_4 = CullPattern(List=rectangle_7.Rectangle, CullPattern=invert(equals_5.Equality))
cull_5 = CullPattern(List=rectangle_9.Rectangle, CullPattern=invert(equals_6.Equality))
cull_6 = CullPattern(List=rectangle_8.Rectangle, CullPattern=invert(equals_7.Equality))
mplane_4 = MeshPlane(Boundary=cull_4, WidthCount="1", HeightCount="1")  # -> Mesh, Area
mplane_5 = MeshPlane(Boundary=cull_6, WidthCount="1", HeightCount="1")  # -> Mesh, Area
mplane_6 = MeshPlane(Boundary=cull_5, WidthCount="1", HeightCount="1")  # -> Mesh, Area
move_20 = Move(Geometry=mplane_6.Mesh, Motion=vec2pt_2.Vector)  # -> Geometry, Transform
move_21 = Move(Geometry=mplane_5.Mesh, Motion=vec2pt_2.Vector)  # -> Geometry, Transform
move_22 = Move(Geometry=mplane_4.Mesh, Motion=vec2pt_2.Vector)  # -> Geometry, Transform
mcol_4 = MeshColours(Mesh=move_22.Geometry, Colours=colour_swatch_2)
mcol_5 = MeshColours(Mesh=move_21.Geometry, Colours=colour_swatch)
mcol_6 = MeshColours(Mesh=move_20.Geometry, Colours=colour_swatch_3)

# ----
# Labels delta
item_10 = ListItem(List=item_7, Index="-1", Wrap=True)
end_3 = EndPoints(Curve=item_10)  # -> Start, End
vec2pt_4 = Vector2Pt(PointA=pt_3, PointB=end_3.Start, Unitize=False)  # -> Vector, Length
Y_20 = UnitY(Factor=labels_offset)
move_23 = Move(Geometry=pt_2, Motion=Y_20)  # -> Geometry, Transform
pdecon = Deconstruct(Point=move_4.Geometry)  # -> XComponent, YComponent, ZComponent
end_4 = EndPoints(Curve=line)  # -> Start, End
X_7 = UnitX(Factor=labels_offset)
pt_7 = ConstructPoint(XCoordinate=pdecon.XComponent, YCoordinate=labels_offset, ZCoordinate=0)
move_24 = Move(Geometry=end_4.Start, Motion=X_7)  # -> Geometry, Transform
tag_5 = TextTag3D(Location=pt_7, Text=graft(panel), Size=labels_size, Colour=labels_colour, Justification=2)
tag_6 = TextTag3D(Location=move_24.Geometry, Text=round_4.Nearest, Size=labels_size, Colour=labels_colour, Justification=6)

# ----
# Title
Y_21 = UnitY(Factor=title_position)
move_25 = Move(Geometry=end.Start, Motion=Y_21)  # -> Geometry, Transform
tag_7 = TextTag3D(Location=move_25.Geometry, Text="Delta", Size=sub_title_size, Colour=labels_colour, Justification=7)

# ----
# Labels and lines
panel_9 = Panel("5")
dom_6 = ConstructDomain(DomainStart="1", DomainEnd="5")
Y_22 = UnitY(Factor=1)
neg_2 = Negative(Value=labels_size)
X_8 = UnitX(Factor=labels_offset)
addition_11 = Addition(A=labels_offset, B=neg_2)

rectangle_10 = Rectangle(Plane=end.Start, XSize=Domain(-1, 1), YSize=division_15, Radius=0)  # -> Rectangle, Length
arrrec = RectangularArray(Geometry=end.Start, Cell=rectangle_10.Rectangle, XCount="1", YCount="11")  # -> Geometry, Transform

# ----
# Sky cover horizontal lines
X_9 = UnitX(Factor=1)
line_2 = LineSDL(Start=arrrec.Geometry, Direction=X_9, Length=graph_s_width)
Y_23 = UnitY(Factor=vertical_distance_between_graphs)
item_11 = ListItem(List=line_2, Index=["0", "-1"], Wrap=True)
cull_i_2 = CullIndex(List=line_2, Indices=["0", "-1"], Wrap=True)
move_26 = Move(Geometry=cull_i_2, Motion=Y_23)  # -> Geometry, Transform
move_27 = Move(Geometry=item_11, Motion=Y_23)  # -> Geometry, Transform
preview_3 = CustomPreview(Geometry=move_26.Geometry, Material=sub_lines_colour)
preview_4 = CustomPreview(Geometry=move_27.Geometry, Material=main_lines_colour)

addition_12 = Addition(A=labels_offset, B=number_slider_5)
X_10 = UnitX(Factor=addition_12)
move_28 = Move(Geometry=end.Start, Motion=X_10)  # -> Geometry, Transform
prot_2 = RotatePlane(Plane=move_28.Geometry, Angle=degrees("90"))
move_29 = Move(Geometry=prot_2, Motion=Vector(0, 0, 10))  # -> Geometry, Transform
move_30 = Move(Geometry=prot_2, Motion=Y_23)  # -> Geometry, Transform
tag_8 = TextTag3D(Location=move_30.Geometry, Text="%", Size=labels_size, Colour=labels_colour, Justification=7)

end_5 = EndPoints(Curve=line_2)  # -> Start, End
move_31 = Move(Geometry=end_5.Start, Motion=Y_23)  # -> Geometry, Transform
move_32 = Move(Geometry=move_31.Geometry, Motion=X_3)  # -> Geometry, Transform
tag_9 = TextTag3D(Location=move_32.Geometry, Text=range, Size=labels_size, Colour=labels_colour, Justification=6)

# ----
# Sky cover legend
end_6 = EndPoints(Curve=item_11)  # -> Start, End
panel_10 = Panel("6.8")
item_12 = ListItem(List=end_6.End, Index=0, Wrap=True)
Y_24 = UnitY(Factor="25")
Y_25 = UnitY(Factor="25")
move_33 = Move(Geometry=item_12, Motion=Y_23)  # -> Geometry, Transform
move_34 = Move(Geometry=move_33.Geometry, Motion=Y_25)  # -> Geometry, Transform
move_35 = Move(Geometry=move_34.Geometry, Motion=Y_25)  # -> Geometry, Transform
join_2 = TextJoin(Text=["0", "2"], Join="÷")
join_3 = TextJoin(Text=["3", "7"], Join="÷")
join_4 = TextJoin(Text=["8", "10"], Join="÷")
rectangle_11 = Rectangle(Plane=move_33.Geometry, XSize="6.8", YSize="25", Radius=0)  # -> Rectangle, Length
rectangle_12 = Rectangle(Plane=move_34.Geometry, XSize="6.8", YSize="25", Radius=0)  # -> Rectangle, Length
rectangle_13 = Rectangle(Plane=move_35.Geometry, XSize="6.8", YSize="25", Radius=0)  # -> Rectangle, Length
X_11 = UnitX(Factor="12.5")
merge_4 = Merge(Data1=join_2, Data2=join_3, Data3=join_4)
X_12 = UnitX(Factor=expr("-x", labels_offset))
move_36 = Move(Geometry=[move_33.Geometry, move_34.Geometry, move_35.Geometry], Motion=X_11)  # -> Geometry, Transform
mplane_7 = MeshPlane(Boundary=rectangle_12.Rectangle, WidthCount="1", HeightCount="1")  # -> Mesh, Area
mplane_8 = MeshPlane(Boundary=rectangle_13.Rectangle, WidthCount="1", HeightCount="1")  # -> Mesh, Area
mplane_9 = MeshPlane(Boundary=rectangle_11.Rectangle, WidthCount="1", HeightCount="1")  # -> Mesh, Area
Y_26 = UnitY(Factor="25")
Y_27 = UnitY(Factor=expr("-x", labels_offset))
move_37 = Move(Geometry=move_35.Geometry, Motion=Y_26)  # -> Geometry, Transform
move_38 = Move(Geometry=move_36.Geometry, Motion=X_12)  # -> Geometry, Transform
move_39 = Move(Geometry=move_37.Geometry, Motion=Y_27)  # -> Geometry, Transform
mcol_7 = MeshColours(Mesh=mplane_9.Mesh, Colours=colour_swatch_3)
mcol_8 = MeshColours(Mesh=mplane_8.Mesh, Colours=colour_swatch_2)
mcol_9 = MeshColours(Mesh=mplane_7.Mesh, Colours=colour_swatch)
tag_10 = TextTag3D(Location=move_38.Geometry, Text=merge_4, Size=labels_size, Colour=labels_colour, Justification=7)
tag_11 = TextTag3D(Location=move_39.Geometry, Text="Tenth", Size=labels_size, Colour=labels_colour, Justification=7)

# ----
# Sky cover title
panel_11 = Panel("Sky cover")
item_13 = ListItem(List=end_6.Start, Index="1", Wrap=True)
merge_5 = Merge(Data1=panel_11, Data2=item_2)  # -> flatten(Result)
item_14 = ListItem(List=move_27.Geometry, Index="1", Wrap=True)
join_5 = TextJoin(Text=merge_5, Join="_")
end_7 = EndPoints(Curve=item_14)  # -> Start, End
move_40 = Move(Geometry=end_7.Start, Motion=Y)  # -> Geometry, Transform
tag_12 = TextTag3D(Location=move_40.Geometry, Text=join_5, Size=main_title_size, Colour=labels_colour, Justification=7)

move_41 = Move(Geometry=end_7.Start, Motion=Y_13)  # -> Geometry, Transform

hourlyplot = LBHourlyPlot(data=importepw.global_horizontal_ill, base_pt=move_41.Geometry, x_dim=division_2, y_dim=division)  # -> report, mesh, legend, borders, labels, title, vis_set; plug-in component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
txt = Text(hourlyplot.labels)
split_2 = SplitList(List=txt, Index=panel_9)  # -> ListA, ListB
eval = EvaluateCurve(Curve=hourlyplot.borders, Parameter="0")  # -> Point, Tangent, Angle
subset = SubList(List=hourlyplot.borders, Domain=dom_6, Wrap=True)  # -> List, Index
mindex_5 = MemberIndex(Set=eval.Tangent, Member=Y_22)  # -> Index, Count
end_8 = EndPoints(Curve=subset.List)  # -> Start, End
item_15 = ListItem(List=hourlyplot.borders, Index=mindex_5.Index, Wrap=True)
end_9 = EndPoints(Curve=item_15)  # -> Start, End
pdecon_2 = Deconstruct(Point=end_9.Start)  # -> XComponent, YComponent, ZComponent
ins = InsertItems(List=pdecon_2.XComponent, Item="0", Indices="0", Wrap=True)
ins_2 = InsertItems(List=pdecon_2.XComponent, Item=main_graph_width, Indices="-1", Wrap=True)
pt_8 = ConstructPoint(XCoordinate=ins, YCoordinate=0, ZCoordinate=0)
pt_9 = ConstructPoint(XCoordinate=ins_2, YCoordinate=0, ZCoordinate=0)
ln = Line(StartPoint=pt_8, EndPoint=pt_9)
midpt = CurveMiddle(Curve=ln)
move_42 = Move(Geometry=end_8.Start, Motion=X_8)  # -> Geometry, Transform
preview_5 = CustomPreview(Geometry=hourlyplot.borders, Material=main_lines_colour)
tag_13 = TextTag3D(Location=move_42.Geometry, Text=split_2.ListA, Size=labels_size, Colour=labels_colour, Justification=6)

item_16 = ListItem(List=hourlyplot.borders, Index=0, Wrap=True)
cpoly_2 = ControlPolygon(Curve=item_16)  # -> Polygon, Points
item_17 = ListItem(List=cpoly_2.Points, Index="3", Wrap=True)
item_18 = ListItem(List=end_8.Start, Index=0, Wrap=True)

# ----
# Actual & Future
# Actual
addition_13 = Addition(
    A=labels_offset,
    B=vertical_distance_between_graphs,
    C=main_graph_height,
    D=vertical_distance_between_graphs,
    E=main_graph_s_height,
    F=vertical_distance_between_graphs,
    G=delta_graph_s_height)
Y_28 = UnitY(Factor=addition_13)
scale = Scale(Geometry=midpt, Center="0,0,0", Factor=division_3)  # -> Geometry, Transform
scale_2 = Scale(Geometry=end_8.Start, Center=move_41.Geometry, Factor=division_3)  # -> Geometry, Transform
scale_3 = Scale(Geometry=hourlyplot.borders, Center=item_18, Factor=division_3)  # -> Geometry, Transform
move_43 = Move(Geometry=scale.Geometry, Motion=Y_28)  # -> Geometry, Transform
move_44 = Move(Geometry=scale_2.Geometry, Motion=Y_2)  # -> Geometry, Transform
move_45 = Move(Geometry=scale_3.Geometry, Motion=Y_3)  # -> Geometry, Transform
tag_14 = TextTag3D(Location=move_43.Geometry, Text=split_2.ListB, Size=labels_size, Colour=labels_colour, Justification=2)
tag_15 = TextTag3D(Location=move_44.Geometry, Text=split_2.ListA, Size=labels_size, Colour=labels_colour, Justification=6)
preview_6 = CustomPreview(Geometry=move_45.Geometry, Material=main_lines_colour)

item_19 = ListItem(List=move_45.Geometry, Index=0, Wrap=True)
drec_4 = DeconstuctRectangle(Rectangle=item_19)  # -> BasePlane, XInterval, YInterval
int = Integer(drec_4.YInterval)
division_19 = Division(A=int, B="7")
legendpar = LBLegendParameters(
    min=entwine,
    max=entwine_2,
    seg_count="7",
    colors=entwine_3,
    continuous_leg=Toggle(True),
    num_decimals="0",
    base_plane=entwine_5,
    seg_height=division_19,
    seg_width="6.8",
    text_height=labels_size)  # -> leg_par; plug-in component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
hourlyplot_2 = LBHourlyPlot(data=entwine_4, base_pt=move_41.Geometry, x_dim=division_2, y_dim=division, legend_par=legendpar)  # -> report, mesh, legend, borders, labels, title, vis_set; plug-in component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
bang = ExplodeTree(Data=hourlyplot_2.mesh)  # -> Branch0, Branch1, Branch2
item_20 = ListItem(List=hourlyplot_2.borders, Index=0, Wrap=True)
bang_2 = ExplodeTree(Data=legendpar)  # -> Branch0, Branch1, Branch2

scale_4 = Scale(Geometry=bang.Branch0, Center=item_18, Factor=division_3)  # -> Geometry, Transform
move_46 = Move(Geometry=scale_4.Geometry, Motion=Y_3)  # -> Geometry, Transform

heatmap = LBSpatialHeatmap(values=subtraction_2, mesh=hourlyplot.mesh, legend_par=bang_2.Branch2, legend_title="Δlux")  # -> mesh, legend, title, colors, legend_par, vis_set; plug-in component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
move_47 = Move(Geometry=midpt, Motion=Y_14)  # -> Geometry, Transform
cullf = CullFaces(Mesh=heatmap.mesh, Pattern=equals_4.Equality)
mesh = Mesh(cullf)
geo = Geometry(heatmap.legend)

tag_16 = TextTag3D(Location=move_47.Geometry, Text=split_2.ListB, Size=labels_size, Colour=labels_colour, Justification=2)

# ----
# Illuminance
item_21 = ListItem(List=move_45.Geometry, Index=0, Wrap=True)
cpoly_3 = ControlPolygon(Curve=item_21)  # -> Polygon, Points
item_22 = ListItem(List=cpoly_3.Points, Index="3", Wrap=True)

move_48 = Move(Geometry=item_22, Motion=Y_15)  # -> Geometry, Transform
tag_17 = TextTag3D(Location=move_48.Geometry, Text=join, Size=main_title_size, Colour=labels_colour, Justification=7)

move_49 = Move(Geometry=move_48.Geometry, Motion=Y_16)  # -> Geometry, Transform
tag_18 = TextTag3D(Location=move_49.Geometry, Text=panel_7, Size="6.3", Colour=labels_colour, Justification=7)

# ----
# Future
panel_12 = Panel("-1")
item_23 = ListItem(List=pt_9, Index=panel_12, Wrap=True)
scale_5 = Scale(Geometry=hourlyplot.borders, Center=item_23, Factor=division_3)  # -> Geometry, Transform
move_50 = Move(Geometry=scale_5.Geometry, Motion=Y_3)  # -> Geometry, Transform
scale_6 = Scale(Geometry=bang.Branch1, Center=item_18, Factor=division_3)  # -> Geometry, Transform
addition_14 = Addition(A=small_graphs_width, B=vertical_distance_graphs)
move_51 = Move(Geometry=scale_6.Geometry, Motion=Y_3)  # -> Geometry, Transform

item_24 = ListItem(List=move_50.Geometry, Index=0, Wrap=True)
cp = ControlPoints(Curve=[item_19, item_24, item_20])  # -> Points, Weights, Knots
item_25 = ListItem(List=cp.Points, Index="3", Wrap=True)  # -> simplify(Item)

X_13 = UnitX(Factor=addition_14)

move_52 = Move(Geometry=item_22, Motion=X_13)  # -> Geometry, Transform

entwine_7 = Entwine(Branch00=item_22, Branch01=move_52.Geometry, Branch02=item_17, FlattenInputs=True)  # -> simplify(Result)
move_53 = Move(Geometry=entwine_7, Motion=Y_17)  # -> simplify(Geometry), Transform
move_54 = Move(Geometry=move_53.Geometry, Motion=Y_18)  # -> Geometry, Transform
tag_19 = TextTag3D(Location=move_53.Geometry, Text=entwine_6, Size=sub_title_size, Colour=labels_colour, Justification=7)

move_55 = Move(Geometry=move_43.Geometry, Motion=X_13)  # -> Geometry, Transform
move_56 = Move(Geometry=move_44.Geometry, Motion=X_13)  # -> Geometry, Transform

move_57 = Move(Geometry=move_45.Geometry, Motion=X_13)  # -> Geometry, Transform
move_58 = Move(Geometry=move_51.Geometry, Motion=X_13)  # -> Geometry, Transform
tag_20 = TextTag3D(Location=move_55.Geometry, Text=split_2.ListB, Size=labels_size, Colour=labels_colour, Justification=2)
preview_7 = CustomPreview(Geometry=move_57.Geometry, Material=main_lines_colour)
tag_21 = TextTag3D(Location=move_56.Geometry, Text=split_2.ListA, Size=labels_size, Colour=labels_colour, Justification=6)

# ----
# Legend
addition_15 = Addition(A=vertical_distance_between_graphs, B=main_graph_height, C=delta_graph_s_height, D=vertical_distance_between_graphs)
partition = PartitionList(List=hourlyplot_2.legend, Size="9")
bang_3 = ExplodeTree(Data=partition)  # -> Branch0, Branch1, Branch2

Y_29 = UnitY(Factor=addition_15)

move_59 = Move(Geometry=bang_3.Branch0, Motion=Y_29)  # -> Geometry, Transform
