# Grasshopper definition global_horizontal_radiation_timeseries_delta_and_hourly_delta_calendar.gh (Grasshopper 1.0.8)
# plug-ins: Human

# ----
# Settings
main_graph_s_vertical_intervals = Slider(20, range=1..20, expression="x*5")
delta_graph_s_vertical_intervals = Slider(5, range=1..100)
delta_graph_s_height = Slider(50, range=0..100)
main_graph_s_height = Slider(200, range=0..1000)
distance_between_graphs = Slider(50, range=0..100)
daily_lines_thickness = Slider(1.7, range=0..2)
actual_values_ray = Slider(0.55, range=0..2)
future_values_ray = Slider(0.7, range=0..2)
graph_s_width = Slider(600, range=0..1000)
lines_thickness = Slider(1, range=0.1..10)
title_position = Slider(16, range=0..40)
main_title_size = Slider(7, range=0.1..10)
labels_offset = Slider(-3, range=-3..0)
labels_size = Slider(5, range=0.1..10)
actual_values_colour = ColourSwatch(SwatchColor=RGB(102, 102, 102))
future_values_colour = ColourSwatch(SwatchColor=RGB(255, 191, 102))
future_line_colour = ColourSwatch(SwatchColor=RGB(255, 149, 0))
actual_line_colour = ColourSwatch(SwatchColor=RGB(0, 0, 0))
main_lines_colour = ColourSwatch(SwatchColor=RGB(128, 128, 128))
delta_line_colour = ColourSwatch(SwatchColor=RGB(255, 0, 0))
sub_lines_colour = ColourSwatch(SwatchColor=RGB(178, 178, 178))
labels_colour = ColourSwatch(SwatchColor=RGB(0, 0, 0))

# ----
# global_horizontal_radiation_timeseries_delta_and_hourly_delta_calendar.gh
# Additional plugins: Ladybug Tools v. 1.8.0, Human
# 1. Insert path to current EPW
current_epw = FilePath("D:\Marcello\Dropbox\PhD Parma\BERKELEY\CLIMA TOOL\PHASE 2\Paper 1\EPWs\Riyadh_King_Khalid-hour_PRESENT.epw")

# ----
# 2. Insert path to future EPW
future_epw = FilePath("D:\Marcello\Dropbox\PhD Parma\BERKELEY\CLIMA TOOL\PHASE 2\Paper 1\EPWs\Riyadh_King_Khalid-hour_2050.epw")

secondary_title_size = Slider(6.5, range=0.1..10)
filename_position = Slider(24, range=0..40)

# ----
# Data
importepw = LBImportEPW(epw_file=future_epw)  # -> location, dry_bulb_temperature, dew_point_temperature, relative_humidity, wind_speed, wind_direction, direct_normal_rad, diffuse_horizontal_rad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; plug-in component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
importepw_2 = LBImportEPW(epw_file=current_epw)  # -> location, dry_bulb_temperature, dew_point_temperature, relative_humidity, wind_speed, wind_direction, direct_normal_rad, diffuse_horizontal_rad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; plug-in component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
xdata = LBDeconstructData(data=importepw.global_horizontal_rad)  # -> header, values; plug-in component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
xdata_2 = LBDeconstructData(data=importepw_2.global_horizontal_rad)  # -> header, values; plug-in component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
subtraction = Subtraction(A=simplify(flatten(xdata.values)), B=simplify(flatten(xdata_2.values)))
data = Data(simplify(flatten([xdata.values, xdata_2.values])))
bnd = Bounds(Numbers=flatten(data))
bnd_2 = Bounds(Numbers=subtraction)
dedomain = DeconstructDomain(Domain=bnd_2)  # -> Start, End
dedomain_2 = DeconstructDomain(Domain=bnd)  # -> Start, End
abs = Absolute(Value=dedomain.Start)
abs_2 = Absolute(Value=dedomain.End)
max = Maximum(A=abs, B=abs_2)

# ----
# Legend parameters heatmap
swatch = ColourSwatch(SwatchColor=RGB(165, 0, 38))
merge = Merge(Data1=swatch, Data2=ColourSwatch(SwatchColor=RGB(255, 255, 255)), Data3=ColourSwatch(SwatchColor=RGB(54, 75, 154)))  # -> reverse(Result)
round = Round(Number=max)  # -> Nearest, Floor, Ceiling
neg = Negative(Value=round.Nearest)
division = Division(A="95", B="7")
legendpar = LBLegendParameters(
    min=neg,
    max=round.Nearest,
    seg_count="7",
    colors=merge,
    continuous_leg=Toggle(True),
    num_decimals="0",
    seg_height=division,
    seg_width="6.8")  # -> leg_par; plug-in component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

Y = UnitY(Factor="360")

# ----
# Horizontal axes
panel = Panel("2000")
series = Series(Start="-1000", Step=delta_graph_s_vertical_intervals, Count=panel)
X = UnitX(Factor=1)
pt = Point(Point(0, 0, 0))
panel_2 = Panel("""0
-1""")
Y_2 = UnitY(Factor=title_position)

# ----
# Actual range
panel_3 = Panel("24")
# Monthly chart
panel_4 = Panel("0")
series_2 = Series(Start=panel_4, Step=1, Count=panel_3)
series_3 = Series(Start=series_2, Step="24", Count="365")  # -> simplify(Series)
panel_5 = Panel("""31
28
31
30
31
30
31
31
30
31
30
31""")
series_4 = Series(Start="0", Step=1, Count="24")  # -> simplify(Series)
series_5 = Series(Start="0", Step=1, Count="288")
dom = ConstructDomain(DomainStart=expr("-x", actual_values_ray), DomainEnd=actual_values_ray)

# ---- group: Horizontal axes
series_6 = Series(Start="-100", Step=main_graph_s_vertical_intervals, Count="2000")
smaller = SmallerThan(FirstNumber=dedomain_2.Start, SecondNumber=series_6)  # -> SmallerThan, OrEqualTo
smaller_2 = SmallerThan(FirstNumber=dedomain_2.End, SecondNumber=series_6)  # -> SmallerThan, OrEqualTo
mindex = MemberIndex(Set=smaller_2.OrEqualTo, Member=Toggle(True))  # -> Index, Count
bnd_3 = Bounds(Numbers=flatten(mindex.Index))
dedomain_3 = DeconstructDomain(Domain=bnd_3)  # -> Start, End
item = ListItem(List=series_6, Index=dedomain_3.Start, Wrap=True)
X_2 = UnitX(Factor=1)
pt_2 = Point(Point(0, 0, 0))
pt_3 = Point(Point(0, 0, 0))
X_3 = UnitX(Factor=labels_offset)

# ----
# Future range
panel_6 = Panel("24")
series_7 = Series(Start="0", Step=1, Count=panel_6)
series_8 = Series(Start=series_7, Step="24", Count="365")  # -> simplify(Series)
panel_7 = Panel("""31
28
31
30
31
30
31
31
30
31
30
31""")
series_9 = Series(Start="0", Step=1, Count="24")  # -> simplify(Series)
series_10 = Series(Start="0", Step=1, Count="288")
dom_2 = ConstructDomain(DomainStart=expr("-x", future_values_ray), DomainEnd=future_values_ray)

# ---- group: Horizontal axes / Negative values
mindex_2 = MemberIndex(Set=smaller.SmallerThan, Member=Toggle(False))  # -> Index, Count

# ----
# Labels and lines
panel_8 = Panel("24")
division_2 = Division(A=graph_s_width, B="365")
division_3 = Division(A="200", B=panel_8)
dom_3 = ConstructDomain(DomainStart="1", DomainEnd="5")
Y_3 = UnitY(Factor=1)
X_4 = UnitX(Factor=labels_offset)
neg_2 = Negative(Value=labels_size)
addition = Addition(B=neg_2)
Y_4 = UnitY(Factor=addition)

# ----
# HEATMAP
hourlyplot = LBHourlyPlot(data=importepw.global_horizontal_rad, x_dim=division_2, y_dim=division_3)  # -> report, mesh, legend, borders, labels, title, vis_set; plug-in component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
Y_5 = UnitY(Factor=Slider(-360, range=-900..0))

txt = Text(hourlyplot.labels)
split = SplitList(List=txt, Index="5")  # -> ListA, ListB
subset = SubList(List=hourlyplot.borders, Domain=dom_3, Wrap=True)  # -> List, Index
eval = EvaluateCurve(Curve=hourlyplot.borders, Parameter="0")  # -> Point, Tangent, Angle
end = EndPoints(Curve=subset.List)  # -> Start, End
mindex_3 = MemberIndex(Set=eval.Tangent, Member=Y_3)  # -> Index, Count
item_2 = ListItem(List=hourlyplot.borders, Index=mindex_3.Index, Wrap=True)
end_2 = EndPoints(Curve=item_2)  # -> Start, End
pdecon = Deconstruct(Point=end_2.Start)  # -> XComponent, YComponent, ZComponent
ins = InsertItems(List=pdecon.XComponent, Item="0", Indices="0", Wrap=True)
ins_2 = InsertItems(List=pdecon.XComponent, Item=graph_s_width, Indices="-1", Wrap=True)
pt_4 = ConstructPoint(XCoordinate=ins, YCoordinate=0, ZCoordinate=0)
pt_5 = ConstructPoint(XCoordinate=ins_2, YCoordinate=0, ZCoordinate=0)
ln = Line(StartPoint=pt_4, EndPoint=pt_5)
midpt = CurveMiddle(Curve=ln)
move = Move(Geometry=end.Start, Motion=X_4)  # -> Geometry, Transform
move_2 = Move(Geometry=midpt, Motion=Y_4)  # -> Geometry, Transform
tag = TextTag3D(Location=move_2.Geometry, Text=split.ListB, Size=labels_size, Colour=labels_colour, Justification=2)
preview = CustomPreview(Geometry=hourlyplot.borders, Material=main_lines_colour)
tag_2 = TextTag3D(Location=move.Geometry, Text=split.ListA, Size=labels_size, Colour=labels_colour, Justification=6)

# ----
# Legend heatmap
panel_9 = Panel("ΔWh/m2")
heatmap = LBSpatialHeatmap(values=subtraction, mesh=hourlyplot.mesh, legend_par=legendpar, legend_title=panel_9)  # -> mesh, legend, title, colors, legend_par, vis_set; plug-in component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
geo = Geometry(heatmap.legend)

# ----
# Mesh heatmap
panel_10 = Panel("0")
equals = Equality(FirstNumber=subtraction, SecondNumber=panel_10)  # -> Equality, Inequality
mesh = Mesh(heatmap.mesh)
cullf = CullFaces(Mesh=mesh, Pattern=equals.Equality)

# ---- group: Horizontal axes (continued)
bnd_4 = Bounds(Numbers=flatten(mindex_2.Index))
dedomain_4 = DeconstructDomain(Domain=bnd_4)  # -> Start, End

# ---- group: Horizontal axes / Negative values (continued)
item_3 = ListItem(List=series_6, Index=dedomain_4.End, Wrap=True)

# ---- group: Horizontal axes (continued)
dom_4 = ConstructDomain(DomainStart=item, DomainEnd=item_3)
subtraction_2 = Subtraction(A=item, B=item_3)
division_4 = Division(A=subtraction_2, B=main_graph_s_vertical_intervals)
range = Range(Domain=dom_4, Steps=division_4)
round_2 = Round(Number=range)  # -> Nearest, Floor, Ceiling

# ---- group: Scale verticals
division_5 = Division(A=main_graph_s_height, B=subtraction_2)

# ----
multiplication = Multiplication(A=xdata.values, B=division_5)
item_4 = ListItem(List=multiplication, Index=series_3, Wrap=True)
partition = PartitionList(List=simplify(item_4), Size=panel_5)  # -> simplify(Chunks)
tstat = TreeStatistics(Tree=partition)  # -> simplify(Paths), Length, Count
partition_2 = PartitionList(List=tstat.Paths, Size=simplify("12"))  # -> simplify(Chunks)
flip = FlipMatrix(Data=partition_2)
item_5 = ListItem(List=flip, Index=series_4, Wrap=True)  # -> flatten(Item)
item_6 = ListItem(List=item_5, Index=series_5, Wrap=True)

# ----
# X values
panel_11 = Panel("288")
division_6 = Division(A=graph_s_width, B=panel_11)
series_11 = Series(Start=0, Step=division_6, Count=panel_11)
tstat_2 = TreeStatistics(Tree=graft(series_11))  # -> Paths, Length, Count
replace = ReplacePaths(Data=graft(series_11), Search=tstat_2.Paths, Replace=item_6)

multiplication_2 = Multiplication(A=xdata_2.values, B=division_5)
item_7 = ListItem(List=multiplication_2, Index=series_8, Wrap=True)
partition_3 = PartitionList(List=simplify(item_7), Size=panel_7)  # -> simplify(Chunks)
tstat_3 = TreeStatistics(Tree=partition_3)  # -> simplify(Paths), Length, Count
partition_4 = PartitionList(List=tstat_3.Paths, Size=simplify("12"))  # -> simplify(Chunks)
flip_2 = FlipMatrix(Data=partition_4)
item_8 = ListItem(List=flip_2, Index=series_9, Wrap=True)  # -> flatten(Item)
item_9 = ListItem(List=item_8, Index=series_10, Wrap=True)
branch = TreeBranch(Tree=partition_3, Path=item_9, MaintainPaths=True)
pt_6 = ConstructPoint(XCoordinate=replace, YCoordinate=branch, ZCoordinate=0)
rectangle = Rectangle(Plane=pt_6, XSize=dom_2, YSize=dom_2, Radius=0)  # -> Rectangle, Length
mplane = MeshPlane(Boundary=rectangle.Rectangle, WidthCount="1", HeightCount="1")  # -> Mesh, Area

# ---- group: Vertical sub axes
path = ConstructPath(Indices="12")
Y_6 = UnitY(Factor=labels_offset)
panel_12 = Panel("""6
12
18""")

# ----
# Legend
number_slider = Slider(5, range=0..5)
X_5 = UnitX(Factor=number_slider)
number_slider_2 = Slider(9, range=0..10)
Y_7 = UnitY(Factor=Slider(10, range=0..10))
X_6 = UnitX(Factor=1)
X_7 = UnitX(Factor=Slider(2, range=1..5))
dom_5 = ConstructDomain(DomainStart=expr("-x", future_values_ray), DomainEnd=future_values_ray)
dom_6 = ConstructDomain(DomainStart=expr("-x", future_values_ray), DomainEnd=future_values_ray)
panel_13 = Panel("""Average actual
Average future
Range actual
Range future""")

# ---- group: Vertical main axes
addition_2 = Addition(A=labels_offset, B=Slider(-16, range=-40..1))
Y_8 = UnitY(Factor="-1")
division_7 = Division(A=graph_s_width, B="12")
X_8 = UnitX(Factor=addition_2)
division_8 = Division(A=division_7, B="2")
X_9 = UnitX(Factor=division_8)
neg_3 = Negative(Value=labels_offset)
panel_14 = Panel("""Jan
Feb
Mar
Apr
May
Jun
Jul
Aug
Sep
Oct
Nov
Dec""")
Y_9 = UnitY(Factor=neg_3)

# ---- group: Vertical sub axes (continued)
division_9 = Division(A=division_7, B="4")
rectangle_2 = Rectangle(Plane=PlaneXY(0, 0, 0), XSize=division_9, YSize=Domain(-2, 2), Radius=0)  # -> Rectangle, Length
X_10 = UnitX(Factor=division_9)

# ---- group: Horizontal axes (continued)
multiplication_3 = Multiplication(A=range, B=division_5)
bnd_5 = Bounds(Numbers=flatten(multiplication_3))
pt_7 = ConstructPoint(XCoordinate=0, YCoordinate=multiplication_3, ZCoordinate=0)
dedomain_5 = DeconstructDomain(Domain=bnd_5)  # -> Start, End
mindex_4 = MemberIndex(Set=multiplication_3, Member=[dedomain_5.Start, dedomain_5.End])  # -> flatten(Index), Count
line = LineSDL(Start=pt_7, Direction=X_2, Length=graph_s_width)
mindex_5 = MemberIndex(Set=pt_7, Member=pt_2)  # -> Index, Count
cull_i = CullIndex(List=line, Indices=flatten([mindex_5.Index, mindex_4.Index]), Wrap=True)
item_10 = ListItem(List=line, Index=[mindex_5.Index, mindex_4.Index], Wrap=True)  # -> flatten(Item)
move_3 = Move(Geometry=pt_7, Motion=X_3)  # -> Geometry, Transform

# ---- group: Vertical main axes (continued)
sort_pt = SortPoints(Points=pt_7)  # -> Points, Indices
bnd_6 = Bounds(Numbers=flatten(sort_pt.Indices))
dedomain_6 = DeconstructDomain(Domain=bnd_6)  # -> Start, End
item_11 = ListItem(List=line, Index=0, Wrap=True)
item_12 = ListItem(List=sort_pt.Points, Index=dedomain_6.Start, Wrap=True)
item_13 = ListItem(List=sort_pt.Points, Index=dedomain_6.End, Wrap=True)
divide = DivideCurve(Curve=item_11, Count="12", Kinks=False)  # -> Points, Tangents, Parameters
dist = Distance(PointA=item_12, PointB=item_13)
line_2 = LineSDL(Start=divide.Points, Direction=Y_8, Length=dist)
move_4 = Move(Geometry=item_12, Motion=X_8)  # -> Geometry, Transform
cull_i_2 = CullIndex(List=divide.Points, Indices="-1", Wrap=True)
prot = RotatePlane(Plane=move_4.Geometry, Angle=degrees("90"))
move_5 = Move(Geometry=cull_i_2, Motion=X_9)  # -> Geometry, Transform
move_6 = Move(Geometry=move_5.Geometry, Motion=Y_9)  # -> Geometry, Transform

# ---- group: Horizontal axes (continued)
vec2pt = Vector2Pt(PointA=item_12, PointB=pt_3, Unitize=False)  # -> Vector, Length
move_7 = Move(Geometry=move_3.Geometry, Motion=vec2pt.Vector)  # -> Geometry, Transform
move_8 = Move(Geometry=move_7.Geometry, Motion=Y)  # -> Geometry, Transform
tag_3 = TextTag3D(Location=move_8.Geometry, Text=round_2.Nearest, Size=labels_size, Colour=labels_colour, Justification=6)

# ---- group: Vertical sub axes (continued)
arrrec = RectangularArray(Geometry=line_2, Cell=rectangle_2.Rectangle, XCount="3", YCount="1")  # -> Geometry, Transform
move_9 = Move(Geometry=arrrec.Geometry, Motion=X_10)  # -> simplify(Geometry), Transform
split_2 = SplitTree(Data=move_9.Geometry, Masks=flatten(path))  # -> Positive, Negative
end_3 = EndPoints(Curve=split_2.Negative)  # -> Start, End
move_10 = Move(Geometry=end_3.End, Motion=Y_6)  # -> Geometry, Transform
move_11 = Move(Geometry=move_10.Geometry, Motion=vec2pt.Vector)  # -> Geometry, Transform
move_12 = Move(Geometry=move_11.Geometry, Motion=Y)  # -> Geometry, Transform
tag_4 = TextTag3D(Location=move_12.Geometry, Text=panel_12, Size=labels_size, Colour=labels_colour, Justification=2)

# ----
# Main title heatmap
Y_10 = UnitY(Factor=title_position)
move_13 = Move(Geometry=item_13, Motion=Y_10)  # -> Geometry, Transform
split_3 = TextSplit(Text=importepw.location, Separators=",")
move_14 = Move(Geometry=move_13.Geometry, Motion=vec2pt.Vector)  # -> Geometry, Transform
item_14 = ListItem(List=split_3, Index=0, Wrap=True)
concat = Concatenate(FragmentA="Hourly Delta_", FragmentB=item_14)
tag_5 = TextTag3D(Location=move_14.Geometry, Text=concat, Size=main_title_size, Colour=labels_colour, Justification=7)

# ---- group: Vertical main axes (continued)
move_15 = Move(Geometry=prot, Motion=vec2pt.Vector)  # -> Geometry, Transform
move_16 = Move(Geometry=move_6.Geometry, Motion=vec2pt.Vector)  # -> Geometry, Transform
move_17 = Move(Geometry=move_15.Geometry, Motion=Y)  # -> Geometry, Transform
move_18 = Move(Geometry=move_16.Geometry, Motion=Y)  # -> Geometry, Transform
tag_6 = TextTag3D(Location=move_18.Geometry, Text=panel_14, Size=labels_size, Colour=labels_colour, Justification=8)
tag_7 = TextTag3D(
    Location=move_17.Geometry,
    Text="Global horizontal radiation (Wh/m2)",
    Size=labels_size,
    Colour=labels_colour,
    Justification=7)

# ----
item_15 = ListItem(List=item_10, Index=0, Wrap=True)
move_19 = Move(Geometry=item_15, Motion=vec2pt.Vector)  # -> Geometry, Transform
end_4 = EndPoints(Curve=flatten(move_19.Geometry))  # -> Start, End
move_20 = Move(Geometry=end_4.End, Motion=X_5)  # -> Geometry, Transform
line_3 = LineSDL(Start=move_20.Geometry, Direction=X_6, Length=number_slider_2)
move_21 = Move(Geometry=line_3, Motion=Y_7)  # -> Geometry, Transform
move_22 = Move(Geometry=move_21.Geometry, Motion=Y_7)  # -> Geometry, Transform
midpt_2 = CurveMiddle(Curve=move_22.Geometry)
end_5 = EndPoints(Curve=[line_3, move_21.Geometry])  # -> Start, End
move_23 = Move(Geometry=midpt_2, Motion=Y_7)  # -> Geometry, Transform
move_24 = Move(Geometry=end_5.End, Motion=X_7)  # -> Geometry, Transform
item_16 = ListItem(List=move_24.Geometry, Index="-1", Wrap=True)
rectangle_3 = Rectangle(Plane=move_23.Geometry, XSize=dom_5, YSize=dom_5, Radius=0)  # -> Rectangle, Length
rectangle_4 = Rectangle(Plane=midpt_2, XSize=dom_6, YSize=dom_6, Radius=0)  # -> Rectangle, Length
move_25 = Move(Geometry=item_16, Motion=Y_7)  # -> Geometry, Transform
mplane_2 = MeshPlane(Boundary=rectangle_3.Rectangle, WidthCount="1", HeightCount="1")  # -> Mesh, Area
mplane_3 = MeshPlane(Boundary=rectangle_4.Rectangle, WidthCount="1", HeightCount="1")  # -> Mesh, Area
move_26 = Move(Geometry=move_25.Geometry, Motion=Y_7)  # -> Geometry, Transform
move_27 = Move(Geometry=mplane_3.Mesh, Motion=Y)  # -> Geometry, Transform
move_28 = Move(Geometry=mplane_2.Mesh, Motion=Y)  # -> Geometry, Transform
move_29 = Move(Geometry=[move_24.Geometry, move_25.Geometry, move_26.Geometry], Motion=Y)  # -> Geometry, Transform
tag_8 = TextTag3D(Location=move_29.Geometry, Text=panel_13, Size=labels_size, Colour=labels_colour, Justification=7)

move_30 = Move(Geometry=line_3, Motion=Y)  # -> Geometry, Transform
move_31 = Move(Geometry=move_21.Geometry, Motion=Y)  # -> Geometry, Transform

pt_8 = ConstructPoint(XCoordinate=replace, YCoordinate=partition, ZCoordinate=0)
rectangle_5 = Rectangle(Plane=pt_8, XSize=dom, YSize=dom, Radius=0)  # -> Rectangle, Length
mplane_4 = MeshPlane(Boundary=rectangle_5.Rectangle, WidthCount="1", HeightCount="1")  # -> Mesh, Area
move_32 = Move(Geometry=mplane_4.Mesh, Motion=vec2pt.Vector)  # -> Geometry, Transform
move_33 = Move(Geometry=move_32.Geometry, Motion=Y)  # -> Geometry, Transform
preview_2 = CustomPreview(Geometry=[move_33.Geometry, move_27.Geometry], Material=actual_values_colour)

# ----
# Actual average
avr = Average(Input=partition)
pt_9 = ConstructPoint(XCoordinate=replace, YCoordinate=avr, ZCoordinate=0)  # -> flatten(Point)
sort_pt_2 = SortPoints(Points=pt_9)  # -> Points, Indices
partition_5 = PartitionList(List=sort_pt_2.Points, Size="24")
pline = PolyLine(Vertices=partition_5, Closed=False)
move_34 = Move(Geometry=pline, Motion=vec2pt.Vector)  # -> Geometry, Transform
move_35 = Move(Geometry=move_34.Geometry, Motion=Y)  # -> Geometry, Transform
previewlw = CustomPreviewLineweights(Geometry=[move_35.Geometry, move_30.Geometry], Shader=actual_line_colour, Thickness=daily_lines_thickness, Absolute=True)

# ----
# Future average
avr_2 = Average(Input=branch)
pt_10 = ConstructPoint(XCoordinate=replace, YCoordinate=avr_2, ZCoordinate=0)  # -> flatten(Point)
sort_pt_3 = SortPoints(Points=pt_10)  # -> Points, Indices
partition_6 = PartitionList(List=sort_pt_3.Points, Size="24")
pline_2 = PolyLine(Vertices=partition_6, Closed=False)
move_36 = Move(Geometry=pline_2, Motion=vec2pt.Vector)  # -> Geometry, Transform
move_37 = Move(Geometry=move_36.Geometry, Motion=Y)  # -> Geometry, Transform
previewlw_2 = CustomPreviewLineweights(Geometry=[move_37.Geometry, move_31.Geometry], Shader=future_line_colour, Thickness=daily_lines_thickness, Absolute=True)

move_38 = Move(Geometry=mplane.Mesh, Motion=vec2pt.Vector)  # -> Geometry, Transform
move_39 = Move(Geometry=move_38.Geometry, Motion=Y)  # -> Geometry, Transform
preview_3 = CustomPreview(Geometry=[move_39.Geometry, move_28.Geometry], Material=future_values_colour)

# ----
# Vertical main axes
panel_15 = Panel("12")
Y_11 = UnitY(Factor="-1")
division_10 = Division(A=graph_s_width, B=panel_15)
division_11 = Division(A=division_10, B="2")
X_11 = UnitX(Factor=division_11)
neg_4 = Negative(Value=labels_offset)
Y_12 = UnitY(Factor=neg_4)
panel_16 = Panel("""Jan
Feb
Mar
Apr
May
Jun
Jul
Aug
Sep
Oct
Nov
Dec""")

# ----
# Vertical sub axes
panel_17 = Panel("4")
division_12 = Division(A=division_10, B=panel_17)
rectangle_6 = Rectangle(Plane=PlaneXY(0, 0, 0), XSize=division_12, YSize=Domain(-2, 2), Radius=0)  # -> Rectangle, Length
X_12 = UnitX(Factor=division_12)
path_2 = ConstructPath(Indices="12")
Y_13 = UnitY(Factor=labels_offset)
panel_18 = Panel("""6
12
18""")

# ---- group: Main title
panel_19 = Panel("Global horizontal radiation_")
Y_14 = UnitY(Factor=title_position)
move_40 = Move(Geometry=item_13, Motion=Y_14)  # -> Geometry, Transform
move_41 = Move(Geometry=move_40.Geometry, Motion=vec2pt.Vector)  # -> Geometry, Transform

# ----
# Framework MAIN
panel_20 = Panel(",")
split_4 = TextSplit(Text=importepw.location, Separators=panel_20)
item_17 = ListItem(List=split_4, Index=0, Wrap=True)
concat_2 = Concatenate(FragmentA=panel_19, FragmentB=item_17)
move_42 = Move(Geometry=move_41.Geometry, Motion=Y)  # -> Geometry, Transform
move_43 = Move(Geometry=[item_10, line_2], Motion=vec2pt.Vector)  # -> Geometry, Transform
move_44 = Move(Geometry=[split_2.Negative, cull_i], Motion=vec2pt.Vector)  # -> Geometry, Transform
move_45 = Move(Geometry=move_44.Geometry, Motion=Y)  # -> Geometry, Transform
move_46 = Move(Geometry=move_43.Geometry, Motion=Y)  # -> Geometry, Transform
preview_4 = CustomPreview(Geometry=move_45.Geometry, Material=sub_lines_colour)
preview_5 = CustomPreview(Geometry=move_46.Geometry, Material=main_lines_colour)

# ---- group: Main title (continued)
tag_9 = TextTag3D(Location=move_42.Geometry, Text=concat_2, Size=main_title_size, Colour=labels_colour, Justification=7)

# ----
# Filename
panel_21 = Panel("global_horizontal_radiation_timeseries_delta_and_hourly_delta_calendar.gh")
Y_15 = UnitY(Factor=filename_position)
move_47 = Move(Geometry=move_42.Geometry, Motion=Y_15)  # -> Geometry, Transform
tag_10 = TextTag3D(Location=move_47.Geometry, Text=panel_21, Size=main_title_size, Colour=labels_colour, Justification=7)

# ----
# Delta
subtraction_3 = Subtraction(A=flatten(avr_2), B=flatten(avr))  # -> graft(Result)

bnd_7 = Bounds(Numbers=flatten(subtraction_3))
dedomain_7 = DeconstructDomain(Domain=bnd_7)  # -> Start, End
smaller_3 = SmallerThan(FirstNumber=dedomain_7.Start, SecondNumber=series)  # -> SmallerThan, OrEqualTo
smaller_4 = SmallerThan(FirstNumber=dedomain_7.End, SecondNumber=series)  # -> SmallerThan, OrEqualTo
mindex_6 = MemberIndex(Set=smaller_3.SmallerThan, Member=Toggle(False))  # -> Index, Count
mindex_7 = MemberIndex(Set=smaller_4.OrEqualTo, Member=Toggle(True))  # -> Index, Count
bnd_8 = Bounds(Numbers=flatten(mindex_7.Index))
bnd_9 = Bounds(Numbers=flatten(mindex_6.Index))
dedomain_8 = DeconstructDomain(Domain=bnd_8)  # -> Start, End
dedomain_9 = DeconstructDomain(Domain=bnd_9)  # -> Start, End
item_18 = ListItem(List=series, Index=dedomain_8.Start, Wrap=True)
item_19 = ListItem(List=series, Index=dedomain_9.End, Wrap=True)
abs_3 = Absolute(Value=item_19)
abs_4 = Absolute(Value=item_18)
addition_3 = Addition(A=abs_4, B=abs_3)
division_13 = Division(A=addition_3, B=delta_graph_s_vertical_intervals)
dom_7 = ConstructDomain(DomainStart=item_18, DomainEnd=item_19)
division_14 = Division(A=delta_graph_s_height, B=addition_3)
range_2 = Range(Domain=dom_7, Steps=division_13)
multiplication_4 = Multiplication(A=range_2, B=division_14)
pt_11 = ConstructPoint(XCoordinate=0, YCoordinate=multiplication_4, ZCoordinate=0)
bnd_10 = Bounds(Numbers=flatten(multiplication_4))
dedomain_10 = DeconstructDomain(Domain=bnd_10)  # -> Start, End
addition_4 = Addition(A=dedomain_10.End, B=distance_between_graphs)
neg_5 = Negative(Value=addition_4)
Y_16 = UnitY(Factor=neg_5)
move_48 = Move(Geometry=pt_11, Motion=Y_16)  # -> Geometry, Transform
item_20 = ListItem(List=move_48.Geometry, Index=0, Wrap=True)
line_4 = LineSDL(Start=move_48.Geometry, Direction=X, Length=graph_s_width)
mindex_8 = MemberIndex(Set=pt_11, Member=pt)  # -> Index, Count
cull_i_3 = CullIndex(List=line_4, Indices=flatten([mindex_8.Index, panel_2]), Wrap=True)
item_21 = ListItem(List=line_4, Index=flatten([mindex_8.Index, panel_2]), Wrap=True)
move_49 = Move(Geometry=item_20, Motion=Y_2)  # -> Geometry, Transform
move_50 = Move(Geometry=move_49.Geometry, Motion=Y)  # -> Geometry, Transform
round_3 = Round(Number=range_2)  # -> Nearest, Floor, Ceiling
tag_11 = TextTag3D(Location=move_50.Geometry, Text="Delta", Size=main_title_size, Colour=labels_colour, Justification=7)

sort_pt_4 = SortPoints(Points=move_48.Geometry)  # -> Points, Indices
bnd_11 = Bounds(Numbers=flatten(sort_pt_4.Indices))
dedomain_11 = DeconstructDomain(Domain=bnd_11)  # -> Start, End
item_22 = ListItem(List=line_4, Index=0, Wrap=True)
item_23 = ListItem(List=sort_pt_4.Points, Index=dedomain_11.Start, Wrap=True)
item_24 = ListItem(List=sort_pt_4.Points, Index=dedomain_11.End, Wrap=True)
divide_2 = DivideCurve(Curve=item_22, Count=panel_15, Kinks=False)  # -> Points, Tangents, Parameters
dist_2 = Distance(PointA=item_23, PointB=item_24)
line_5 = LineSDL(Start=divide_2.Points, Direction=Y_11, Length=dist_2)
move_51 = Move(Geometry=item_23, Motion=X_8)  # -> Geometry, Transform
cull_i_4 = CullIndex(List=divide_2.Points, Indices="-1", Wrap=True)
prot_2 = RotatePlane(Plane=move_51.Geometry, Angle=degrees("90"))
move_52 = Move(Geometry=cull_i_4, Motion=X_11)  # -> Geometry, Transform
move_53 = Move(Geometry=move_52.Geometry, Motion=Y_12)  # -> Geometry, Transform
move_54 = Move(Geometry=prot_2, Motion=Y)  # -> Geometry, Transform
move_55 = Move(Geometry=move_53.Geometry, Motion=Y)  # -> Geometry, Transform
tag_12 = TextTag3D(Location=move_55.Geometry, Text=panel_16, Size=labels_size, Colour=labels_colour, Justification=8)
tag_13 = TextTag3D(Location=move_54.Geometry, Text="Delta GHR (ΔWh/m2)", Size=labels_size, Colour=labels_colour, Justification=7)

arrrec_2 = RectangularArray(Geometry=line_5, Cell=rectangle_6.Rectangle, XCount="3", YCount="1")  # -> Geometry, Transform
move_56 = Move(Geometry=arrrec_2.Geometry, Motion=X_12)  # -> simplify(Geometry), Transform
split_5 = SplitTree(Data=move_56.Geometry, Masks=flatten(path_2))  # -> Positive, Negative
end_6 = EndPoints(Curve=split_5.Negative)  # -> Start, End
move_57 = Move(Geometry=end_6.End, Motion=Y_13)  # -> Geometry, Transform
move_58 = Move(Geometry=move_57.Geometry, Motion=Y)  # -> Geometry, Transform
tag_14 = TextTag3D(Location=move_58.Geometry, Text=panel_18, Size=labels_size, Colour=labels_colour, Justification=2)

item_25 = ListItem(List=line_4, Index="-1", Wrap=True)
end_7 = EndPoints(Curve=flatten(item_25))  # -> Start, End
move_59 = Move(Geometry=end_7.End, Motion=X_5)  # -> Geometry, Transform
line_6 = LineSDL(Start=move_59.Geometry, Direction=X_6, Length=number_slider_2)
move_60 = Move(Geometry=line_6, Motion=Y)  # -> Geometry, Transform
end_8 = EndPoints(Curve=line_6)  # -> Start, End
move_61 = Move(Geometry=end_8.End, Motion=X_7)  # -> Geometry, Transform
move_62 = Move(Geometry=move_61.Geometry, Motion=Y)  # -> Geometry, Transform
tag_15 = TextTag3D(Location=move_62.Geometry, Text="Average delta", Size=labels_size, Colour=labels_colour, Justification=7)

multiplication_5 = Multiplication(A=subtraction_3, B=division_14)
pt_12 = ConstructPoint(XCoordinate=replace, YCoordinate=multiplication_5, ZCoordinate=0)  # -> flatten(Point)
sort_pt_5 = SortPoints(Points=pt_12)  # -> Points, Indices
partition_7 = PartitionList(List=sort_pt_5.Points, Size="24")
pline_3 = PolyLine(Vertices=partition_7, Closed=False)
move_63 = Move(Geometry=pline_3, Motion=Y_16)  # -> Geometry, Transform
move_64 = Move(Geometry=move_63.Geometry, Motion=Y)  # -> Geometry, Transform
previewlw_3 = CustomPreviewLineweights(Geometry=[move_64.Geometry, move_60.Geometry], Shader=delta_line_colour, Thickness=daily_lines_thickness, Absolute=True)

# ----
# Framework DELTA
X_13 = UnitX(Factor=labels_offset)
move_65 = Move(Geometry=move_48.Geometry, Motion=X_13)  # -> Geometry, Transform
move_66 = Move(Geometry=[item_21, line_5], Motion=Y)  # -> Geometry, Transform
move_67 = Move(Geometry=[cull_i_3, split_5.Negative], Motion=Y)  # -> Geometry, Transform
preview_6 = CustomPreview(Geometry=move_67.Geometry, Material=sub_lines_colour)
preview_7 = CustomPreview(Geometry=move_66.Geometry, Material=main_lines_colour)

move_68 = Move(Geometry=move_65.Geometry, Motion=Y)  # -> Geometry, Transform

tag_16 = TextTag3D(Location=move_68.Geometry, Text=round_3.Nearest, Size=labels_size, Colour=labels_colour, Justification=6)
