# Grasshopper definition natural_ventilation_actual_delta_and_monthly_chart.gh (Grasshopper 1.0.8)
# plug-ins: Human, LadybugGrasshopper

# ----
# 3. Set the air temperature range
lower_bound_air_temperature_c = Slider(19, range=10..40)
upper_bound_air_temperature_c = Slider(27, range=10..40)

# ----
# 4. Set the wind speed range
lower_bound_wind_speed_m_s = Slider(1, range=1..10)
upper_bound_wind_speed_m_s = Slider(5, range=1..10)

# ---- group: Insert path to current EPW
# File: natural_ventilation_opportunities.gh
# Additional plugins: Ladybug Tools version 1.8.0, Human
# 1. Insert path to current EPW
current_epw = FilePath("D:\Marcello\Dropbox\PhD Parma\BERKELEY\CLIMA TOOL\EPWs\Berkeley_Actual.epw")

# ----
# 2. Insert path to future EPW
future_epw = FilePath("D:\Marcello\Dropbox\PhD Parma\BERKELEY\CLIMA TOOL\EPWs\Berkeley_2070-8.5.epw")

# ----
# 5. Turn the toggle into "true" to run the script
falsestart = LBFalseStartToggle(True)

# ----
# Settings
monthly_chart_lines_thickness = Slider(0.1, range=0.1..10)
parameter_panels_interline = Slider(-11, range=-15..0)
monthly_chart_bars_width = Slider(5, range=0..10)
graphs_vertical_distance = Slider(50, range=0..200)
vertical_position_titles = Slider(11, range=0..30)
monthly_chart_height = Slider(150, range=0..500)
graphs_width = Slider(600, range=0..700)
labels_offset = Slider(-3, range=-10..0)
labels_size = Slider(5, range=0..10)
titles_size = Slider(7, range=0..10)
monthly_chart_main_line = ColourSwatch(SwatchColor=RGB(0, 0, 0))
heatmaps_lines_colours = ColourSwatch(SwatchColor=RGB(0, 0, 0))
monthly_chart_lines = ColourSwatch(SwatchColor=RGB(102, 102, 102))
labels_colour = ColourSwatch(SwatchColor=RGB(3, 3, 3))

# ----
# Monthly chart colour
monthly_actual_colour = ColourSwatch(SwatchColor=RGB(74, 123, 183))
monthly_future_colour = ColourSwatch(SwatchColor=RGB(221, 61, 45))
monthly_delta_colour = ColourSwatch(SwatchColor=RGB(128, 128, 128))

# ----
# Actual - delta colours
swatch = ColourSwatch(SwatchColor=RGB(246, 126, 75))
swatch_2 = ColourSwatch(SwatchColor=RGB(255, 255, 255))
swatch_3 = ColourSwatch(SwatchColor=RGB(74, 123, 183))
swatch_4 = ColourSwatch(SwatchColor=RGB(178, 178, 178))

# ----
# Data
panel = Panel("12")
dispatch = Dispatch(List=current_epw, DispatchPattern=falsestart)  # -> ListA, ListB
dispatch_2 = Dispatch(List=future_epw, DispatchPattern=falsestart)  # -> ListA, ListB
series = Series(Start="1", Step=1, Count=panel)  # -> graft(Series)
importepw = LBImportEPW(epw_file=dispatch.ListA)  # -> location, dry_bulb_temperature, dew_point_temperature, relative_humidity, wind_speed, wind_direction, direct_normal_rad, diffuse_horizontal_rad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; plug-in component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
importepw_2 = LBImportEPW(epw_file=dispatch_2.ListA)  # -> location, dry_bulb_temperature, dew_point_temperature, relative_humidity, wind_speed, wind_direction, direct_normal_rad, diffuse_horizontal_rad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; plug-in component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
analysisperiod = LBAnalysisPeriod(start_month=series, start_day=1, start_hour=0, end_month=series)  # -> simplify(period), hoys, dates; plug-in component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
applyper = LBApplyAnalysisPeriod(data=importepw.dry_bulb_temperature, period=analysisperiod.period)  # -> data; plug-in component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
applyper_2 = LBApplyAnalysisPeriod(data=importepw.wind_speed, period=analysisperiod.period)  # -> data; plug-in component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
applyper_3 = LBApplyAnalysisPeriod(data=importepw_2.dry_bulb_temperature, period=analysisperiod.period)  # -> data; plug-in component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
applyper_4 = LBApplyAnalysisPeriod(data=importepw_2.wind_speed, period=analysisperiod.period)  # -> data; plug-in component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
xdata = LBDeconstructData(data=applyper)  # -> header, values; plug-in component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
xdata_2 = LBDeconstructData(data=applyper_2)  # -> header, values; plug-in component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
xdata_3 = LBDeconstructData(data=applyper_3)  # -> header, values; plug-in component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
xdata_4 = LBDeconstructData(data=applyper_4)  # -> header, values; plug-in component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
larger = LargerThan(FirstNumber=xdata.values, SecondNumber=lower_bound_air_temperature_c)  # -> LargerThan, OrEqualTo
smaller = SmallerThan(FirstNumber=xdata.values, SecondNumber=upper_bound_air_temperature_c)  # -> SmallerThan, OrEqualTo
larger_2 = LargerThan(FirstNumber=xdata_2.values, SecondNumber=lower_bound_wind_speed_m_s)  # -> LargerThan, OrEqualTo
smaller_2 = SmallerThan(FirstNumber=xdata_2.values, SecondNumber=upper_bound_wind_speed_m_s)  # -> SmallerThan, OrEqualTo
larger_3 = LargerThan(FirstNumber=xdata_3.values, SecondNumber=lower_bound_air_temperature_c)  # -> LargerThan, OrEqualTo
smaller_3 = SmallerThan(FirstNumber=xdata_3.values, SecondNumber=upper_bound_air_temperature_c)  # -> SmallerThan, OrEqualTo
larger_4 = LargerThan(FirstNumber=xdata_4.values, SecondNumber=lower_bound_wind_speed_m_s)  # -> LargerThan, OrEqualTo
smaller_4 = SmallerThan(FirstNumber=xdata_4.values, SecondNumber=upper_bound_wind_speed_m_s)  # -> SmallerThan, OrEqualTo
and = GateAnd(A=larger.OrEqualTo, B=smaller.OrEqualTo)
and_2 = GateAnd(A=larger_2.OrEqualTo, B=smaller_2.OrEqualTo)
and_3 = GateAnd(A=larger_3.OrEqualTo, B=smaller_3.OrEqualTo)
and_4 = GateAnd(A=larger_4.OrEqualTo, B=smaller_4.OrEqualTo)
and_5 = GateAnd(A=and, B=and_2)
and_6 = GateAnd(A=and_3, B=and_4)
ma = MassAddition(Input=and_5)  # -> simplify(Result), PartialResults
ma_2 = MassAddition(Input=and_6)  # -> simplify(Result), PartialResults
merge = Merge(Data1=importepw.dry_bulb_temperature, Data2=importepw.wind_speed)
merge_2 = Merge(Data1=importepw_2.dry_bulb_temperature, Data2=importepw_2.wind_speed)
concat = Concatenate(
    FragmentA=lower_bound_air_temperature_c,
    FragmentB="<a<",
    FragmentC=upper_bound_air_temperature_c,
    FragmentD=" and ",
    FragmentE=lower_bound_wind_speed_m_s,
    FragmentF="<b<",
    FragmentG=upper_bound_wind_speed_m_s)
concat_2 = Concatenate(
    FragmentA=lower_bound_air_temperature_c,
    FragmentB="<a<",
    FragmentC=upper_bound_air_temperature_c,
    FragmentD=" and ",
    FragmentE=lower_bound_wind_speed_m_s,
    FragmentF="<b<",
    FragmentG=upper_bound_wind_speed_m_s)
hourlyplot = LBHourlyPlot(data=merge_2, statement=concat)  # -> report, mesh, legend, borders, labels, title, vis_set; plug-in component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
hourlyplot_2 = LBHourlyPlot(data=merge, statement=concat_2)  # -> report, mesh, legend, borders, labels, title, vis_set; plug-in component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
hourlyplot_3 = LBHourlyPlot(data=importepw.dry_bulb_temperature)  # -> report, mesh, legend, borders, labels, title, vis_set; plug-in component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
bang = ExplodeTree(Data=graft(hourlyplot.mesh))  # -> Branch0, Branch1
bang_2 = ExplodeTree(Data=graft(hourlyplot_2.mesh))  # -> Branch0, Branch1
txt = Text(hourlyplot_3.labels)
mesh = Mesh(bang.Branch0)
mesh_2 = Mesh(bang_2.Branch0)

# ----
# Data adapter
panel_2 = Panel("""31
28
31
30
31
30
31
31
30
31
30
31""")
multiplication = Multiplication(A=panel_2, B="24")  # -> simplify(graft(Result))
subtraction = Subtraction(A=ma_2.Result, B=ma.Result)
division = Division(A=ma.Result, B=multiplication)
division_2 = Division(A=ma_2.Result, B=multiplication)
division_3 = Division(A=subtraction, B=multiplication)
multiplication_2 = Multiplication(A=division, B="100")
multiplication_3 = Multiplication(A=division_2, B="100")
multiplication_4 = Multiplication(A=division_3, B="100")
bnd = Bounds(Numbers=flatten([multiplication_2, multiplication_3, multiplication_4]))
series_2 = Series(Start="-100", Step="5", Count="21")
dedomain = DeconstructDomain(Domain=bnd)  # -> Start, End
series_3 = Series(Start="0", Step="5", Count="21")
smaller_5 = SmallerThan(FirstNumber=dedomain.Start, SecondNumber=series_2)  # -> SmallerThan, OrEqualTo
toggle = BooleanToggle(True)
larger_5 = LargerThan(FirstNumber=dedomain.End, SecondNumber=series_3)  # -> LargerThan, OrEqualTo
mindex = MemberIndex(Set=smaller_5.SmallerThan, Member=toggle)  # -> Index, Count
mindex_2 = MemberIndex(Set=larger_5.LargerThan, Member=toggle)  # -> Index, Count
item = ListItem(List=series_2, Index=expr("x-1", mindex.Index), Wrap=True)  # -> reverse(Item)
item_2 = ListItem(List=series_3, Index=expr("x+1", mindex_2.Index), Wrap=True)  # -> reverse(Item)
merge_3 = Merge(Data1=item_2, Data2=item)
bnd_2 = Bounds(Numbers=item_2)
bnd_3 = Bounds(Numbers=item_2)
bnd_4 = Bounds(Numbers=item_2)
bnd_5 = Bounds(Numbers=item_2)
pt = ConstructPoint(XCoordinate=0, YCoordinate=merge_3, ZCoordinate=0)
dedomain_2 = DeconstructDomain(Domain=bnd_2)  # -> Start, End
multiplication_5 = Multiplication(A=multiplication_2, B=monthly_chart_height)
dedomain_3 = DeconstructDomain(Domain=bnd_3)  # -> Start, End
multiplication_6 = Multiplication(A=multiplication_3, B=monthly_chart_height)
dedomain_4 = DeconstructDomain(Domain=bnd_4)  # -> Start, End
multiplication_7 = Multiplication(A=multiplication_4, B=monthly_chart_height)
dedomain_5 = DeconstructDomain(Domain=bnd_5)  # -> Start, End
multiplication_8 = Multiplication(A=pt, B=monthly_chart_height)
division_4 = Division(A=multiplication_5, B=dedomain_3.End)
division_5 = Division(A=multiplication_6, B=dedomain_4.End)
division_6 = Division(A=multiplication_7, B=dedomain_5.End)
division_7 = Division(A=multiplication_8, B=dedomain_2.End)
X = UnitX(Factor=labels_offset)
move = Move(Geometry=division_7, Motion=X)  # -> Geometry, Transform

# ----
# Actual graph
panel_3 = Panel("365")
division_8 = Division(A=graphs_width, B=panel_3)
scale = Scale(Geometry=hourlyplot_3.borders, Center=Point(0, 0, 0), Factor=division_8)  # -> Geometry, Transform
cull_i = CullIndex(List=scale.Geometry, Indices="0", Wrap=True)
eval = EvaluateCurve(Curve=cull_i, Parameter="0")  # -> Point, Tangent, Angle
X_2 = UnitX(Factor=1)
mindex_3 = MemberIndex(Set=eval.Tangent, Member=X_2)  # -> Index, Count

# ----
# Monthly chart legend
number_slider = Slider(10, range=0..10)
panel_4 = Panel("""Actual
Future
Delta""")
merge_4 = Merge(Data1=monthly_actual_colour, Data2=monthly_future_colour, Data3=monthly_delta_colour)
panel_5 = Panel("""0
1""")
pt_2 = ConstructPoint(XCoordinate=graphs_width, YCoordinate="0", ZCoordinate=0)
X_3 = UnitX(Factor=number_slider)
legendparcategorized = LBLegendParametersCategorized(domain=panel_5, colors=merge_4, categories=panel_4, seg_height="21", seg_width="6.8", text_height=labels_size)  # -> leg_par; plug-in component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
move_2 = Move(Geometry=pt_2, Motion=X_3)  # -> Geometry, Transform
createlegend = LBCreateLegend(values="0", base_plane=move_2.Geometry, title="Natural ventilation", legend_par=legendparcategorized)  # -> mesh, title_obj, label_objs, label_text, colors; plug-in component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
medges = MeshEdges(Mesh=createlegend.mesh)  # -> NakedEdges, InteriorEdges, NonManifoldEdges
preview = CustomPreview(Geometry=medges.NakedEdges, Material=swatch_4)

# ----
# Monthly chart
pt_3 = Point(Point(0, 0, 0))

# ----
# Lines
X_4 = UnitX(Factor=graphs_width)
move_3 = Move(Geometry=pt_3, Motion=X_4)  # -> Geometry, Transform
vec2pt = Vector2Pt(PointA=pt_3, PointB=division_7, Unitize=False)  # -> Vector, Length
ln = Line(StartPoint=pt_3, EndPoint=move_3.Geometry)
move_4 = Move(Geometry=ln, Motion=vec2pt.Vector)  # -> Geometry, Transform
previewlw = CustomPreviewLineweights(Geometry=move_4.Geometry, Shader=monthly_chart_lines, Thickness=monthly_chart_lines_thickness, Absolute=False)
previewlw_2 = CustomPreviewLineweights(Geometry=ln, Shader=monthly_chart_main_line, Thickness=monthly_chart_lines_thickness, Absolute=False)

# ----
# Parameters panel
panel_6 = Panel("""Parameters:

Wind Speed
Min: 0 m/s
Max: 0 m/s

Dry Bulb Temperature
Min: 0°C
Max: 0°C""")
item_3 = ListItem(List=panel_6, Index="8", Wrap=True)
item_4 = ListItem(List=panel_6, Index="7", Wrap=True)
merge_5 = Merge(Data1=ln, Data2=reverse(move_4.Geometry))  # -> flatten(Result)
item_5 = ListItem(List=panel_6, Index="4", Wrap=True)
item_6 = ListItem(List=panel_6, Index="3", Wrap=True)
rep = ReplaceText(Text=item_3, Find="0", Replace=upper_bound_air_temperature_c, RecursiveReplace=False)
rep_2 = ReplaceText(Text=item_4, Find="0", Replace=lower_bound_air_temperature_c, RecursiveReplace=False)
rep_3 = ReplaceText(Text=item_5, Find="0", Replace=upper_bound_wind_speed_m_s, RecursiveReplace=False)
rep_4 = ReplaceText(Text=item_6, Find="0", Replace=lower_bound_wind_speed_m_s, RecursiveReplace=False)
end = EndPoints(Curve=merge_5)  # -> Start, End
pdecon = Deconstruct(Point=end.Start)  # -> XComponent, YComponent, ZComponent
merge_6 = Merge(Data1=rep_4, Data2=rep_3, Data3=rep_2, Data4=rep)
merge_7 = Merge(Data1="3", Data2="4", Data3="7", Data4="8")
sort = SortList(Keys=pdecon.YComponent)  # -> Keys, ValuesA
replace = ReplaceItems(List=panel_6, Item=merge_6, Indices=merge_7, Wrap=False)
item_7 = ListItem(List=sort.Keys, Index=0, Wrap=True)
panel_7 = Panel(replace)
mindex_4 = MemberIndex(Set=pdecon.YComponent, Member=item_7)  # -> Index, Count
Y = UnitY(Factor=expr("-x", graphs_vertical_distance))
item_8 = ListItem(List=end.Start, Index=mindex_4.Index, Wrap=True)
move_5 = Move(Geometry=item_8, Motion=Y)  # -> Geometry, Transform
lng = ListLength(List=panel_7)
pdecon_2 = Deconstruct(Point=move_5.Geometry)  # -> XComponent, YComponent, ZComponent
series_4 = Series(Start=pdecon_2.YComponent, Step=parameter_panels_interline, Count=lng)
pt_4 = ConstructPoint(XCoordinate=0, YCoordinate=series_4, ZCoordinate=0)
tag = TextTag3D(Location=pt_4, Text=panel_7, Size=titles_size, Colour=labels_colour, Justification=1)

# ----
# Y - axis title
X_5 = UnitX(Factor=Slider(-17.3, range=-20..0))
move_6 = Move(Geometry=pt_3, Motion=X_5)  # -> Geometry, Transform
prot = RotatePlane(Plane=move_6.Geometry, Angle=degrees("90"))
tag_2 = TextTag3D(Location=prot, Text="Hours %", Size=labels_size, Colour=labels_colour, Justification=7)

# ----
# Title
item_9 = ListItem(List=move_4.Geometry, Index=0, Wrap=True)
end_2 = EndPoints(Curve=item_9)  # -> Start, End
vec = VectorXYZ(XComponent=expr("-x", labels_offset), YComponent=vertical_position_titles, ZComponent=0)  # -> Vector, Length
move_7 = Move(Geometry=end_2.Start, Motion=vec.Vector)  # -> Geometry, Transform
tag_3 = TextTag3D(Location=move_7.Geometry, Text="Monthly chart", Size="7", Colour=labels_colour, Justification=7)

# ----
# Y - axis labels
tag_4 = TextTag3D(Location=move.Geometry, Text=[item_2, item], Size=labels_size, Colour=labels_colour, Justification=6)

# ----
# Graphs vertical positioner
panel_8 = Panel("""1
2""")
item_10 = ListItem(List=move_4.Geometry, Index=0, Wrap=True)
end_3 = EndPoints(Curve=item_10)  # -> Start, End
pdecon_3 = Deconstruct(Point=end_3.Start)  # -> XComponent, YComponent, ZComponent
addition = Addition(A=graphs_vertical_distance, B=pdecon_3.YComponent)

# ----
# Delta graph
panel_9 = Panel("365")
division_9 = Division(A=graphs_width, B=panel_9)
scale_2 = Scale(Geometry=hourlyplot_3.borders, Center=Point(0, 0, 0), Factor=division_9)  # -> Geometry, Transform
cull_i_2 = CullIndex(List=scale_2.Geometry, Indices="0", Wrap=True)
eval_2 = EvaluateCurve(Curve=cull_i_2, Parameter="0")  # -> Point, Tangent, Angle
X_6 = UnitX(Factor=1)
Y_2 = UnitY(Factor=addition)
mindex_5 = MemberIndex(Set=eval_2.Tangent, Member=X_6)  # -> Index, Count

# ----
# Mesh
facen = FaceNormals(Mesh=mesh)  # -> Centers, Normals
faceb = FaceBoundaries(Mesh=mesh_2)
facen_2 = FaceNormals(Mesh=mesh_2)  # -> Centers, Normals
faceb_2 = FaceBoundaries(Mesh=mesh)
incurves = PointInCurves(Point=facen_2.Centers, Curves=faceb_2)  # -> Relationship, Index, Point
incurves_2 = PointInCurves(Point=facen.Centers, Curves=faceb)  # -> Relationship, Index, Point
cullf = CullFaces(Mesh=mesh_2, Pattern=invert(incurves.Relationship))
cullf_2 = CullFaces(Mesh=mesh, Pattern=incurves_2.Relationship)
cullf_3 = CullFaces(Mesh=mesh_2, Pattern=incurves.Relationship)
mcol = MeshColours(Mesh=cullf, Colours=swatch_2)
mcol_2 = MeshColours(Mesh=cullf_3, Colours=swatch_3)
mcol_3 = MeshColours(Mesh=cullf_2, Colours=swatch)
mjoin = MeshJoin(Meshes=[mcol_2, mcol_3, mcol])
facen_3 = FaceNormals(Mesh=hourlyplot_3.mesh)  # -> Centers, Normals
faceb_3 = FaceBoundaries(Mesh=mjoin)
incurves_3 = PointInCurves(Point=facen_3.Centers, Curves=faceb_3)  # -> Relationship, Index, Point
cullf_4 = CullFaces(Mesh=hourlyplot_3.mesh, Pattern=incurves_3.Relationship)
mcol_4 = MeshColours(Mesh=cullf_4, Colours=swatch_4)
mjoin_2 = MeshJoin(Meshes=flatten([mcol_4, mjoin]))
scale_3 = Scale(Geometry=mjoin_2, Center=Point(0, 0, 0), Factor=division_9)  # -> Geometry, Transform
move_8 = Move(Geometry=scale_3.Geometry, Motion=Y_2)  # -> Geometry, Transform

# ----
# X - axis labels
Y_3 = UnitY(Factor=1)
mindex_6 = MemberIndex(Set=eval_2.Tangent, Member=Y_3)  # -> Index, Count
item_11 = ListItem(List=eval_2.Point, Index=mindex_6.Index, Wrap=True)
pt_5 = Point(Point(0, 0, 0))
ins = InsertItems(List=item_11, Item=pt_5, Indices="0", Wrap=True)
item_12 = ListItem(List=ins, Index="1", Wrap=True)
pdecon_4 = Deconstruct(Point=item_12)  # -> XComponent, YComponent, ZComponent
division_10 = Division(A=pdecon_4.XComponent, B="2")
vec_2 = VectorXYZ(XComponent=division_10, YComponent=labels_offset, ZComponent=0)  # -> Vector, Length
move_9 = Move(Geometry=ins, Motion=vec_2.Vector)  # -> Geometry, Transform
move_10 = Move(Geometry=move_9.Geometry, Motion=Y_2)  # -> Geometry, Transform
cull_i_3 = CullIndex(List=txt, Indices=mindex_5.Index, Wrap=True)
tag_5 = TextTag3D(Location=move_10.Geometry, Text=cull_i_3, Size=labels_size, Colour=heatmaps_lines_colours, Justification=2)

# ----
# Bars
pdecon_5 = Deconstruct(Point=move_9.Geometry)  # -> XComponent, YComponent, ZComponent
neg = Negative(Value=monthly_chart_bars_width)
multiplication_9 = Multiplication(A=monthly_chart_bars_width, B="2")
multiplication_10 = Multiplication(A=monthly_chart_bars_width, B="-2")
pt_6 = ConstructPoint(XCoordinate=graft(pdecon_5.XComponent), YCoordinate=0, ZCoordinate=0)
X_7 = UnitX(Factor=multiplication_9)
X_8 = UnitX(Factor=multiplication_10)
dom = ConstructDomain(DomainStart=neg, DomainEnd=monthly_chart_bars_width)
move_11 = Move(Geometry=pt_6, Motion=X_8)  # -> simplify(Geometry), Transform
move_12 = Move(Geometry=pt_6, Motion=X_7)  # -> simplify(Geometry), Transform
rectangle = Rectangle(Plane=move_12.Geometry, XSize=dom, YSize=division_6, Radius=0)  # -> Rectangle, Length
rectangle_2 = Rectangle(Plane=move_11.Geometry, XSize=dom, YSize=division_4, Radius=0)  # -> Rectangle, Length
rectangle_3 = Rectangle(Plane=pt_6, XSize=dom, YSize=division_5, Radius=0)  # -> Rectangle, Length
drec = DeconstructRectangle(Rectangle=rectangle.Rectangle)  # -> BasePlane, XInterval, YInterval
drec_2 = DeconstructRectangle(Rectangle=rectangle_3.Rectangle)  # -> BasePlane, XInterval, YInterval
drec_3 = DeconstructRectangle(Rectangle=rectangle_2.Rectangle)  # -> BasePlane, XInterval, YInterval
num = Number(drec_2.YInterval)
num_2 = Number(drec.YInterval)
num_3 = Number(drec_3.YInterval)
equals = Equality(FirstNumber=num_3, SecondNumber="0")  # -> Equality, Inequality
equals_2 = Equality(FirstNumber=num_2, SecondNumber="0")  # -> Equality, Inequality
equals_3 = Equality(FirstNumber=num, SecondNumber="0")  # -> Equality, Inequality
cull = CullPattern(List=rectangle_2.Rectangle, CullPattern=invert(equals.Equality))
cull_2 = CullPattern(List=rectangle.Rectangle, CullPattern=invert(equals_2.Equality))
cull_3 = CullPattern(List=rectangle_3.Rectangle, CullPattern=invert(equals_3.Equality))
mplane = MeshPlane(Boundary=cull, WidthCount="1", HeightCount="1")  # -> Mesh, Area
mplane_2 = MeshPlane(Boundary=cull_3, WidthCount="1", HeightCount="1")  # -> Mesh, Area
mplane_3 = MeshPlane(Boundary=cull_2, WidthCount="1", HeightCount="1")  # -> Mesh, Area
mcol_5 = MeshColours(Mesh=mplane.Mesh, Colours=monthly_actual_colour)
mcol_6 = MeshColours(Mesh=mplane_2.Mesh, Colours=monthly_future_colour)
mcol_7 = MeshColours(Mesh=mplane_3.Mesh, Colours=monthly_delta_colour)

# ----
# Bars
panel_10 = Panel("2.5")
pdecon_6 = Deconstruct(Point=move_9.Geometry)  # -> XComponent, YComponent, ZComponent
neg_2 = Negative(Value=monthly_chart_bars_width)
multiplication_11 = Multiplication(A=monthly_chart_bars_width, B="2")
multiplication_12 = Multiplication(A=monthly_chart_bars_width, B="-2")
pt_7 = ConstructPoint(XCoordinate=graft(pdecon_6.XComponent), YCoordinate=0, ZCoordinate=0)
dom_2 = ConstructDomain(DomainStart=neg_2, DomainEnd=monthly_chart_bars_width)
subtraction_2 = Subtraction(A=ma_2.Result, B=ma.Result)
X_9 = UnitX(Factor=multiplication_11)
X_10 = UnitX(Factor=multiplication_12)
move_13 = Move(Geometry=pt_7, Motion=X_9)  # -> simplify(Geometry), Transform
division_11 = Division(A=ma.Result, B=panel_10)  # -> simplify(Result)
division_12 = Division(A=subtraction_2, B=panel_10)  # -> simplify(Result)
move_14 = Move(Geometry=pt_7, Motion=X_10)  # -> simplify(Geometry), Transform
division_13 = Division(A=ma_2.Result, B=panel_10)  # -> simplify(Result)
rectangle_4 = Rectangle(Plane=move_13.Geometry, XSize=dom_2, YSize=division_12, Radius=0)  # -> Rectangle, Length
rectangle_5 = Rectangle(Plane=move_14.Geometry, XSize=dom_2, YSize=division_11, Radius=0)  # -> Rectangle, Length
rectangle_6 = Rectangle(Plane=pt_7, XSize=dom_2, YSize=division_13, Radius=0)  # -> Rectangle, Length
drec_4 = DeconstructRectangle(Rectangle=rectangle_4.Rectangle)  # -> BasePlane, XInterval, YInterval
drec_5 = DeconstructRectangle(Rectangle=rectangle_6.Rectangle)  # -> BasePlane, XInterval, YInterval
drec_6 = DeconstructRectangle(Rectangle=rectangle_5.Rectangle)  # -> BasePlane, XInterval, YInterval
num_4 = Number(drec_5.YInterval)
num_5 = Number(drec_4.YInterval)
num_6 = Number(drec_6.YInterval)
equals_4 = Equality(FirstNumber=num_6, SecondNumber="0")  # -> Equality, Inequality
equals_5 = Equality(FirstNumber=num_5, SecondNumber="0")  # -> Equality, Inequality
equals_6 = Equality(FirstNumber=num_4, SecondNumber="0")  # -> Equality, Inequality
cull_4 = CullPattern(List=rectangle_5.Rectangle, CullPattern=invert(equals_4.Equality))
cull_5 = CullPattern(List=rectangle_4.Rectangle, CullPattern=invert(equals_5.Equality))
cull_6 = CullPattern(List=rectangle_6.Rectangle, CullPattern=invert(equals_6.Equality))
mplane_4 = MeshPlane(Boundary=cull_4, WidthCount="1", HeightCount="1")  # -> Mesh, Area
mplane_5 = MeshPlane(Boundary=cull_6, WidthCount="1", HeightCount="1")  # -> Mesh, Area
mplane_6 = MeshPlane(Boundary=cull_5, WidthCount="1", HeightCount="1")  # -> Mesh, Area
mcol_8 = MeshColours(Mesh=mplane_4.Mesh, Colours=monthly_actual_colour)
mcol_9 = MeshColours(Mesh=mplane_5.Mesh, Colours=monthly_future_colour)
mcol_10 = MeshColours(Mesh=mplane_6.Mesh, Colours=monthly_delta_colour)

bnd_6 = Bounds(Numbers=flatten([ma.Result, ma_2.Result]))
dedomain_6 = DeconstructDomain(Domain=bnd_6)  # -> Start, End
series_5 = Series(Start="0", Step="50", Count="178")
smaller_6 = SmallerThan(FirstNumber=dedomain_6.End, SecondNumber=series_5)  # -> SmallerThan, OrEqualTo
mindex_7 = MemberIndex(Set=smaller_6.OrEqualTo, Member=Toggle(True))  # -> Index, Count
bnd_7 = Bounds(Numbers=mindex_7.Index)
dedomain_7 = DeconstructDomain(Domain=bnd_7)  # -> Start, End
item_13 = ListItem(List=series_5, Index=dedomain_7.Start, Wrap=True)
split = SplitList(List=series_5, Index=dedomain_7.Start)  # -> reverse(ListA), ListB
merge_8 = Merge(Data1=split.ListA, Data2=item_13)  # -> flatten(Result)
division_14 = Division(A=merge_8, B=panel_10)
pt_8 = ConstructPoint(XCoordinate=0, YCoordinate=division_14, ZCoordinate=0)
X_11 = UnitX(Factor=labels_offset)
move_15 = Move(Geometry=pt_8, Motion=X_11)  # -> Geometry, Transform

# ----
# Y - axis labels
item_14 = ListItem(List=eval_2.Point, Index=mindex_5.Index, Wrap=True)
X_12 = UnitX(Factor=labels_offset)
move_16 = Move(Geometry=item_14, Motion=X_12)  # -> Geometry, Transform
move_17 = Move(Geometry=move_16.Geometry, Motion=Y_2)  # -> Geometry, Transform
item_15 = ListItem(List=txt, Index=mindex_5.Index, Wrap=True)
tag_6 = TextTag3D(Location=move_17.Geometry, Text=item_15, Size=labels_size, Colour=heatmaps_lines_colours, Justification=6)

# ----
# Lines
move_18 = Move(Geometry=scale_2.Geometry, Motion=Y_2)  # -> Geometry, Transform
preview_2 = CustomPreview(Geometry=move_18.Geometry, Material=heatmaps_lines_colours)

item_16 = ListItem(List=move_18.Geometry, Index=0, Wrap=True)
cpoly = ControlPolygon(Curve=item_16)  # -> Polygon, Points
item_17 = ListItem(List=cpoly.Points, Index=panel_8, Wrap=True)
pdecon_7 = Deconstruct(Point=item_17)  # -> XComponent, YComponent, ZComponent
bnd_8 = Bounds(Numbers=pdecon_7.YComponent)
num_7 = Number(bnd_8)
addition_2 = Addition(A=graphs_vertical_distance, B=num_7, C=addition)

# ----
# Mesh
facen_4 = FaceNormals(Mesh=hourlyplot_3.mesh)  # -> Centers, Normals
faceb_4 = FaceBoundaries(Mesh=mesh_2)
incurves_4 = PointInCurves(Point=facen_4.Centers, Curves=faceb_4)  # -> Relationship, Index, Point
number_slider_2 = Slider(350, range=0..500)
cullf_5 = CullFaces(Mesh=hourlyplot_3.mesh, Pattern=invert(incurves_4.Relationship))
cullf_6 = CullFaces(Mesh=hourlyplot_3.mesh, Pattern=incurves_4.Relationship)
mcol_11 = MeshColours(Mesh=cullf_6, Colours=swatch_4)
mcol_12 = MeshColours(Mesh=cullf_5, Colours=swatch_2)
Y_4 = UnitY(Factor=addition_2)
scale_4 = Scale(Geometry=[mcol_11, mcol_12], Center=Point(0, 0, 0), Factor=division_8)  # -> Geometry, Transform
move_19 = Move(Geometry=scale_4.Geometry, Motion=Y_4)  # -> Geometry, Transform

# ----
# X - axis labels
Y_5 = UnitY(Factor=1)
mindex_8 = MemberIndex(Set=eval.Tangent, Member=Y_5)  # -> Index, Count
item_18 = ListItem(List=eval.Point, Index=mindex_8.Index, Wrap=True)
pt_9 = Point(Point(0, 0, 0))
ins_2 = InsertItems(List=item_18, Item=pt_9, Indices="0", Wrap=True)
item_19 = ListItem(List=ins_2, Index="1", Wrap=True)
pdecon_8 = Deconstruct(Point=item_19)  # -> XComponent, YComponent, ZComponent
division_15 = Division(A=pdecon_8.XComponent, B="2")
vec_3 = VectorXYZ(XComponent=division_15, YComponent=labels_offset, ZComponent=0)  # -> Vector, Length
move_20 = Move(Geometry=ins_2, Motion=vec_3.Vector)  # -> Geometry, Transform
move_21 = Move(Geometry=move_20.Geometry, Motion=Y_4)  # -> Geometry, Transform
cull_i_4 = CullIndex(List=txt, Indices=mindex_3.Index, Wrap=True)
tag_7 = TextTag3D(Location=move_21.Geometry, Text=cull_i_4, Size=labels_size, Colour=labels_colour, Justification=2)

# ----
# Y - axis labels
item_20 = ListItem(List=eval.Point, Index=mindex_3.Index, Wrap=True)
X_13 = UnitX(Factor=labels_offset)
move_22 = Move(Geometry=item_20, Motion=X_13)  # -> Geometry, Transform
item_21 = ListItem(List=txt, Index=mindex_3.Index, Wrap=True)
move_23 = Move(Geometry=move_22.Geometry, Motion=Y_4)  # -> Geometry, Transform
tag_8 = TextTag3D(Location=move_23.Geometry, Text=item_21, Size=labels_size, Colour=labels_colour, Justification=6)

# ----
# Title
panel_11 = Panel("-1")
vec_4 = VectorXYZ(XComponent=expr("-x", labels_offset), YComponent=vertical_position_titles, ZComponent=0)  # -> Vector, Length
item_22 = ListItem(List=move_23.Geometry, Index=panel_11, Wrap=True)
move_24 = Move(Geometry=item_22, Motion=vec_4.Vector)  # -> Geometry, Transform
tag_9 = TextTag3D(Location=move_24.Geometry, Text="Actual", Size=titles_size, Colour=labels_colour, Justification=7)

# ----
# Labels
panel_12 = Panel("""Jan
Feb
Mar
Apr
May
Jun
Jul
Aug
Sep
Oct
Nov
Dec""")
number_slider_3 = Slider(3, range=0..10)
tag_10 = TextTag3D(Location=graft(move_9.Geometry), Text=graft(panel_12), Size=labels_size, Colour=labels_colour, Justification=2)
tag_11 = TextTag3D(Location=move_15.Geometry, Text=merge_8, Size=labels_size, Colour=labels_colour, Justification=6)

# ----
# Lines
move_25 = Move(Geometry=scale.Geometry, Motion=Y_4)  # -> Geometry, Transform
preview_3 = CustomPreview(Geometry=move_25.Geometry, Material=labels_colour)

# ----
# Legend
panel_13 = Panel("""Always possible
Never possible
Possible in the future
Not possible in the future""")
panel_14 = Panel("""0
1
2""")
merge_9 = Merge(Data1=swatch_2, Data2=swatch_4, Data3=swatch, Data4=swatch_3)
legendparcategorized_2 = LBLegendParametersCategorized(domain=panel_14, colors=merge_9, categories=panel_13, seg_height="21", seg_width="6.8", text_height=labels_size)  # -> leg_par; plug-in component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
pt_10 = ConstructPoint(XCoordinate=graphs_width, YCoordinate=addition, ZCoordinate=0)
X_14 = UnitX(Factor=Slider(10, range=0..10))
move_26 = Move(Geometry=pt_10, Motion=X_14)  # -> Geometry, Transform
createlegend_2 = LBCreateLegend(values="0", base_plane=move_26.Geometry, title="Δ Natural ventilation", legend_par=legendparcategorized_2)  # -> mesh, title_obj, label_objs, label_text, colors; plug-in component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
medges_2 = MeshEdges(Mesh=createlegend_2.mesh)  # -> NakedEdges, InteriorEdges, NonManifoldEdges
preview_4 = CustomPreview(Geometry=medges_2.NakedEdges, Material=swatch_4)

# ----
# Legend
panel_15 = Panel("""Possible
Not possible""")
merge_10 = Merge(Data1=swatch_2, Data2=swatch_4)
legendparcategorized_3 = LBLegendParametersCategorized(domain="0, 1", colors=merge_10, categories=panel_15, seg_height="21", seg_width="6.8", text_height=labels_size)  # -> leg_par; plug-in component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
pt_11 = ConstructPoint(XCoordinate=graphs_width, YCoordinate=addition_2, ZCoordinate=0)
X_15 = UnitX(Factor=Slider(10, range=0..10))
move_27 = Move(Geometry=pt_11, Motion=X_15)  # -> Geometry, Transform
createlegend_3 = LBCreateLegend(values="0", base_plane=move_27.Geometry, title="Natural ventilation", legend_par=legendparcategorized_3)  # -> mesh, title_obj, label_objs, label_text, colors; plug-in component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
medges_3 = MeshEdges(Mesh=createlegend_3.mesh)  # -> NakedEdges, InteriorEdges, NonManifoldEdges
preview_5 = CustomPreview(Geometry=medges_3.NakedEdges, Material=swatch_4)

# ----
# Main title
panel_16 = Panel(",")
split_2 = TextSplit(Text=importepw.location, Separators=panel_16)
item_23 = ListItem(List=split_2, Index=0, Wrap=True)
Y_6 = UnitY(Factor=Slider(35, range=0..100))
Y_7 = UnitY(Factor=Slider(-12, range=-20..0))
move_28 = Move(Geometry=move_24.Geometry, Motion=Y_6)  # -> Geometry, Transform
concat_3 = Concatenate(FragmentA="Natural ventilation opportunities_", FragmentB=item_23)
move_29 = Move(Geometry=move_28.Geometry, Motion=Vector(0, 0, 10))  # -> Geometry, Transform
move_30 = Move(Geometry=move_29.Geometry, Motion=Y_7)  # -> Geometry, Transform
tag_12 = TextTag3D(Location=move_29.Geometry, Text=concat_3, Size=titles_size, Colour=labels_colour, Justification=7)
tag_13 = TextTag3D(
    Location=move_30.Geometry,
    Text="File: natural_ventilation_opportunities.gh",
    Size="6.3",
    Colour=labels_colour,
    Justification=7)

# ----
# Title
panel_17 = Panel("-1")
vec_5 = VectorXYZ(XComponent=expr("-x", labels_offset), YComponent=vertical_position_titles, ZComponent=0)  # -> Vector, Length
item_24 = ListItem(List=move_17.Geometry, Index=panel_17, Wrap=True)
move_31 = Move(Geometry=item_24, Motion=vec_5.Vector)  # -> Geometry, Transform
tag_14 = TextTag3D(Location=move_31.Geometry, Text="Delta", Size=titles_size, Colour=labels_colour, Justification=7)
