# Grasshopper definition psychrometric_chart_actual_future_delta.gh (Grasshopper 1.0.8)
# plug-ins: LadybugGrasshopper

# ---- group: Insert path to current EPW
# File: psychrometric_chart_actual_future_delta.gh
# Additional plugins: Ladybug Tools version 1.8.0
# 1. Insert path to current EPW
current_epw = FilePath("D:\Marcello\Dropbox\PhD Parma\BERKELEY\CLIMA TOOL\EPWs\Berkeley_Actual.epw")

# ----
# 2. Insert path to future EPW
future_epw = FilePath("D:\Marcello\Dropbox\PhD Parma\BERKELEY\CLIMA TOOL\EPWs\Berkeley_2070-8.5.epw")

# ----
# 3. Turn the toggle into "true" to run the script
falsestart = LBFalseStartToggle(False)

# ----
# Settings
horizontal_spacing_upper_graphs = Slider(50, range=0..50)
legend_distance = Slider(20, range=0..20)
titles_y_position = Slider(120, range=0..500)
main_titles_size = Slider(7, range=0..10)
small_titles_size = Slider(6.3, range=0..10)
legend_height = Slider(12, range=0..20)
graphs_height = Slider(110, range=0..600)
labels_offset = Slider(-3, range=-3..0)
graps_width = Slider(280, range=0..600)
labels_size = Slider(5, range=0.1..10)
continuous_legend = BooleanToggle(True)
labels_colour = ColourSwatch(SwatchColor=RGB(0, 0, 0))
lines_colour = ColourSwatch(SwatchColor=RGB(128, 128, 128))

# ----
# Data colours
swatch = ColourSwatch(SwatchColor=RGB(254, 218, 139))
swatch_2 = ColourSwatch(SwatchColor=RGB(54, 75, 154))
merge = Merge(
    Data1=ColourSwatch(SwatchColor=RGB(165, 0, 38)),
    Data2=ColourSwatch(SwatchColor=RGB(221, 61, 45)),
    Data3=ColourSwatch(SwatchColor=RGB(246, 126, 75)),
    Data4=ColourSwatch(SwatchColor=RGB(253, 179, 102)),
    Data5=swatch,
    Data6=ColourSwatch(SwatchColor=RGB(234, 236, 204)),
    Data7=ColourSwatch(SwatchColor=RGB(194, 228, 239)),
    Data8=ColourSwatch(SwatchColor=RGB(152, 202, 225)),
    Data9=ColourSwatch(SwatchColor=RGB(110, 166, 205)),
    Data10=ColourSwatch(SwatchColor=RGB(74, 123, 183)))  # -> reverse(Result)

# ----
# Scale factor
panel = Panel("2")
multiplication = Multiplication(A=graps_width, B=panel)
addition = Addition(A=multiplication, B=horizontal_spacing_upper_graphs)
division = Division(A=addition, B=graps_width)

# ----
# Data
dispatch = Dispatch(List=current_epw, DispatchPattern=falsestart)  # -> ListA, ListB
dispatch_2 = Dispatch(List=future_epw, DispatchPattern=falsestart)  # -> ListA, ListB
importepw = LBImportEPW(epw_file=dispatch.ListA)  # -> location, dry_bulb_temperature, dew_point_temperature, relative_humidity, wind_speed, wind_direction, direct_normal_rad, diffuse_horizontal_rad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; plug-in component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
importepw_2 = LBImportEPW(epw_file=dispatch_2.ListA)  # -> location, dry_bulb_temperature, dew_point_temperature, relative_humidity, wind_speed, wind_direction, direct_normal_rad, diffuse_horizontal_rad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; plug-in component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

# ----
# Barometric pressure
xdata = LBDeconstructData(data=importepw.barometric_pressure)  # -> header, values; plug-in component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

# ----
# Mesh grid
panel_2 = Panel("2")
xdata_2 = LBDeconstructData(data=importepw_2.barometric_pressure)  # -> header, values; plug-in component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
series = Series(Start="-20.25", Step="1", Count="72")
multiplication_2 = Multiplication(A=series, B=panel_2)
addition_2 = Addition(A=multiplication_2, B="40")
addition_3 = Addition(A=xdata.values, B=xdata_2.values)
series_2 = Series(Start="-0.5", Step="4", Count="26")  # -> graft(Series)
division_2 = Division(A=addition_3, B="2")
avr = Average(Input=division_2)
humidityr = LBHumidityMetrics(dry_bulb=series, rel_humid=series_2, pressure=avr)  # -> humid_ratio, enthalpy, wet_bulb, dew_point; plug-in component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
multiplication_3 = Multiplication(A=humidityr.humid_ratio, B="3000")
pt = ConstructPoint(XCoordinate=addition_2, YCoordinate=multiplication_3, ZCoordinate=0)
cull_i = CullIndex(List=pt, Indices="0", Wrap=True)
cull_i_2 = CullIndex(List=pt, Indices="-1", Wrap=True)
ln = Line(StartPoint=cull_i_2, EndPoint=cull_i)
flip = FlipMatrix(Data=ln)
cull_i_3 = CullIndex(List=flip, Indices="-1", Wrap=True)
cull_i_4 = CullIndex(List=flip, Indices="0", Wrap=True)
rulesrf = RuledSurface(CurveA=cull_i_3, CurveB=cull_i_4)  # -> flatten(Surface)
debrep = DeconstructBrep(Brep=rulesrf)  # -> Faces, Edges, Vertices
conmesh = ConstructMesh(Vertices=debrep.Vertices, Faces={A=0, B=1, C=2, D=3})  # -> flatten(Mesh)
mjoin = MeshJoin(Meshes=conmesh)
facen = FaceNormals(Mesh=mjoin)  # -> Centers, Normals
bool = Boolean(Toggle(True))

data = LBConstructData(header=xdata.header, values=division_2)  # -> data; plug-in component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

psychrometricchart = LBPsychrometricChart(temperature=importepw.dry_bulb_temperature, rel_humidity=importepw.relative_humidity, pressure=data)  # -> report, title, temp_lines, rh_lines, hr_lines, enth_wb_lines, mesh, legend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; plug-in component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
psychrometricchart_2 = LBPsychrometricChart(temperature=importepw_2.dry_bulb_temperature, rel_humidity=importepw_2.relative_humidity, pressure=data)  # -> report, title, temp_lines, rh_lines, hr_lines, enth_wb_lines, mesh, legend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; plug-in component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

item = ListItem(List=psychrometricchart.title, Index=0, Wrap=True)
item_2 = ListItem(List=psychrometricchart.rh_lines, Index="9", Wrap=True)
join = JoinCurves(Curves=[item, item_2], Preserve=False)
offset = OffsetCurve(Curve=join, Distance=2, Plane=PlaneXY(0, 0, 0), Corners=1)
incurve = PointInCurve(Point=facen.Centers, Curve=offset)  # -> Relationship, Point
cullf = CullFaces(Mesh=mjoin, Pattern=invert(incurve.Relationship))
faceb = FaceBoundaries(Mesh=cullf)
lng = ListLength(List=faceb)
series_3 = Series(Start="0", Step=1, Count=lng)  # -> graft(Series)

# ----
# Point cloud actual
incurves = PointInCurves(Point=psychrometricchart.points, Curves=faceb)  # -> Relationship, Index, Point
dom = ConstructDomain(DomainStart=series_3, DomainEnd=series_3)
inc = Includes(Value=incurves.Index, Domain=dom)  # -> Includes, Deviation
mindex = MemberIndex(Set=inc.Includes, Member=bool)  # -> Index, flatten(Count)

# ----
# Point cloud future
incurves_2 = PointInCurves(Point=psychrometricchart_2.points, Curves=faceb)  # -> Relationship, Index, Point
dom_2 = ConstructDomain(DomainStart=series_3, DomainEnd=series_3)
inc_2 = Includes(Value=incurves_2.Index, Domain=dom_2)  # -> Includes, Deviation
mindex_2 = MemberIndex(Set=inc_2.Includes, Member=bool)  # -> Index, flatten(Count)

# ----
# DELTA GRAPH
subtraction = Subtraction(A=mindex_2.Count, B=mindex.Count)

# ----
# Categories
panel_3 = Panel("-50")
series_4 = Series(Start=panel_3, Step="10", Count="11")
bang = ExplodeTree(Data=graft(series_4))  # -> Branch0, Branch1, Branch2, Branch3, Branch4, Branch5, Branch6, Branch7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
smaller = SmallerThan(FirstNumber=subtraction, SecondNumber=bang.Branch10)  # -> SmallerThan, OrEqualTo
larger = LargerThan(FirstNumber=subtraction, SecondNumber=bang.Branch9)  # -> LargerThan, OrEqualTo
smaller_2 = SmallerThan(FirstNumber=subtraction, SecondNumber=bang.Branch9)  # -> SmallerThan, OrEqualTo
larger_2 = LargerThan(FirstNumber=subtraction, SecondNumber=bang.Branch8)  # -> LargerThan, OrEqualTo
smaller_3 = SmallerThan(FirstNumber=subtraction, SecondNumber=bang.Branch8)  # -> SmallerThan, OrEqualTo
larger_3 = LargerThan(FirstNumber=subtraction, SecondNumber=bang.Branch7)  # -> LargerThan, OrEqualTo
smaller_4 = SmallerThan(FirstNumber=subtraction, SecondNumber=bang.Branch7)  # -> SmallerThan, OrEqualTo
larger_4 = LargerThan(FirstNumber=subtraction, SecondNumber=bang.Branch6)  # -> LargerThan, OrEqualTo
smaller_5 = SmallerThan(FirstNumber=subtraction, SecondNumber=bang.Branch6)  # -> SmallerThan, OrEqualTo
larger_5 = LargerThan(FirstNumber=subtraction, SecondNumber=bang.Branch5)  # -> LargerThan, OrEqualTo
smaller_6 = SmallerThan(FirstNumber=subtraction, SecondNumber=bang.Branch5)  # -> SmallerThan, OrEqualTo
larger_6 = LargerThan(FirstNumber=subtraction, SecondNumber=bang.Branch4)  # -> LargerThan, OrEqualTo
smaller_7 = SmallerThan(FirstNumber=subtraction, SecondNumber=bang.Branch4)  # -> SmallerThan, OrEqualTo
larger_7 = LargerThan(FirstNumber=subtraction, SecondNumber=bang.Branch3)  # -> LargerThan, OrEqualTo
smaller_8 = SmallerThan(FirstNumber=subtraction, SecondNumber=bang.Branch3)  # -> SmallerThan, OrEqualTo
larger_8 = LargerThan(FirstNumber=subtraction, SecondNumber=bang.Branch2)  # -> LargerThan, OrEqualTo
smaller_9 = SmallerThan(FirstNumber=subtraction, SecondNumber=bang.Branch2)  # -> SmallerThan, OrEqualTo
larger_9 = LargerThan(FirstNumber=subtraction, SecondNumber=bang.Branch1)  # -> LargerThan, OrEqualTo
smaller_10 = SmallerThan(FirstNumber=subtraction, SecondNumber=bang.Branch1)  # -> SmallerThan, OrEqualTo
larger_10 = LargerThan(FirstNumber=subtraction, SecondNumber=bang.Branch0)  # -> LargerThan, OrEqualTo
and = GateAnd(A=smaller.OrEqualTo, B=larger.LargerThan)
and_2 = GateAnd(A=smaller_2.OrEqualTo, B=larger_2.LargerThan)
and_3 = GateAnd(A=smaller_3.OrEqualTo, B=larger_3.LargerThan)
and_4 = GateAnd(A=smaller_4.OrEqualTo, B=larger_4.LargerThan)
and_5 = GateAnd(A=smaller_5.OrEqualTo, B=larger_5.LargerThan)
and_6 = GateAnd(A=smaller_6.SmallerThan, B=larger_6.LargerThan)
and_7 = GateAnd(A=smaller_7.OrEqualTo, B=larger_7.LargerThan)
and_8 = GateAnd(A=smaller_8.OrEqualTo, B=larger_8.LargerThan)
and_9 = GateAnd(A=smaller_9.SmallerThan, B=larger_9.OrEqualTo)
and_10 = GateAnd(A=smaller_10.SmallerThan, B=larger_10.OrEqualTo)
cullf_2 = CullFaces(Mesh=cullf, Pattern=invert(and))
cullf_3 = CullFaces(Mesh=cullf, Pattern=invert(and_2))
cullf_4 = CullFaces(Mesh=cullf, Pattern=invert(and_3))
cullf_5 = CullFaces(Mesh=cullf, Pattern=invert(and_4))
cullf_6 = CullFaces(Mesh=cullf, Pattern=invert(and_5))
cullf_7 = CullFaces(Mesh=cullf, Pattern=invert(and_6))
cullf_8 = CullFaces(Mesh=cullf, Pattern=invert(and_7))
cullf_9 = CullFaces(Mesh=cullf, Pattern=invert(and_8))
cullf_10 = CullFaces(Mesh=cullf, Pattern=invert(and_9))
cullf_11 = CullFaces(Mesh=cullf, Pattern=invert(and_10))
swatch_3 = ColourSwatch(SwatchColor=RGB(220, 5, 12))
swatch_4 = ColourSwatch(SwatchColor=RGB(232, 96, 28))
swatch_5 = ColourSwatch(SwatchColor=RGB(241, 147, 45))
swatch_6 = ColourSwatch(SwatchColor=RGB(246, 193, 65))
swatch_7 = ColourSwatch(SwatchColor=RGB(247, 240, 86))
swatch_8 = ColourSwatch(SwatchColor=RGB(202, 224, 171))
swatch_9 = ColourSwatch(SwatchColor=RGB(144, 201, 135))
swatch_10 = ColourSwatch(SwatchColor=RGB(78, 178, 101))
swatch_11 = ColourSwatch(SwatchColor=RGB(123, 175, 222))
swatch_12 = ColourSwatch(SwatchColor=RGB(82, 137, 199))
mcol = MeshColours(Mesh=cullf_2, Colours=swatch_3)
mcol_2 = MeshColours(Mesh=cullf_3, Colours=swatch_4)
mcol_3 = MeshColours(Mesh=cullf_4, Colours=swatch_5)
mcol_4 = MeshColours(Mesh=cullf_5, Colours=swatch_6)
mcol_5 = MeshColours(Mesh=cullf_6, Colours=swatch_7)
mcol_6 = MeshColours(Mesh=cullf_7, Colours=swatch_8)
mcol_7 = MeshColours(Mesh=cullf_8, Colours=swatch_9)
mcol_8 = MeshColours(Mesh=cullf_9, Colours=swatch_10)
mcol_9 = MeshColours(Mesh=cullf_10, Colours=swatch_11)
mcol_10 = MeshColours(Mesh=cullf_11, Colours=swatch_12)

# ----
# Misc
panel_4 = Panel("140")
addition_4 = Addition(A=graps_width, B=horizontal_spacing_upper_graphs)
pt_2 = ConstructPoint(XCoordinate=0, YCoordinate=titles_y_position, ZCoordinate=0)
division_3 = Division(A=graps_width, B=panel_4)
division_4 = Division(A=graphs_height, B="90")
X = UnitX(Factor=addition_4)

# ----
# Mesh
mjoin_2 = MeshJoin(Meshes=[mcol_7, mcol_8, mcol_9, mcol_10, mcol_6, mcol_5, mcol_4, mcol_3, mcol_2, mcol])
mesh = Mesh(mjoin_2)
scale_nu = ScaleNU(Geometry=mesh, Plane=PlaneXY(0, 0, 0), ScaleX=division_3, ScaleY=division_4, ScaleZ=1)  # -> Geometry, Transform
scale = Scale(Geometry=scale_nu.Geometry, Center="0,0,0", Factor=division)  # -> Geometry, Transform

# ----
# Main vector
panel_5 = Panel("0")
pt_3 = ConstructPoint(XCoordinate=panel_5, YCoordinate=panel_5, ZCoordinate=0)

# ----
# ACTUAL GRAPH
txt = Text(psychrometricchart_2.rh_lines)
txt_2 = Text(psychrometricchart_2.enth_wb_lines)
cset = CreateSet(List=txt_2)  # -> Set, Map
cset_2 = CreateSet(List=txt)  # -> Set, Map
txt_3 = Text(psychrometricchart_2.hr_lines)
item_3 = ListItem(List=cset.Set, Index=0, Wrap=True)
cset_3 = CreateSet(List=txt_3)  # -> Set, Map
item_4 = ListItem(List=cset_2.Set, Index=0, Wrap=True)
mindex_3 = MemberIndex(Set=txt_2, Member=item_3)  # -> Index, Count
item_5 = ListItem(List=cset_3.Set, Index=0, Wrap=True)
txt_4 = Text(psychrometricchart_2.temp_lines)
mindex_4 = MemberIndex(Set=txt, Member=item_4)  # -> Index, Count
txt_5 = Text(psychrometricchart_2.title)
cset_4 = CreateSet(List=txt_4)  # -> Set, Map
item_6 = ListItem(List=psychrometricchart_2.enth_wb_lines, Index=mindex_3.Index, Wrap=True)
cull_i_5 = CullIndex(List=psychrometricchart_2.enth_wb_lines, Indices=mindex_3.Index, Wrap=True)
mindex_5 = MemberIndex(Set=txt_3, Member=item_5)  # -> Index, Count
cset_5 = CreateSet(List=txt_5)  # -> Set, Map
item_7 = ListItem(List=psychrometricchart_2.rh_lines, Index=mindex_4.Index, Wrap=True)
item_8 = ListItem(List=cset_4.Set, Index=0, Wrap=True)
item_9 = ListItem(List=cset_5.Set, Index=0, Wrap=True)
item_10 = ListItem(List=psychrometricchart_2.hr_lines, Index=mindex_5.Index, Wrap=True)
mindex_6 = MemberIndex(Set=txt_4, Member=item_8)  # -> Index, Count
cull_i_6 = CullIndex(List=psychrometricchart_2.rh_lines, Indices=mindex_4.Index, Wrap=True)
mindex_7 = MemberIndex(Set=txt_5, Member=item_9)  # -> Index, Count
item_11 = ListItem(List=psychrometricchart_2.temp_lines, Index=mindex_6.Index, Wrap=True)

# ---- group: Outline
item_12 = ListItem(List=psychrometricchart_2.title, Index=mindex_7.Index, Wrap=True)
scale_nu_2 = ScaleNU(Geometry=item_12, Plane=PlaneXY(0, 0, 0), ScaleX=division_3, ScaleY=division_4, ScaleZ=1)  # -> Geometry, Transform

# ---- group: ENTH lines
scale_nu_3 = ScaleNU(Geometry=item_6, Plane=PlaneXY(0, 0, 0), ScaleX=division_3, ScaleY=division_4, ScaleZ=1)  # -> Geometry, Transform

# ---- group: Vertical lines
scale_nu_4 = ScaleNU(Geometry=item_11, Plane=PlaneXY(0, 0, 0), ScaleX=division_3, ScaleY=division_4, ScaleZ=1)  # -> Geometry, Transform

# ---- group: RH lines
scale_nu_5 = ScaleNU(Geometry=item_7, Plane=PlaneXY(0, 0, 0), ScaleX=division_3, ScaleY=division_4, ScaleZ=1)  # -> Geometry, Transform

# ---- group: HR lines
scale_nu_6 = ScaleNU(Geometry=item_10, Plane=PlaneXY(0, 0, 0), ScaleX=division_3, ScaleY=division_4, ScaleZ=1)  # -> Geometry, Transform

# ----
# X - axis Labels
end = EndPoints(Curve=item_11)  # -> Start, End
scale_nu_7 = ScaleNU(Geometry=end.Start, Plane=PlaneXY(0, 0, 0), ScaleX=division_3, ScaleY=division_4, ScaleZ=1)  # -> Geometry, Transform
Y = UnitY(Factor=labels_offset)
move = Move(Geometry=scale_nu_7.Geometry, Motion=Y)  # -> Geometry, Transform
cull_i_7 = CullIndex(List=psychrometricchart_2.temp_lines, Indices=mindex_6.Index, Wrap=True)

# ----
# Title
panel_6 = Panel("Actual")

# ----
# MESH
panel_7 = Panel("10")
equals = Equality(FirstNumber=mindex.Count, SecondNumber="0")  # -> Equality, Inequality

# ---- group: Labels ENTH
end_2 = EndPoints(Curve=item_6)  # -> Start, End
vec = VectorXYZ(XComponent=labels_offset, YComponent=expr("-x", labels_offset), ZComponent=0)  # -> Vector, Length
scale_nu_8 = ScaleNU(Geometry=end_2.End, Plane=PlaneXY(0, 0, 0), ScaleX=division_3, ScaleY=division_4, ScaleZ=1)  # -> Geometry, Transform
move_2 = Move(Geometry=scale_nu_8.Geometry, Motion=vec.Vector)  # -> Geometry, Transform
cull_i_8 = CullIndex(List=psychrometricchart_2.temp_lines, Indices=mindex_6.Index, Wrap=True)
panel_8 = Panel("-1")

# ----
# Main title
panel_9 = Panel("Psychrometric chart_")
split = TextSplit(Text=importepw.location, Separators=",")
item_13 = ListItem(List=split, Index=0, Wrap=True)
Y_2 = UnitY(Factor=Slider(35, range=0..100))
Y_3 = UnitY(Factor=Slider(-12, range=-20..0))
move_3 = Move(Geometry=pt_2, Motion=Y_2)  # -> Geometry, Transform
concat = Concatenate(FragmentA=panel_9, FragmentB=item_13)

# ----
# Y- Axis title
panel_10 = Panel("Humidity ratio (Kg Water/Kg air)")
item_14 = ListItem(List=scale_nu_4.Geometry, Index="-1", Wrap=True)
multiplication_4 = Multiplication(A=labels_offset, B="7")
end_3 = EndPoints(Curve=item_14)  # -> Start, End
prot = RotatePlane(Plane=end_3.End, Angle=degrees("90"))
X_2 = UnitX(Factor=expr("-x", multiplication_4))
move_4 = Move(Geometry=prot, Motion=X_2)  # -> Geometry, Transform

neg = Negative(Value=multiplication_4)
addition_5 = Addition(A=addition_4, B=graps_width, C=neg, D=legend_distance)

pt_4 = ConstructPoint(XCoordinate=addition_5, YCoordinate=0, ZCoordinate=0)
legendpar = LBLegendParameters(
    seg_count=panel_7,
    colors=merge,
    continuous_leg=continuous_legend,
    num_decimals="0",
    base_plane=pt_4,
    seg_height=legend_height,
    text_height=labels_size)  # -> leg_par; plug-in component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
heatmap = LBSpatialHeatmap(values=mindex.Count, mesh=cullf, legend_par=legendpar, legend_title="h")  # -> mesh, legend, title, colors, legend_par, vis_set; plug-in component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
cullf_12 = CullFaces(Mesh=heatmap.mesh, Pattern=equals.Equality)

# ---- group: Actual
mesh_2 = Mesh(cullf_12)

# ---- group: Labels RH
end_4 = EndPoints(Curve=item_7)  # -> Start, End
vec_2 = VectorXYZ(XComponent=expr("x*2", labels_offset), YComponent=expr("x*2", labels_offset), ZComponent=0)  # -> Vector, Length
scale_nu_9 = ScaleNU(Geometry=end_4.End, Plane=PlaneXY(0, 0, 0), ScaleX=division_3, ScaleY=division_4, ScaleZ=1)  # -> Geometry, Transform
move_5 = Move(Geometry=scale_nu_9.Geometry, Motion=vec_2.Vector)  # -> Geometry, Transform
cull_i_9 = CullIndex(List=move_5.Geometry, Indices="-1", Wrap=True)

# ----
# X - axis title
panel_11 = Panel("4")
panel_12 = Panel("Dry bulb temperature (°C)")
multiplication_5 = Multiplication(A=labels_offset, B=panel_11)
Y_4 = UnitY(Factor=multiplication_5)
pt_5 = Point(Point(0, 0, 0))
move_6 = Move(Geometry=pt_5, Motion=Y_4)  # -> Geometry, Transform

# ---- group: Labels HR
end_5 = EndPoints(Curve=item_10)  # -> Start, End
vec_3 = VectorXYZ(XComponent=expr("-x", labels_offset), YComponent=expr("x*2", 0), ZComponent=0)  # -> Vector, Length
scale_nu_10 = ScaleNU(Geometry=end_5.Start, Plane=PlaneXY(0, 0, 0), ScaleX=division_3, ScaleY=division_4, ScaleZ=1)  # -> Geometry, Transform
move_7 = Move(Geometry=scale_nu_10.Geometry, Motion=vec_3.Vector)  # -> Geometry, Transform
cull_i_10 = CullIndex(List=psychrometricchart_2.hr_lines, Indices=mindex_5.Index, Wrap=True)

# ----
scale_nu_11 = ScaleNU(Geometry=mesh_2, Plane=PlaneXY(0, 0, 0), ScaleX=division_3, ScaleY=division_4, ScaleZ=1)  # -> Geometry, Transform

# ----
# Mesh
sort = SortList(Keys=mindex_2.Count)  # -> Keys, ValuesA
cset_6 = CreateSet(List=sort.Keys)  # -> Set, Map
item_15 = ListItem(List=cset_6.Set, Index="-1", Wrap=True)
legendpar_2 = LBLegendParameters(min="0", max=item_15, seg_count="5", colors=merge)  # -> leg_par; plug-in component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
heatmap_2 = LBSpatialHeatmap(values=mindex_2.Count, mesh=cullf, legend_par=legendpar_2)  # -> mesh, legend, title, colors, legend_par, vis_set; plug-in component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
equals_2 = Equality(FirstNumber=mindex_2.Count, SecondNumber="0")  # -> Equality, Inequality
cullf_13 = CullFaces(Mesh=heatmap_2.mesh, Pattern=equals_2.Equality)

# ---- group: Future
mesh_3 = Mesh(cullf_13)

# ---- group: Labels RH
scale_2 = Scale(Geometry=scale_nu_9.Geometry, Center=Point(0, 0, 0), Factor=division)  # -> Geometry, Transform

# ----
# Y - axis title
move_8 = Move(Geometry=move_4.Geometry, Motion=X)  # -> Geometry, Transform

# ----
# Lines
multiplication_6 = Multiplication(A=graphs_height, B=division)
addition_6 = Addition(A=multiplication_6, B=horizontal_spacing_upper_graphs)
Y_5 = UnitY(Factor=expr("-x", addition_6))
move_9 = Move(
    Geometry=[scale_nu_2.Geometry, scale_nu_4.Geometry, scale_nu_5.Geometry, scale_nu_6.Geometry, scale_nu_3.Geometry],
    Motion=Y_5)  # -> simplify(Geometry), Transform

cp = ControlPoints(Curve=move_9.Geometry)  # -> simplify(Points), Weights, Knots
item_16 = TreeItem(Tree=cp.Points, Path=panel_5, Index="1", Wrap=True)
vec2pt = Vector2Pt(PointA=item_16, PointB=pt_3, Unitize=False)  # -> Vector, Length

move_10 = Move(Geometry=pt_2, Motion=vec2pt.Vector)  # -> Geometry, Transform
tag = TextTag3D(Location=move_10.Geometry, Text=panel_6, Size=small_titles_size, Colour=labels_colour, Justification=7)

move_11 = Move(Geometry=move.Geometry, Motion=vec2pt.Vector)  # -> Geometry, Transform
tag_2 = TextTag3D(Location=move_11.Geometry, Text=cull_i_7, Size=labels_size, Colour=labels_colour, Justification=2)

# ----
# Legend actual-future
move_12 = Move(Geometry=heatmap.legend, Motion=vec2pt.Vector)  # -> Geometry, Transform
geo = Geometry(move_12.Geometry)

# ---- group: Labels ENTH (continued)
move_13 = Move(Geometry=move_2.Geometry, Motion=vec2pt.Vector)  # -> Geometry, Transform
tag_3 = TextTag3D(Location=move_13.Geometry, Text=cull_i_5, Size=labels_size, Colour=labels_colour, Justification=9)

# ----
move_14 = Move(Geometry=scale_nu_11.Geometry, Motion=vec2pt.Vector)  # -> Geometry, Transform
mesh_4 = Mesh(move_14.Geometry)

move_15 = Move(Geometry=move_6.Geometry, Motion=vec2pt.Vector)  # -> Geometry, Transform
tag_4 = TextTag3D(Location=move_15.Geometry, Text=panel_12, Size=labels_size, Colour=labels_colour, Justification=1)

move_16 = Move(Geometry=move_4.Geometry, Motion=vec2pt.Vector)  # -> Geometry, Transform
tag_5 = TextTag3D(Location=move_16.Geometry, Text=panel_10, Size=labels_size, Colour=labels_colour, Justification=3)

# ---- group: Labels HR (continued)
move_17 = Move(Geometry=move_7.Geometry, Motion=vec2pt.Vector)  # -> Geometry, Transform
tag_6 = TextTag3D(Location=move_17.Geometry, Text=cull_i_10, Size=labels_size, Colour=labels_colour, Justification=4)

# ----
move_18 = Move(
    Geometry=[scale_nu_2.Geometry, scale_nu_4.Geometry, scale_nu_5.Geometry, scale_nu_6.Geometry, scale_nu_3.Geometry],
    Motion=vec2pt.Vector)  # -> Geometry, Transform

move_19 = Move(Geometry=move_3.Geometry, Motion=vec2pt.Vector)  # -> Geometry, Transform
move_20 = Move(Geometry=move_19.Geometry, Motion=Y_3)  # -> Geometry, Transform
tag_7 = TextTag3D(Location=move_19.Geometry, Text=concat, Size=main_titles_size, Colour=labels_colour, Justification=7)
tag_8 = TextTag3D(
    Location=move_20.Geometry,
    Text="File: psychrometric_chart_actual_future_delta.gh",
    Size=small_titles_size,
    Colour=labels_colour,
    Justification=7)

# ---- group: Labels RH (continued)
move_21 = Move(Geometry=cull_i_9, Motion=vec2pt.Vector)  # -> Geometry, Transform
tag_9 = TextTag3D(Location=move_21.Geometry, Text=cull_i_6, Size=expr("x*0.6", labels_size), Colour=labels_colour, Justification=3)

# ----
# Lines
preview = CustomPreview(Geometry=move_18.Geometry, Material=lines_colour)

# ---- group: Base point
pt_6 = ConstructPoint(XCoordinate=0, YCoordinate=expr("-x", addition_6), ZCoordinate=0)

# ---- group: Labels RH
move_22 = Move(Geometry=move_21.Geometry, Motion=X)  # -> Geometry, Transform
tag_10 = TextTag3D(Location=move_22.Geometry, Text=cull_i_6, Size=expr("x*0.6", labels_size), Colour=labels_colour, Justification=3)

# ----
move_23 = Move(Geometry=move_8.Geometry, Motion=vec2pt.Vector)  # -> Geometry, Transform
tag_11 = TextTag3D(Location=move_23.Geometry, Text=panel_10, Size=labels_size, Colour=labels_colour, Justification=3)

scale_nu_12 = ScaleNU(Geometry=mesh_3, Plane=PlaneXY(0, 0, 0), ScaleX=division_3, ScaleY=division_4, ScaleZ=1)  # -> Geometry, Transform
move_24 = Move(Geometry=scale_nu_12.Geometry, Motion=X)  # -> Geometry, Transform
move_25 = Move(Geometry=move_24.Geometry, Motion=vec2pt.Vector)  # -> Geometry, Transform

# ----
# X - axis title
panel_13 = Panel("4")
multiplication_7 = Multiplication(A=labels_offset, B=panel_13)
subtraction_2 = Subtraction(A=addition_6, B=multiplication_7)
pt_7 = ConstructPoint(XCoordinate=0, YCoordinate=expr("-x", subtraction_2), ZCoordinate=0)
pt_8 = Point(Point(0, 0, 0))
move_26 = Move(Geometry=pt_8, Motion=pt_7)  # -> Geometry, Transform
move_27 = Move(Geometry=move_26.Geometry, Motion=vec2pt.Vector)  # -> Geometry, Transform
tag_12 = TextTag3D(Location=move_27.Geometry, Text="Dry bulb temperature (°C)", Size=labels_size, Colour=labels_colour, Justification=1)

# ----
# Lines
move_28 = Move(
    Geometry=[scale_nu_2.Geometry, scale_nu_4.Geometry, scale_nu_5.Geometry, scale_nu_6.Geometry, scale_nu_3.Geometry],
    Motion=X)  # -> Geometry, Transform
move_29 = Move(Geometry=move_28.Geometry, Motion=vec2pt.Vector)  # -> Geometry, Transform
preview_2 = CustomPreview(Geometry=move_29.Geometry, Material=lines_colour)

# ----
# FUTURE GRAPH
# Title
X_3 = UnitX(Factor=addition_4)
move_30 = Move(Geometry=pt_2, Motion=X_3)  # -> Geometry, Transform
move_31 = Move(Geometry=move_30.Geometry, Motion=vec2pt.Vector)  # -> Geometry, Transform
tag_13 = TextTag3D(Location=move_31.Geometry, Text="Future", Size=small_titles_size, Colour=labels_colour, Justification=7)

# ----
# Y- Axis title
panel_14 = Panel("Humidity ratio (Kg Water/Kg air)")
vec_4 = VectorXYZ(XComponent=addition_4, YComponent=expr("-x", subtraction_2), ZComponent=0)  # -> Vector, Length
move_32 = Move(Geometry=move_4.Geometry, Motion=vec_4.Vector)  # -> Geometry, Transform
move_33 = Move(Geometry=move_32.Geometry, Motion=vec2pt.Vector)  # -> Geometry, Transform
tag_14 = TextTag3D(Location=move_33.Geometry, Text=panel_14, Size=labels_size, Colour=labels_colour, Justification=3)

# ----
# Labels ENTH
move_34 = Move(Geometry=move_2.Geometry, Motion=X)  # -> Geometry, Transform
move_35 = Move(Geometry=move_34.Geometry, Motion=vec2pt.Vector)  # -> Geometry, Transform
tag_15 = TextTag3D(Location=move_35.Geometry, Text=cull_i_5, Size=labels_size, Colour=labels_colour, Justification=9)

# ----
# X - axis Labels
move_36 = Move(Geometry=move.Geometry, Motion=X)  # -> Geometry, Transform
move_37 = Move(Geometry=move_36.Geometry, Motion=vec2pt.Vector)  # -> Geometry, Transform
tag_16 = TextTag3D(Location=move_37.Geometry, Text=cull_i_7, Size=labels_size, Colour=labels_colour, Justification=2)

# ----
# Y - axis labels
move_38 = Move(Geometry=move_7.Geometry, Motion=X)  # -> Geometry, Transform
move_39 = Move(Geometry=move_38.Geometry, Motion=vec2pt.Vector)  # -> Geometry, Transform
tag_17 = TextTag3D(Location=move_39.Geometry, Text=cull_i_10, Size=labels_size, Colour=labels_colour, Justification=4)

# ----
# X- axis title
move_40 = Move(Geometry=move_6.Geometry, Motion=X)  # -> Geometry, Transform
move_41 = Move(Geometry=move_40.Geometry, Motion=vec2pt.Vector)  # -> Geometry, Transform
tag_18 = TextTag3D(Location=move_41.Geometry, Text=panel_12, Size=labels_size, Colour=labels_colour, Justification=1)

# ----
# X - axis Labels
subtraction_3 = Subtraction(A=labels_offset, B=addition_6)
scale_3 = Scale(Geometry=scale_nu_7.Geometry, Center=Point(0, 0, 0), Factor=division)  # -> Geometry, Transform
Y_6 = UnitY(Factor=subtraction_3)
move_42 = Move(Geometry=scale_3.Geometry, Motion=Y_6)  # -> Geometry, Transform
move_43 = Move(Geometry=move_42.Geometry, Motion=vec2pt.Vector)  # -> Geometry, Transform
tag_19 = TextTag3D(Location=move_43.Geometry, Text=cull_i_7, Size=labels_size, Colour=labels_colour, Justification=2)

# ---- group: Labels RH (continued)
move_44 = Move(Geometry=scale_2.Geometry, Motion=Y_6)  # -> Geometry, Transform
move_45 = Move(Geometry=move_44.Geometry, Motion=vec2pt.Vector)  # -> Geometry, Transform
cull_i_11 = CullIndex(List=move_45.Geometry, Indices="-1", Wrap=True)
tag_20 = TextTag3D(Location=cull_i_11, Text=cull_i_6, Size=expr("x*0.6", labels_size), Colour=labels_colour, Justification=3)

# ----
# Y - axis labels
vec_5 = VectorXYZ(XComponent=expr("-x", labels_offset), YComponent=expr("-x", Y_5), ZComponent=0)  # -> Vector, Length
scale_4 = Scale(Geometry=scale_nu_10.Geometry, Center=Point(0, 0, 0), Factor=division)  # -> Geometry, Transform
move_46 = Move(Geometry=scale_4.Geometry, Motion=vec_5.Vector)  # -> Geometry, Transform
move_47 = Move(Geometry=move_46.Geometry, Motion=vec2pt.Vector)  # -> Geometry, Transform
tag_21 = TextTag3D(Location=move_47.Geometry, Text=cull_i_10, Size=labels_size, Colour=labels_colour, Justification=4)

# ----
# Isoenthalpic labels
move_48 = Move(Geometry=move_2.Geometry, Motion=Y_5)  # -> Geometry, Transform
scale_5 = Scale(Geometry=move_48.Geometry, Center=pt_6, Factor=division)  # -> Geometry, Transform
move_49 = Move(Geometry=scale_5.Geometry, Motion=vec2pt.Vector)  # -> Geometry, Transform
tag_22 = TextTag3D(Location=move_49.Geometry, Text=cull_i_5, Size=labels_size, Colour=labels_colour, Justification=9)

# ----
# Legend
merge_2 = Merge(
    Data1=swatch_12,
    Data2=swatch_11,
    Data3=swatch_10,
    Data4=swatch_9,
    Data5=swatch_8,
    Data6=swatch_7,
    Data7=swatch_6,
    Data8=swatch_5,
    Data9=swatch_4,
    Data10=swatch_3)  # -> flatten(Result)
pt_9 = ConstructPoint(XCoordinate=addition_5, YCoordinate=expr("-x", addition_6), ZCoordinate=0)
panel_15 = Panel("""-50 ÷ -40
-40 ÷ -30
-30 ÷ -20
-20 ÷ -10
-10 ÷ 1
1 ÷ 10
10 ÷ 20
20 ÷ 30
30 ÷ 40
40 ÷ 50""")
panel_16 = Panel("""-40
-30
-20
-10
10
20
30
40
50""")
legendparcategorized = LBLegendParametersCategorized(
    domain=panel_16,
    colors=merge_2,
    categories=panel_15,
    continuous_leg=continuous_legend,
    base_plane=pt_9,
    seg_height=legend_height,
    text_height=labels_size)  # -> leg_par; plug-in component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
heatmap_3 = LBSpatialHeatmap(values=subtraction, mesh=cullf, legend_par=legendparcategorized, legend_title="Δh")  # -> mesh, legend, title, colors, legend_par, vis_set; plug-in component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
move_50 = Move(Geometry=heatmap_3.legend, Motion=vec2pt.Vector)  # -> Geometry, Transform
geo_2 = Geometry(move_50.Geometry)

# ----
# Title
number_slider = Slider(310, range=0..400)
Y_7 = UnitY(Factor=expr("-x", number_slider))
scale_6 = Scale(Geometry=pt_2, Center=Point(0, 0, 0), Factor=division)  # -> Geometry, Transform
move_51 = Move(Geometry=scale_6.Geometry, Motion=Y_7)  # -> Geometry, Transform
move_52 = Move(Geometry=move_51.Geometry, Motion=vec2pt.Vector)  # -> Geometry, Transform
tag_23 = TextTag3D(Location=move_52.Geometry, Text="Delta", Size=small_titles_size, Colour=labels_colour, Justification=7)

scale_7 = Scale(Geometry=move_9.Geometry, Center=pt_6, Factor=division)  # -> Geometry, Transform

move_53 = Move(Geometry=scale_7.Geometry, Motion=vec2pt.Vector)  # -> Geometry, Transform

preview_3 = CustomPreview(Geometry=move_53.Geometry, Material=lines_colour)
