# Grasshopper definition seasonal_sun_path_diagrams_actual_future_delta.gh (Grasshopper 1.0.8)
# plug-ins: Human, LadybugGrasshopper

# ----
# File: seasonal_sun_path_diagrams_actual_future_delta.gh
# Additional plugins: Ladybug Tools version 1.8.0
# 1. Insert path to current EPW
current_epw = FilePath("D:\Marcello\Dropbox\PhD Parma\BERKELEY\CLIMA TOOL\PHASE 2\Paper 1\EPWs\Wien-Hohe_Warte-hour_PRESENT.epw")

# ----
# 2. Insert path to future EPW
future_epw = FilePath("D:\Marcello\Dropbox\PhD Parma\BERKELEY\CLIMA TOOL\PHASE 2\Paper 1\EPWs\Wien-Hohe_Warte-hour_2050.epw")

# ----
# Settings
main_title_vertical_position = Slider(184, range=0..300)
vertical_distance_graphs = Slider(171, range=0..500)
texts_hrizontal_position = Slider(-133, range=-200..200)
legend_text_size = Slider(5, range=0..10)
title_size = Slider(7, range=0..10)
text_size = Slider(6.3, range=0..10)
labels_colour = ColourSwatch(SwatchColor=RGB(0, 0, 0))
lines_colour = ColourSwatch(SwatchColor=RGB(204, 204, 204))

# ----
# 3- Set the thresholds for harmful solar conditions in summer
global_horizontal_radiation_wh_m2 = Slider(250, range=200..400)
dry_bulb_temperature_c = Slider(30, range=20..50)

# ----
# 4. Set the thresholds for useful solar conditions in winter
dry_bulb_temperature_c_2 = Slider(26, range=20..50)
global_horizontal_radiation_wh_m2_2 = Slider(200, range=200..400)

# ----
# 5. Turn the toggle into "true" to run the script
falsestart = LBFalseStartToggle(True)

# ---- group: Data colours
swatch = ColourSwatch(SwatchColor=RGB(165, 0, 38))
swatch_2 = ColourSwatch(SwatchColor=RGB(230, 172, 0))
swatch_3 = ColourSwatch(SwatchColor=RGB(54, 75, 154))

# ----
dispatch = Dispatch(List=current_epw, DispatchPattern=falsestart)  # -> ListA, ListB
dispatch_2 = Dispatch(List=future_epw, DispatchPattern=falsestart)  # -> ListA, ListB

# ---- group: Harmful positions in summer
# Data - harmful positions
importepw = LBImportEPW(epw_file=dispatch.ListA)  # -> location, dry_bulb_temperature, dew_point_temperature, relative_humidity, wind_speed, wind_direction, direct_normal_rad, diffuse_horizontal_rad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; plug-in component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
importepw_2 = LBImportEPW(epw_file=dispatch_2.ListA)  # -> location, dry_bulb_temperature, dew_point_temperature, relative_humidity, wind_speed, wind_direction, direct_normal_rad, diffuse_horizontal_rad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; plug-in component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
analysisperiod = LBAnalysisPeriod(start_hour=0)  # -> period, hoys, dates; plug-in component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
applyper = LBApplyAnalysisPeriod(data=importepw.dry_bulb_temperature, period=analysisperiod.period)  # -> data; plug-in component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
applyper_2 = LBApplyAnalysisPeriod(data=importepw.global_horizontal_rad, period=analysisperiod.period)  # -> data; plug-in component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
applyper_3 = LBApplyAnalysisPeriod(data=importepw_2.dry_bulb_temperature, period=analysisperiod.period)  # -> data; plug-in component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
applyper_4 = LBApplyAnalysisPeriod(data=importepw_2.global_horizontal_rad, period=analysisperiod.period)  # -> data; plug-in component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
xdata = LBDeconstructData(data=applyper)  # -> header, values; plug-in component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
xdata_2 = LBDeconstructData(data=applyper_2)  # -> header, values; plug-in component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
xdata_3 = LBDeconstructData(data=applyper_3)  # -> header, values; plug-in component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
xdata_4 = LBDeconstructData(data=applyper_4)  # -> header, values; plug-in component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
panel = Panel("400")
panel_2 = Panel("26")
larger = LargerThan(FirstNumber=xdata.values, SecondNumber=dry_bulb_temperature_c)  # -> LargerThan, OrEqualTo
larger_2 = LargerThan(FirstNumber=xdata_2.values, SecondNumber=global_horizontal_radiation_wh_m2)  # -> LargerThan, OrEqualTo
larger_3 = LargerThan(FirstNumber=xdata_3.values, SecondNumber=dry_bulb_temperature_c)  # -> LargerThan, OrEqualTo
larger_4 = LargerThan(FirstNumber=xdata_4.values, SecondNumber=global_horizontal_radiation_wh_m2)  # -> LargerThan, OrEqualTo
and = GateAnd(A=larger.OrEqualTo, B=larger_2.OrEqualTo)
and_2 = GateAnd(A=larger_3.OrEqualTo, B=larger_4.OrEqualTo)
series = Series(Start=0, Step=1, Count="8760")
series_2 = Series(Start=0, Step=1, Count="8760")
number_slider = Slider(10, range=1..10)
number_slider_2 = Slider(0.25, range=0..1)
cull = CullPattern(List=series_2, CullPattern=and)
cull_2 = CullPattern(List=series_2, CullPattern=and_2)
multiplication = Multiplication(A=number_slider, B=number_slider_2)
multiplication_2 = Multiplication(A=number_slider, B=number_slider_2)
sunpath = LBSunPath(location=importepw_2.location, hoys=cull, scale=multiplication_2)  # -> report, vectors, altitudes, azimuths, hoys, sun_pts, analemma, daily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; plug-in component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
sunpath_2 = LBSunPath(location=importepw.location, hoys=cull_2, scale=multiplication)  # -> report, vectors, altitudes, azimuths, hoys, sun_pts, analemma, daily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; plug-in component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
cset = CreateSet(List=sunpath.sun_pts)  # -> Set, Map
cset_2 = CreateSet(List=sunpath_2.sun_pts)  # -> Set, Map
intersection = SetIntersection(SetA=cset.Set, SetB=cset_2.Set)
difference = SetDifference(SetA=cset_2.Set, SetB=intersection)
difference_2 = SetDifference(SetA=cset.Set, SetB=intersection)
pdecon = Deconstruct(Point=difference)  # -> XComponent, YComponent, ZComponent
pdecon_2 = Deconstruct(Point=cset.Set)  # -> XComponent, YComponent, ZComponent
sort = SortList(Keys=pdecon.YComponent)  # -> Keys, ValuesA
sort_2 = SortList(Keys=pdecon_2.YComponent)  # -> Keys, ValuesA
item = ListItem(List=sort.Keys, Index=0, Wrap=True)
item_2 = ListItem(List=sort_2.Keys, Index=0, Wrap=True)
mindex = MemberIndex(Set=pdecon.YComponent, Member=item)  # -> Index, Count
mindex_2 = MemberIndex(Set=pdecon_2.YComponent, Member=item_2)  # -> Index, Count
item_3 = ListItem(List=difference, Index=mindex.Index, Wrap=True)
item_4 = ListItem(List=cset.Set, Index=mindex_2.Index, Wrap=True)

# Harmful inclinations
pt = Point(Point(0, 0, 0))
ln = Line(StartPoint=pt, EndPoint=item_4)
ln_2 = Line(StartPoint=pt, EndPoint=item_3)
yz = YZPlane(Origin=Point(0, 0, 0))
number_slider_3 = Slider(10, range=0..10)
project = Project(Geometry=ln, Plane=yz)  # -> Geometry, Transform
project_2 = Project(Geometry=ln_2, Plane=yz)  # -> Geometry, Transform
ext = ExtendCurve(Curve=project_2.Geometry, Type=0, Start="0", End=number_slider_3)
ext_2 = ExtendCurve(Curve=project.Geometry, Type=0, Start="0", End=number_slider_3)

# Harmful points
future_values_ray = Slider(2, range=0..5)
future_values_ray_2 = Slider(0.8, range=0..5)
xy = XYPlane(Origin=difference_2)
X = UnitX(Factor=1)
xy_2 = XYPlane(Origin=intersection)
X_2 = UnitX(Factor=1)
xy_3 = XYPlane(Origin=difference)
X_3 = UnitX(Factor=1)
padjust = AdjustPlane(Plane=xy, Normal=X)
padjust_2 = AdjustPlane(Plane=xy_2, Normal=X_2)
padjust_3 = AdjustPlane(Plane=xy_3, Normal=X_3)
cir = Circle(Plane=padjust_3, Radius=future_values_ray)
cir_2 = Circle(Plane=padjust, Radius=future_values_ray)
cir_3 = Circle(Plane=padjust_2, Radius=future_values_ray_2)

# ----
split = TextSplit(Text=importepw.location, Separators=",")
Y = UnitY(Factor=Slider(295, range=0..1000))
item_5 = ListItem(List=split, Index=0, Wrap=True)

# ---- group: Harmful positions in summer
yz_2 = YZPlane(Origin=Point(0, 0, 0))

# Delta
number_slider_4 = Slider(0.7, range=0..10)
number_slider_5 = Slider(0.5, range=0..1)
scale = Scale(Geometry=[sunpath_2.analemma, sunpath_2.daily, sunpath_2.compass], Center=Point(0, 0, 0), Factor=number_slider_5)  # -> Geometry, Transform
scale_2 = Scale(Geometry=cir_2, Center=Point(0, 0, 0), Factor=number_slider_5)  # -> Geometry, Transform
scale_3 = Scale(Geometry=cir_3, Center=Point(0, 0, 0), Factor=number_slider_5)  # -> Geometry, Transform
scale_4 = Scale(Geometry=cir, Center=Point(0, 0, 0), Factor=number_slider_5)  # -> Geometry, Transform
scale_5 = Scale(Geometry=ext_2, Center=Point(0, 0, 0), Factor=number_slider_5)  # -> Geometry, Transform
scale_6 = Scale(Geometry=ext, Center=Point(0, 0, 0), Factor=number_slider_5)  # -> Geometry, Transform
orient = Orient(Geometry=scale.Geometry, Source=yz_2, Target=PlaneXY(0, 0, 0))  # -> Geometry, Transform
orient_2 = Orient(Geometry=scale_4.Geometry, Source=yz_2, Target=PlaneXY(0, 0, 0))  # -> Geometry, Transform
orient_3 = Orient(Geometry=scale_2.Geometry, Source=yz_2, Target=PlaneXY(0, 0, 0))  # -> Geometry, Transform
orient_4 = Orient(Geometry=scale_5.Geometry, Source=yz_2, Target=PlaneXY(0, 0, 0))  # -> Geometry, Transform
orient_5 = Orient(Geometry=scale_3.Geometry, Source=yz_2, Target=PlaneXY(0, 0, 0))  # -> Geometry, Transform
orient_6 = Orient(Geometry=scale_6.Geometry, Source=yz_2, Target=PlaneXY(0, 0, 0))  # -> Geometry, Transform
previewlw = CustomPreviewLineweights(Geometry=orient_4.Geometry, Shader=swatch_3, Thickness=number_slider_4, Absolute=True)
previewlw_2 = CustomPreviewLineweights(Geometry=orient_6.Geometry, Shader=swatch, Thickness=number_slider_4, Absolute=True)

# Future
Z = UnitZ(Factor=vertical_distance_graphs)
pt_2 = Point(Point(0, 0, 0))
move = Move(Geometry=pt_2, Motion=Z)  # -> Geometry, Transform
move_2 = Move(Geometry=cir, Motion=Z)  # -> Geometry, Transform
move_3 = Move(Geometry=[sunpath_2.analemma, sunpath_2.daily, sunpath_2.compass], Motion=Z)  # -> Geometry, Transform
move_4 = Move(Geometry=ext, Motion=Z)  # -> Geometry, Transform
scale_7 = Scale(Geometry=move_2.Geometry, Center=move.Geometry, Factor=number_slider_5)  # -> Geometry, Transform
scale_8 = Scale(Geometry=move_3.Geometry, Center=move.Geometry, Factor=number_slider_5)  # -> Geometry, Transform
scale_9 = Scale(Geometry=move_4.Geometry, Center=move.Geometry, Factor=number_slider_5)  # -> Geometry, Transform
orient_7 = Orient(Geometry=scale_7.Geometry, Source=yz_2, Target=PlaneXY(0, 0, 0))  # -> Geometry, Transform
orient_8 = Orient(Geometry=scale_8.Geometry, Source=yz_2, Target=PlaneXY(0, 0, 0))  # -> Geometry, Transform
orient_9 = Orient(Geometry=scale_9.Geometry, Source=yz_2, Target=PlaneXY(0, 0, 0))  # -> Geometry, Transform
previewlw_3 = CustomPreviewLineweights(Geometry=orient_7.Geometry, Shader=swatch, Thickness=number_slider_4, Absolute=True)
preview = CustomPreview(Geometry=orient_8.Geometry, Material=lines_colour)
previewlw_4 = CustomPreviewLineweights(Geometry=orient_9.Geometry, Shader=swatch, Thickness=number_slider_4, Absolute=True)

# Actual
panel_3 = Panel("2")
multiplication_3 = Multiplication(A=vertical_distance_graphs, B=panel_3)
Z_2 = UnitZ(Factor=multiplication_3)
move_5 = Move(Geometry=cir_2, Motion=Z_2)  # -> Geometry, Transform
move_6 = Move(Geometry=pt_2, Motion=Z_2)  # -> Geometry, Transform
move_7 = Move(Geometry=[sunpath_2.analemma, sunpath_2.daily, sunpath_2.compass], Motion=Z_2)  # -> Geometry, Transform
move_8 = Move(Geometry=ext_2, Motion=Z_2)  # -> Geometry, Transform
scale_10 = Scale(Geometry=move_5.Geometry, Center=move_6.Geometry, Factor=number_slider_5)  # -> Geometry, Transform
scale_11 = Scale(Geometry=move_7.Geometry, Center=move_6.Geometry, Factor=number_slider_5)  # -> Geometry, Transform
scale_12 = Scale(Geometry=move_8.Geometry, Center=move_6.Geometry, Factor=number_slider_5)  # -> Geometry, Transform
orient_10 = Orient(Geometry=scale_11.Geometry, Source=yz_2, Target=PlaneXY(0, 0, 0))  # -> Geometry, Transform
orient_11 = Orient(Geometry=scale_12.Geometry, Source=yz_2, Target=PlaneXY(0, 0, 0))  # -> Geometry, Transform
orient_12 = Orient(Geometry=scale_10.Geometry, Source=yz_2, Target=PlaneXY(0, 0, 0))  # -> Geometry, Transform
preview_2 = CustomPreview(Geometry=orient_10.Geometry, Material=lines_colour)
previewlw_5 = CustomPreviewLineweights(Geometry=orient_12.Geometry, Shader=swatch_3, Thickness=number_slider_4, Absolute=True)
previewlw_6 = CustomPreviewLineweights(Geometry=orient_11.Geometry, Shader=swatch_3, Thickness=number_slider_4, Absolute=True)

# Parameters harmful positions
panel_4 = Panel("""Parameters:

Dry bulb temperature > """)
panel_5 = Panel(""" °C
Global Horizontal Radiation > """)
pt_3 = ConstructPoint(XCoordinate=0, YCoordinate=texts_hrizontal_position, ZCoordinate=Slider(-44, range=-200..200))
yz_3 = YZPlane(Origin=pt_3)
concat = Concatenate(
    FragmentA=panel_4,
    FragmentE=dry_bulb_temperature_c,
    FragmentC=panel_5,
    FragmentG=global_horizontal_radiation_wh_m2,
    FragmentD=" kw/m2")
orient_13 = Orient(Geometry=yz_3, Source=yz_2, Target=PlaneXY(0, 0, 0))  # -> Geometry, Transform
tag = TextTag3D(Location=orient_13.Geometry, Text=concat, Size=text_size, Colour=labels_colour, Justification=7)

# Title harmful positions
panel_6 = Panel("Harmful solar positions in summer")
addition = Addition(A=main_title_vertical_position, B=multiplication_3)
pt_4 = ConstructPoint(XCoordinate=0, YCoordinate=texts_hrizontal_position, ZCoordinate=addition)
yz_4 = YZPlane(Origin=pt_4)
orient_14 = Orient(Geometry=yz_4, Source=yz_2, Target=PlaneXY(0, 0, 0))  # -> Geometry, Transform
tag_2 = TextTag3D(Location=orient_14.Geometry, Text=panel_6, Size=title_size, Colour=labels_colour, Justification=7)

# ----
# Graph titles
number_slider_6 = Slider(119, range=0..1000)
addition_2 = Addition(A=vertical_distance_graphs, B=number_slider_6)
addition_3 = Addition(A=vertical_distance_graphs, B=addition_2)
merge = Merge(Data1=number_slider_6, Data2=addition_2, Data3=addition_3)  # -> reverse(Result)
pt_5 = ConstructPoint(XCoordinate=0, YCoordinate=texts_hrizontal_position, ZCoordinate=0)
yz_5 = YZPlane(Origin=pt_5)
Z_3 = UnitZ(Factor=merge)
move_9 = Move(Geometry=yz_5, Motion=Z_3)  # -> graft(Geometry), Transform
move_10 = Move(Geometry=move_9.Geometry, Motion=Y)  # -> Geometry, Transform
panel_7 = Panel("""Actual
Future
Delta""")
orient_15 = Orient(Geometry=[move_9.Geometry, move_10.Geometry], Source=yz_2, Target=PlaneXY(0, 0, 0))  # -> Geometry, Transform
tag_3 = TextTag3D(Location=orient_15.Geometry, Text=graft(panel_7), Size=text_size, Colour=labels_colour, Justification=7)

# ---- group: Harmful positions in summer / Cerchi
previewlw_7 = CustomPreviewLineweights(Geometry=orient_2.Geometry, Shader=swatch, Thickness=number_slider_4, Absolute=True)
previewlw_8 = CustomPreviewLineweights(Geometry=orient_3.Geometry, Shader=swatch_3, Thickness=number_slider_4, Absolute=True)
preview_3 = CustomPreview(Geometry=orient_5.Geometry, Material=swatch_2)

# ---- group: Harmful positions in summer / Diagram
preview_4 = CustomPreview(Geometry=orient.Geometry, Material=lines_colour)

# ----
# Data - useful positions
importepw_3 = LBImportEPW(epw_file=dispatch_2.ListA)  # -> location, dry_bulb_temperature, dew_point_temperature, relative_humidity, wind_speed, wind_direction, direct_normal_rad, diffuse_horizontal_rad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; plug-in component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
# Useful positions in winter
importepw_4 = LBImportEPW(epw_file=dispatch.ListA)  # -> location, dry_bulb_temperature, dew_point_temperature, relative_humidity, wind_speed, wind_direction, direct_normal_rad, diffuse_horizontal_rad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; plug-in component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
analysisperiod_2 = LBAnalysisPeriod(start_hour=0)  # -> period, hoys, dates; plug-in component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
applyper_5 = LBApplyAnalysisPeriod(data=importepw_4.dry_bulb_temperature, period=analysisperiod_2.period)  # -> data; plug-in component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
applyper_6 = LBApplyAnalysisPeriod(data=importepw_4.global_horizontal_rad, period=analysisperiod_2.period)  # -> data; plug-in component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
applyper_7 = LBApplyAnalysisPeriod(data=importepw_3.dry_bulb_temperature, period=analysisperiod_2.period)  # -> data; plug-in component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
applyper_8 = LBApplyAnalysisPeriod(data=importepw_3.global_horizontal_rad, period=analysisperiod_2.period)  # -> data; plug-in component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
xdata_5 = LBDeconstructData(data=applyper_5)  # -> header, values; plug-in component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
xdata_6 = LBDeconstructData(data=applyper_6)  # -> header, values; plug-in component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
xdata_7 = LBDeconstructData(data=applyper_7)  # -> header, values; plug-in component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
xdata_8 = LBDeconstructData(data=applyper_8)  # -> header, values; plug-in component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
smaller = SmallerThan(FirstNumber=xdata_5.values, SecondNumber=dry_bulb_temperature_c_2)  # -> SmallerThan, OrEqualTo
larger_5 = LargerThan(FirstNumber=xdata_6.values, SecondNumber=global_horizontal_radiation_wh_m2_2)  # -> LargerThan, OrEqualTo
smaller_2 = SmallerThan(FirstNumber=xdata_7.values, SecondNumber=dry_bulb_temperature_c_2)  # -> SmallerThan, OrEqualTo
larger_6 = LargerThan(FirstNumber=xdata_8.values, SecondNumber=global_horizontal_radiation_wh_m2_2)  # -> LargerThan, OrEqualTo
and_3 = GateAnd(A=smaller.OrEqualTo, B=larger_5.OrEqualTo)
and_4 = GateAnd(A=smaller_2.OrEqualTo, B=larger_6.OrEqualTo)
series_3 = Series(Start=0, Step=1, Count="8760")
series_4 = Series(Start=0, Step=1, Count="8760")
cull_3 = CullPattern(List=series_4, CullPattern=and_3)
cull_4 = CullPattern(List=series_4, CullPattern=and_4)
multiplication_4 = Multiplication(A=number_slider, B=number_slider_2)
multiplication_5 = Multiplication(A=number_slider, B=number_slider_2)
sunpath_3 = LBSunPath(location=importepw_3.location, hoys=cull_3, scale=multiplication_4)  # -> report, vectors, altitudes, azimuths, hoys, sun_pts, analemma, daily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; plug-in component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
sunpath_4 = LBSunPath(location=importepw_4.location, hoys=cull_4, scale=multiplication_5)  # -> report, vectors, altitudes, azimuths, hoys, sun_pts, analemma, daily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; plug-in component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
cset_3 = CreateSet(List=sunpath_3.sun_pts)  # -> Set, Map
cset_4 = CreateSet(List=sunpath_4.sun_pts)  # -> Set, Map
intersection_2 = SetIntersection(SetA=cset_3.Set, SetB=cset_4.Set)
difference_3 = SetDifference(SetA=cset_4.Set, SetB=intersection_2)
difference_4 = SetDifference(SetA=cset_3.Set, SetB=intersection_2)
Y_2 = UnitY(Factor=Slider(-260, range=-500..0))
pdecon_3 = Deconstruct(Point=cset_3.Set)  # -> XComponent, YComponent, ZComponent
pdecon_4 = Deconstruct(Point=difference_3)  # -> XComponent, YComponent, ZComponent
sort_3 = SortList(Keys=pdecon_3.YComponent)  # -> Keys, ValuesA
sort_4 = SortList(Keys=pdecon_4.YComponent)  # -> Keys, ValuesA
item_6 = ListItem(List=sort_3.Keys, Index=0, Wrap=True)
item_7 = ListItem(List=sort_4.Keys, Index=0, Wrap=True)
mindex_3 = MemberIndex(Set=pdecon_3.YComponent, Member=item_6)  # -> Index, Count
mindex_4 = MemberIndex(Set=pdecon_4.YComponent, Member=item_7)  # -> Index, Count
item_8 = ListItem(List=cset_3.Set, Index=mindex_3.Index, Wrap=True)
item_9 = ListItem(List=difference_3, Index=mindex_4.Index, Wrap=True)

# ----
# Main title
number_slider_7 = Slider(119, range=0..1000)
addition_4 = Addition(A=vertical_distance_graphs, B=number_slider_7)
addition_5 = Addition(A=vertical_distance_graphs, B=addition_4)
merge_2 = Merge(Data1=number_slider_7, Data2=addition_4, Data3=addition_5)  # -> reverse(Result)
pt_6 = ConstructPoint(XCoordinate=0, YCoordinate=texts_hrizontal_position, ZCoordinate=0)
yz_6 = YZPlane(Origin=pt_6)
Z_4 = UnitZ(Factor=merge_2)
move_11 = Move(Geometry=yz_6, Motion=Z_4)  # -> graft(Geometry), Transform
Y_3 = UnitY(Factor=Slider(50, range=0..50))
move_12 = Move(Geometry=move_11.Geometry, Motion=Y)  # -> Geometry, Transform
move_13 = Move(Geometry=orient_14.Geometry, Motion=Y_3)  # -> Geometry, Transform
orient_16 = Orient(Geometry=[move_11.Geometry, move_12.Geometry], Source=yz_2, Target=PlaneXY(0, 0, 0))  # -> Geometry, Transform
concat_2 = Concatenate(FragmentA="Seasonal_sun_path_diagrams_", FragmentB=item_5)
tag_4 = TextTag3D(Location=move_13.Geometry, Text=graft(concat_2), Size=title_size, Colour=labels_colour, Justification=7)

# ----
# File name
panel_10 = Panel("seasonal_sun_path_diagrams_actual_future_delta.gh")
Y_4 = UnitY(Factor=Slider(-12, range=-15..0))
move_14 = Move(Geometry=move_13.Geometry, Motion=Y_4)  # -> Geometry, Transform
tag_5 = TextTag3D(Location=move_14.Geometry, Text=graft(panel_10), Size=text_size, Colour=labels_colour, Justification=7)

# ----
# Useful points
future_values_ray_3 = Slider(2, range=0..5)
future_values_ray_4 = Slider(0.8, range=0..5)
xy_4 = XYPlane(Origin=difference_4)
X_4 = UnitX(Factor=1)
xy_5 = XYPlane(Origin=intersection_2)
X_5 = UnitX(Factor=1)
xy_6 = XYPlane(Origin=difference_3)
X_6 = UnitX(Factor=1)
padjust_4 = AdjustPlane(Plane=xy_4, Normal=X_4)
padjust_5 = AdjustPlane(Plane=xy_5, Normal=X_5)
padjust_6 = AdjustPlane(Plane=xy_6, Normal=X_6)
cir_4 = Circle(Plane=padjust_6, Radius=future_values_ray_3)
cir_5 = Circle(Plane=padjust_4, Radius=future_values_ray_3)
cir_6 = Circle(Plane=padjust_5, Radius=future_values_ray_4)

# ----
# Useful inclinations
pt_7 = Point(Point(0, 0, 0))
yz_7 = YZPlane(Origin=Point(0, 0, 0))
ln_3 = Line(StartPoint=pt_7, EndPoint=item_9)
ln_4 = Line(StartPoint=pt_7, EndPoint=item_8)
number_slider_8 = Slider(10, range=0..10)
project_3 = Project(Geometry=ln_3, Plane=yz_7)  # -> Geometry, Transform
project_4 = Project(Geometry=ln_4, Plane=yz_7)  # -> Geometry, Transform
ext_3 = ExtendCurve(Curve=project_3.Geometry, Type=0, Start="0", End=number_slider_8)
ext_4 = ExtendCurve(Curve=project_4.Geometry, Type=0, Start="0", End=number_slider_8)

# ----
# Delta
number_slider_9 = Slider(0.7, range=0..10)
move_15 = Move(Geometry=cir_5, Motion=Y)  # -> Geometry, Transform
move_16 = Move(Geometry=[sunpath_4.analemma, sunpath_4.daily, sunpath_4.compass], Motion=Y)  # -> Geometry, Transform
move_17 = Move(Geometry=pt, Motion=Y)  # -> Geometry, Transform
move_18 = Move(Geometry=cir_4, Motion=Y)  # -> Geometry, Transform
move_19 = Move(Geometry=cir_6, Motion=Y)  # -> Geometry, Transform
scale_13 = Scale(Geometry=move_18.Geometry, Center=move_17.Geometry, Factor=number_slider_5)  # -> Geometry, Transform
scale_14 = Scale(Geometry=move_15.Geometry, Center=move_17.Geometry, Factor=number_slider_5)  # -> Geometry, Transform
scale_15 = Scale(Geometry=move_19.Geometry, Center=move_17.Geometry, Factor=number_slider_5)  # -> Geometry, Transform
scale_16 = Scale(Geometry=move_16.Geometry, Center=move_17.Geometry, Factor=number_slider_5)  # -> Geometry, Transform
orient_17 = Orient(Geometry=scale_16.Geometry, Source=yz_2, Target=PlaneXY(0, 0, 0))  # -> Geometry, Transform
orient_18 = Orient(Geometry=scale_15.Geometry, Source=yz_2, Target=PlaneXY(0, 0, 0))  # -> Geometry, Transform
orient_19 = Orient(Geometry=scale_13.Geometry, Source=yz_2, Target=PlaneXY(0, 0, 0))  # -> Geometry, Transform
orient_20 = Orient(Geometry=scale_14.Geometry, Source=yz_2, Target=PlaneXY(0, 0, 0))  # -> Geometry, Transform

# ----
# Actual
panel_11 = Panel("2")
multiplication_6 = Multiplication(A=vertical_distance_graphs, B=panel_11)
Z_5 = UnitZ(Factor=multiplication_6)
move_20 = Move(Geometry=move_17.Geometry, Motion=Z_5)  # -> Geometry, Transform
move_21 = Move(Geometry=cir_5, Motion=Z_5)  # -> Geometry, Transform
move_22 = Move(Geometry=[sunpath_4.analemma, sunpath_4.daily, sunpath_4.compass], Motion=Z_5)  # -> Geometry, Transform
move_23 = Move(Geometry=move_21.Geometry, Motion=Y)  # -> Geometry, Transform
move_24 = Move(Geometry=move_22.Geometry, Motion=Y)  # -> Geometry, Transform
scale_17 = Scale(Geometry=move_23.Geometry, Center=move_20.Geometry, Factor=number_slider_5)  # -> Geometry, Transform
scale_18 = Scale(Geometry=move_24.Geometry, Center=move_20.Geometry, Factor=number_slider_5)  # -> Geometry, Transform
orient_21 = Orient(Geometry=scale_17.Geometry, Source=yz_2, Target=PlaneXY(0, 0, 0))  # -> Geometry, Transform
orient_22 = Orient(Geometry=scale_18.Geometry, Source=yz_2, Target=PlaneXY(0, 0, 0))  # -> Geometry, Transform
previewlw_9 = CustomPreviewLineweights(Geometry=orient_21.Geometry, Shader=swatch_3, Thickness=number_slider_9, Absolute=True)
preview_5 = CustomPreview(Geometry=orient_22.Geometry, Material=lines_colour)

# ----
# Future
Z_6 = UnitZ(Factor=vertical_distance_graphs)
move_25 = Move(Geometry=move_17.Geometry, Motion=Z_6)  # -> Geometry, Transform
move_26 = Move(Geometry=[sunpath_4.analemma, sunpath_4.daily, sunpath_4.compass], Motion=Z_6)  # -> Geometry, Transform
move_27 = Move(Geometry=cir_4, Motion=Z_6)  # -> Geometry, Transform
move_28 = Move(Geometry=move_26.Geometry, Motion=Y)  # -> Geometry, Transform
move_29 = Move(Geometry=move_27.Geometry, Motion=Y)  # -> Geometry, Transform
scale_19 = Scale(Geometry=move_28.Geometry, Center=move_25.Geometry, Factor=number_slider_5)  # -> Geometry, Transform
scale_20 = Scale(Geometry=move_29.Geometry, Center=move_25.Geometry, Factor=number_slider_5)  # -> Geometry, Transform
orient_23 = Orient(Geometry=scale_20.Geometry, Source=yz_2, Target=PlaneXY(0, 0, 0))  # -> Geometry, Transform
orient_24 = Orient(Geometry=scale_19.Geometry, Source=yz_2, Target=PlaneXY(0, 0, 0))  # -> Geometry, Transform
preview_6 = CustomPreview(Geometry=orient_24.Geometry, Material=lines_colour)
previewlw_10 = CustomPreviewLineweights(Geometry=orient_23.Geometry, Shader=swatch, Thickness=number_slider_9, Absolute=True)

# ----
# Parameters useful positions
number_slider_10 = Slider(-44, range=-200..200)
panel_12 = Panel(""" °C
Global Horizontal Radiation > """)
panel_13 = Panel("""Parameters:

Dry bulb temperature < """)
pt_8 = ConstructPoint(XCoordinate=0, YCoordinate=texts_hrizontal_position, ZCoordinate=number_slider_10)
yz_8 = YZPlane(Origin=pt_8)
move_30 = Move(Geometry=yz_8, Motion=Y)  # -> Geometry, Transform
orient_25 = Orient(Geometry=move_30.Geometry, Source=yz_2, Target=PlaneXY(0, 0, 0))  # -> Geometry, Transform
concat_3 = Concatenate(
    FragmentA=panel_13,
    FragmentE=dry_bulb_temperature_c_2,
    FragmentC=panel_12,
    FragmentG=global_horizontal_radiation_wh_m2_2,
    FragmentD=" kw/m2")
tag_6 = TextTag3D(Location=orient_25.Geometry, Text=concat_3, Size=text_size, Colour=labels_colour, Justification=7)

# ----
# Title useful positions
addition_6 = Addition(A=main_title_vertical_position, B=multiplication_6)
pt_9 = ConstructPoint(XCoordinate=0, YCoordinate=texts_hrizontal_position, ZCoordinate=addition_6)
yz_9 = YZPlane(Origin=pt_9)
move_31 = Move(Geometry=yz_9, Motion=Y)  # -> Geometry, Transform
orient_26 = Orient(Geometry=move_31.Geometry, Source=yz_2, Target=PlaneXY(0, 0, 0))  # -> Geometry, Transform
tag_7 = TextTag3D(
    Location=orient_26.Geometry,
    Text="Useful solar positions in winter",
    Size=title_size,
    Colour=labels_colour,
    Justification=7)

# ---- group: Diagram
preview_7 = CustomPreview(Geometry=orient_17.Geometry, Material=lines_colour)

# ---- group: Cerchi
previewlw_11 = CustomPreviewLineweights(Geometry=orient_19.Geometry, Shader=swatch, Thickness=number_slider_9, Absolute=True)
previewlw_12 = CustomPreviewLineweights(Geometry=orient_20.Geometry, Shader=swatch_3, Thickness=number_slider_9, Absolute=True)
preview_8 = CustomPreview(Geometry=orient_18.Geometry, Material=swatch_2)

# ----
# Legend
number_slider_11 = Slider(10, range=0..50)
number_slider_12 = Slider(15, range=0..50)
number_slider_13 = Slider(449, range=0..1000)
item_10 = ListItem(List=scale_13.Geometry, Index=0, Wrap=True)
item_11 = ListItem(List=scale_14.Geometry, Index=0, Wrap=True)
item_12 = ListItem(List=scale_15.Geometry, Index=0, Wrap=True)
darc = DeconstructArc(Arc=item_10)  # -> BasePlane, Radius, Angle
darc_2 = DeconstructArc(Arc=item_11)  # -> BasePlane, Radius, Angle
darc_3 = DeconstructArc(Arc=item_12)  # -> BasePlane, Radius, Angle
multiplication_7 = Multiplication(A=number_slider_12, B="2")
deplane = DeconstructPlane(Plane=darc.BasePlane)  # -> Origin, XAxis, YAxis, ZAxis
deplane_2 = DeconstructPlane(Plane=darc_2.BasePlane)  # -> Origin, XAxis, YAxis, ZAxis
pt_10 = ConstructPoint(XCoordinate=0, YCoordinate=number_slider_13, ZCoordinate=multiplication_7)
pt_11 = ConstructPoint(XCoordinate=0, YCoordinate=number_slider_13, ZCoordinate=number_slider_12)
deplane_3 = DeconstructPlane(Plane=darc_3.BasePlane)  # -> Origin, XAxis, YAxis, ZAxis
pt_12 = ConstructPoint(XCoordinate=0, YCoordinate=number_slider_13, ZCoordinate=0)
vec2pt = Vector2Pt(PointA=deplane.Origin, PointB=pt_10, Unitize=False)  # -> Vector, Length
vec2pt_2 = Vector2Pt(PointA=deplane_2.Origin, PointB=pt_11, Unitize=False)  # -> Vector, Length
vec2pt_3 = Vector2Pt(PointA=deplane_3.Origin, PointB=pt_12, Unitize=False)  # -> Vector, Length
move_32 = Move(Geometry=item_10, Motion=vec2pt.Vector)  # -> Geometry, Transform
move_33 = Move(Geometry=item_11, Motion=vec2pt_2.Vector)  # -> Geometry, Transform
move_34 = Move(Geometry=item_12, Motion=vec2pt_3.Vector)  # -> Geometry, Transform
orient_27 = Orient(Geometry=move_32.Geometry, Source=yz_2, Target=PlaneXY(0, 0, 0))  # -> Geometry, Transform
orient_28 = Orient(Geometry=move_33.Geometry, Source=yz_2, Target=PlaneXY(0, 0, 0))  # -> Geometry, Transform
Y_5 = UnitY(Factor=number_slider_11)
orient_29 = Orient(Geometry=move_34.Geometry, Source=yz_2, Target=PlaneXY(0, 0, 0))  # -> Geometry, Transform
Y_6 = UnitY(Factor=number_slider_11)
Y_7 = UnitY(Factor=number_slider_11)
previewlw_13 = CustomPreviewLineweights(Geometry=orient_27.Geometry, Shader=swatch, Thickness=number_slider_9, Absolute=True)
previewlw_14 = CustomPreviewLineweights(Geometry=orient_28.Geometry, Shader=swatch_3, Thickness=number_slider_9, Absolute=True)
preview_9 = CustomPreview(Geometry=orient_29.Geometry, Material=swatch_2)
move_35 = Move(Geometry=move_32.Geometry, Motion=Y_5)  # -> Geometry, Transform
move_36 = Move(Geometry=move_34.Geometry, Motion=Y_6)  # -> Geometry, Transform
move_37 = Move(Geometry=move_33.Geometry, Motion=Y_7)  # -> Geometry, Transform
yz_10 = YZPlane(Origin=move_35.Geometry)
yz_11 = YZPlane(Origin=move_36.Geometry)
yz_12 = YZPlane(Origin=move_37.Geometry)
rotate = Rotate(Geometry=move_35.Geometry, Angle=degrees("90"), Plane=yz_10)  # -> Geometry, Transform
rotate_2 = Rotate(Geometry=move_36.Geometry, Angle=degrees("90"), Plane=yz_11)  # -> Geometry, Transform
rotate_3 = Rotate(Geometry=move_37.Geometry, Angle=degrees("90"), Plane=yz_12)  # -> Geometry, Transform
orient_30 = Orient(Geometry=rotate.Geometry, Source=yz_2, Target=PlaneXY(0, 0, 0))  # -> Geometry, Transform
orient_31 = Orient(Geometry=rotate_2.Geometry, Source=yz_2, Target=PlaneXY(0, 0, 0))  # -> Geometry, Transform
orient_32 = Orient(Geometry=rotate_3.Geometry, Source=yz_2, Target=PlaneXY(0, 0, 0))  # -> Geometry, Transform
tag_8 = TextTag3D(
    Location=orient_30.Geometry,
    Text="Only future sun positions",
    Size=legend_text_size,
    Colour=labels_colour,
    Justification=7)
tag_9 = TextTag3D(Location=orient_31.Geometry, Text="Shared sun positions", Size=legend_text_size, Colour=labels_colour, Justification=7)
tag_10 = TextTag3D(
    Location=orient_32.Geometry,
    Text="Only actual sun positions",
    Size=legend_text_size,
    Colour=labels_colour,
    Justification=7)
