# Grasshopper definition thermal_comfort_stategies.gh (Grasshopper 1.0.8)

# ----
# Settings
legend_horizontal_position = Slider(18, range=0..50)
main_title_position = Slider(20, range=0..50)
y_axis_title_position = Slider(-17, range=-91..0)
filename_position = Slider(40, range=0..40)
main_title_size = Slider(7, range=0..10)
graph_height = Slider(200, range=0..1000)
labels_offset = Slider(-3, range=-3..0)
graph_width = Slider(600, range=0..700)
labels_size = Slider(5, range=0..10)
bars_width = Slider(14, range=1..100)
labels_colour = ColourSwatch(SwatchColor=RGB(0, 0, 0))

# ----
# thermal_comfort_strategies.gh
# Additional plugins: Ladybug Tools v. 1.8.0
# 1. Insert path to current EPW
actual_epw = FilePath("D:\Marcello\Dropbox\PhD Parma\BERKELEY\CLIMA TOOL\EPWs\Berkeley_Actual.epw")

# ----
# 2. Insert path to future EPW
future_epw = FilePath("D:\Marcello\Dropbox\PhD Parma\BERKELEY\CLIMA TOOL\EPWs\Berkeley_2070-8.5.epw")

# ----
# Data colours
future_values_colour = ColourSwatch(SwatchColor=RGB(221, 61, 45))
actual_values_colour = ColourSwatch(SwatchColor=RGB(74, 123, 183))
delta_values_colour = ColourSwatch(SwatchColor=RGB(153, 153, 153))

# ----
# Data
importepw = LBImportEPW(epw_file=actual_epw)  # -> location, dry_bulb_temperature, dew_point_temperature, relative_humidity, wind_speed, wind_direction, direct_normal_rad, diffuse_horizontal_rad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; plug-in component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
importepw_2 = LBImportEPW(epw_file=future_epw)  # -> location, dry_bulb_temperature, dew_point_temperature, relative_humidity, wind_speed, wind_direction, direct_normal_rad, diffuse_horizontal_rad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; plug-in component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
strategies = LBPassiveStrategies({"Evaporative Cooling", "Mass + Night Vent", "Occupant Use of Fans", "Capture Internal Heat", "Passive Solar Heating"}, selected=["Evaporative Cooling", "Mass + Night Vent", "Occupant Use of Fans", "Capture Internal Heat", "Passive Solar Heating"])
psychrometricchart = LBPsychrometricChart(
    temperature=importepw.dry_bulb_temperature,
    rel_humidity=importepw.relative_humidity,
    pressure=importepw.barometric_pressure)  # -> report, title, temp_lines, rh_lines, hr_lines, enth_wb_lines, mesh, legend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; plug-in component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
psychrometricchart_2 = LBPsychrometricChart(
    temperature=importepw_2.dry_bulb_temperature,
    rel_humidity=importepw_2.relative_humidity,
    pressure=importepw_2.barometric_pressure)  # -> report, title, temp_lines, rh_lines, hr_lines, enth_wb_lines, mesh, legend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; plug-in component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
pmv_polygon = LBPMVPolygon(psych_chart=psychrometricchart_2.psych_chart, strategies=strategies, solar_data=importepw_2.global_horizontal_rad)  # -> report, total_comfort, total_comf_data, polygon_names, polygon_comfort, polygon_data, comfort_poly, strategy_poly; plug-in component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
pmv_polygon_2 = LBPMVPolygon(psych_chart=psychrometricchart.psych_chart, strategies=strategies, solar_data=importepw.global_horizontal_rad)  # -> report, total_comfort, total_comf_data, polygon_names, polygon_comfort, polygon_data, comfort_poly, strategy_poly; plug-in component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

# ----
# Graph lines
subtraction = Subtraction(A=pmv_polygon.polygon_comfort, B=pmv_polygon_2.polygon_comfort)
num = Number([pmv_polygon_2.polygon_comfort, pmv_polygon.polygon_comfort, subtraction])
series = Series(Start="-50", Step="5", Count="50")
fsim = FindSimilarMember(Data=num, Set=series)  # -> Hit, Index
bnd = Bounds(Numbers=num)
bnd_2 = Bounds(Numbers=fsim.Hit)
dedomain = DeconstructDomain(Domain=bnd)  # -> Start, End
dedomain_2 = DeconstructDomain(Domain=bnd_2)  # -> Start, End
subtraction_2 = Subtraction(A=dedomain_2.Start, B="5")
larger = LargerThan(FirstNumber=dedomain.Start, SecondNumber=dedomain_2.Start)  # -> LargerThan, OrEqualTo
addition = Addition(A=dedomain_2.End, B="5")
smaller = SmallerThan(FirstNumber=dedomain.End, SecondNumber=dedomain_2.End)  # -> SmallerThan, OrEqualTo
cull = CullPattern(List=subtraction_2, CullPattern=invert(larger.OrEqualTo))
cull_2 = CullPattern(List=dedomain_2.Start, CullPattern=larger.OrEqualTo)
cull_3 = CullPattern(List=addition, CullPattern=invert(smaller.OrEqualTo))
cull_4 = CullPattern(List=dedomain_2.End, CullPattern=smaller.OrEqualTo)
merge = Merge(Data1=cull, Data2=cull_2)
merge_2 = Merge(Data1=cull_3, Data2=cull_4)
abs = Absolute(Value=merge)
addition_2 = Addition(A=abs, B=merge_2)
division = Division(A=addition_2, B="5")
division_2 = Division(A=graph_height, B=division)
addition_3 = Addition(A=division, B="1")
division_3 = Division(A=division_2, B="5")
series_2 = Series(Start=merge, Step="5", Count=addition_3)
multiplication = Multiplication(A=division_3, B=series_2)
Y = UnitY(Factor=multiplication)
int = Integer(multiplication)
int_2 = Integer("0")
mindex = MemberIndex(Set=int, Member=int_2)  # -> Index, Count
secondary_lines_colour = ColourSwatch(SwatchColor=RGB(178, 178, 178))
main_line_colour = ColourSwatch(SwatchColor=RGB(128, 128, 128))

# ----
# Bars
panel = Panel("6")
multiplication_2 = Multiplication(A=bars_width, B=panel)
multiplication_3 = Multiplication(A="10", B="2")
multiplication_4 = Multiplication(A=multiplication_2, B="3")
subtraction_3 = Subtraction(A=graph_width, B=multiplication_3)
subtraction_4 = Subtraction(A=subtraction_3, B=multiplication_4)
subtraction_5 = Subtraction(A=panel, B="1")
division_4 = Division(A=subtraction_4, B=subtraction_5)
multiplication_5 = Multiplication(A=bars_width, B="3")
number_slider = Slider(0, range=0..200)
addition_4 = Addition(A=division_4, B=multiplication_5)
multiplication_6 = Multiplication(A=bars_width, B="2")
addition_5 = Addition(A=bars_width, B="10")
addition_6 = Addition(A=multiplication_6, B="10")
series_3 = Series(Start=addition_6, Step=addition_4, Count="6")  # -> graft(Series)
series_4 = Series(Start="10", Step=addition_4, Count=panel)  # -> graft(Series)
series_5 = Series(Start=addition_5, Step=addition_4, Count="6")  # -> graft(Series)
multiplication_7 = Multiplication(A=subtraction, B=division_3)
pt = ConstructPoint(XCoordinate=series_3, YCoordinate=number_slider, ZCoordinate=0)
multiplication_8 = Multiplication(A=pmv_polygon.polygon_comfort, B=division_3)
pt_2 = ConstructPoint(XCoordinate=series_5, YCoordinate=number_slider, ZCoordinate=0)
pt_3 = ConstructPoint(XCoordinate=series_4, YCoordinate=number_slider, ZCoordinate=0)
multiplication_9 = Multiplication(A=pmv_polygon_2.polygon_comfort, B=division_3)
rectangle = Rectangle(Plane=pt, XSize=bars_width, YSize=graft(multiplication_7), Radius=0)  # -> Rectangle, Length
rectangle_2 = Rectangle(Plane=pt_2, XSize=bars_width, YSize=graft(multiplication_8), Radius=0)  # -> Rectangle, Length
rectangle_3 = Rectangle(Plane=pt_3, XSize=bars_width, YSize=graft(multiplication_9), Radius=0)  # -> Rectangle, Length
boundary = BoundarySurfaces(Edges=rectangle.Rectangle)
boundary_2 = BoundarySurfaces(Edges=rectangle_3.Rectangle)
boundary_3 = BoundarySurfaces(Edges=rectangle_2.Rectangle)
mcol = MeshColours(Mesh=boundary, Colours=delta_values_colour)
mcol_2 = MeshColours(Mesh=boundary_3, Colours=future_values_colour)
mcol_3 = MeshColours(Mesh=boundary_2, Colours=actual_values_colour)

pt_4 = ConstructPoint(XCoordinate=0, YCoordinate=number_slider, ZCoordinate=0)
line = LineSDL(Start=pt_4, Direction="1,0,0", Length=graph_width)
move = Move(Geometry=line, Motion=Y)  # -> Geometry, Transform
cull_i = CullIndex(List=move.Geometry, Indices=mindex.Index, Wrap=True)
item = ListItem(List=move.Geometry, Index=mindex.Index, Wrap=True)
item_2 = ListItem(List=move.Geometry, Index=0, Wrap=True)
end = EndPoints(Curve=move.Geometry)  # -> Start, End
end_2 = EndPoints(Curve=item_2)  # -> Start, End
preview = CustomPreview(Geometry=cull_i, Material=secondary_lines_colour)
preview_2 = CustomPreview(Geometry=item, Material=main_line_colour)

# ----
# Y - axis title
X = UnitX(Factor=y_axis_title_position)
move_2 = Move(Geometry=end_2.Start, Motion=X)  # -> Geometry, Transform
prot = RotatePlane(Plane=move_2.Geometry, Angle=degrees("90"))
tag = TextTag3D(Location=prot, Text="% of hours", Size=labels_size, Colour=labels_colour, Justification=7)

# ----
# X - axis labels
item_3 = ListItem(List=end.Start, Index=0, Wrap=True)
pdecon = Deconstruct(Point=item_3)  # -> XComponent, YComponent, ZComponent
Y_2 = UnitY(Factor=labels_offset)
pt_5 = ConstructPoint(XCoordinate=series_5, YCoordinate=pdecon.YComponent, ZCoordinate=0)
move_3 = Move(Geometry=pt_5, Motion=Y_2)  # -> Geometry, Transform
tag_2 = TextTag3D(Location=move_3.Geometry, Text=graft(pmv_polygon.polygon_names), Size=labels_size, Colour=labels_colour, Justification=2)

# ----
# Main title
panel_2 = Panel("-1")
item_4 = ListItem(List=move.Geometry, Index=panel_2, Wrap=True)
end_3 = EndPoints(Curve=item_4)  # -> Start, End
Y_3 = UnitY(Factor=main_title_position)
move_4 = Move(Geometry=end_3.Start, Motion=Y_3)  # -> Geometry, Transform
tag_3 = TextTag3D(Location=move_4.Geometry, Text="Thermal comfort strategies", Size=main_title_size, Colour=labels_colour, Justification=7)

# ----
# Y - axis labels
X_2 = UnitX(Factor=labels_offset)
move_5 = Move(Geometry=end.Start, Motion=X_2)  # -> Geometry, Transform
tag_4 = TextTag3D(Location=graft(move_5.Geometry), Text=graft(series_2), Size=labels_size, Colour=labels_colour, Justification=6)

# ----
# Legend
merge_3 = Merge(Data1=actual_values_colour, Data2=future_values_colour, Data3=delta_values_colour)
X_3 = UnitX(Factor=legend_horizontal_position)
panel_3 = Panel("""Actual
Future
Delta""")
consec = ConsecutiveDomains(Numbers=["0", "1", "2"], Additive=True)
move_6 = Move(Geometry=end_2.End, Motion=X_3)  # -> Geometry, Transform
legendparcategorized = LBLegendParametersCategorized(
    domain=consec,
    colors=merge_3,
    categories=panel_3,
    base_plane=move_6.Geometry,
    seg_height="14",
    seg_width="7",
    text_height=labels_size)  # -> leg_par; plug-in component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
panel_4 = Panel("""0
10""")
createlegend = LBCreateLegend(values=panel_4, legend_par=legendparcategorized)  # -> mesh, title_obj, label_objs, label_text, colors; plug-in component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

# ----
# Filename
panel_5 = Panel("thermal_comfort_strategies.gh")
Y_4 = UnitY(Factor=filename_position)
move_7 = Move(Geometry=move_4.Geometry, Motion=Y_4)  # -> Geometry, Transform
tag_5 = TextTag3D(Location=move_7.Geometry, Text=panel_5, Size=main_title_size, Colour=labels_colour, Justification=7)
